vi "Add_Parts.gviweb"   [G Web Development Software 22.3.0]
inputs:
  "Imput XML": string
  "Error input": error
outputs:
  "Output all Parts": string[]
  "Output": error
diagram:
  s1 = uninitialised  # shift register
  s2 = string[] []  # shift register
  while (iteration -> i1) {
    case (i1) {
      frame 0 {
        Match Pattern(regular expression="<_", string=$"Imput XML") -> (after substring=w4, match substring=w5)
        Match Pattern(regular expression=">", string=w4) -> (before substring=w6, match substring=w7)
        case (w6) {
          frame "False", Default {
            w1 = s2
            w2 = $"Imput XML"
            w3 = FALSE
          }
          frame "1", "10", "2", "3", "4", "5", "6", "7", "8", "9" {
            Concatenate Strings(w5, w6, w7) -> w8
            Match Pattern(regular expression=w8, string=$"Imput XML") -> (after substring=w9)
            Concatenate Strings("</_", w6, w7) -> w10
            Match Pattern(regular expression=w10, string=w9) -> (after substring=w2, before substring=w11)
            Insert Into Array(inArray=s2, new=w11) -> w1
            w3 = FALSE
          }
        }
      }
      frame 1, Default {
        Match Pattern(regular expression="<_", string=s1) -> (after substring=w12, match substring=w13)
        Match Pattern(regular expression=">", string=w12) -> (before substring=w14, match substring=w15)
        case (w14) {
          frame "False", Default {
            w1 = s2
            w2 = s1
            w3 = TRUE
          }
          frame "1", "10", "2", "3", "4", "5", "6", "7", "8", "9" {
            Concatenate Strings(w13, w14, w15) -> w16
            Match Pattern(regular expression=w16, string=s1) -> (after substring=w17)
            Concatenate Strings("</_", w14, w15) -> w18
            Match Pattern(regular expression=w18, string=w17) -> (after substring=w2, before substring=w19)
            Insert Into Array(inArray=s2, new=w19) -> w1
            w3 = FALSE
          }
        }
      }
    }
    Is Empty String Or Path(string/path=w2) -> w20
    Logical Or(w20, w3) -> w21
    next s1 = w2
    next s2 = w1
    stop if w21
  }
  $"Output all Parts" <- s2
  $Output <- $"Error input"
