vi "Add_offset_time_txt.gviweb"   [G Web Development Software 22.3.0]
inputs:
  "Start date and time": string
  "time offset (sec)": string
  "Error input": error
outputs:
  "Date and time": string
  "timestamp": timestamp
  "Output Error": error
  "Duration in seconds": f64
uses:
  NI::G Core::Error::Clear Error Cluster.gvi
  NI::G Core::Strings::Search and Replace Pattern.gvi
diagram:
  Scan From String(formatString="%<%Y.%m.%d %H:%M:%S>T", inputString=$"Start date and time", errIn=$"Error input", default=1904-01-01T00:00:00Z) -> (errOut=w1, out0=w2)
  call "Clear Error Cluster.gvi"(error in=w1) -> (error out=w3)
  $"Output Error" <- w3
  Scan Value(format string="%3s", string=$"time offset (sec)") -> (output string=w4, value=w5)
  Multiply(w5, 3600) -> w6
  Search Or Split String(offset=1, search string/char=":", string=w4) -> (match + rest of string=w7, substring before match=w8)
  call "Search and Replace Pattern.gvi"(string=w7, pattern=":") -> (result string=w9)
  Floating Point String To Number(string=w9) -> (number=w10)
  call "Search and Replace Pattern.gvi"(string=w8, pattern=":") -> (result string=w11)
  Floating Point String To Number(string=w11) -> (number=w12)
  Multiply(w12, 60) -> w13
  Add(w13, w10, w6) -> w14
  Timestamp Add(x=w2, y=w14) -> w15
  $timestamp <- w15
  Get Date And Time String(date format (0)="long", time stamp=w15, want seconds? (F)=TRUE) -> (date string=w16, time string=w17)
  Concatenate Strings(w16, " ", w17) -> w18
  $"Date and time" <- w18
  $"Duration in seconds" <- w14
