vi "Calculate_duration_for_iCC.gviweb"   [G Web Development Software 22.3.0]
inputs:
  "Start date and time": string = "2022.02.22 10:23:00"
  "Last date and time": string = "2022.02.22 11:23:44"
  "Error input": error
outputs:
  "Output Error": error
  "Duration": string
  "TimeStamp": timestamp
  "Duration time": f64
uses:
  NI::G Core::Strings::Search and Replace Pattern.gvi
  NI::G Core::Error::Clear Error Cluster.gvi
diagram:
  Match Pattern(regular expression="/", string=$"Last date and time") -> (after substring=w1, before substring=w2, match substring=w3)
  String Subset(length (rest)=6, string=w2) -> w4
  String Subset(offset (0)=6, string=w2) -> w5
  Concatenate Strings("20", w5) -> w6
  Concatenate Strings(w4, w6, w3, w1) -> w7
  call "Search and Replace Pattern.gvi"(string=w7, pattern="/", replace all=TRUE) -> (result string=w8)
  Scan From String(formatString="%<%d.%m.%Y %H:%M:%S>T", inputString=w8, errIn=$"Error input", default=1904-01-01T00:00:00Z) -> (errOut=w9, out0=w10)
  $TimeStamp <- w10
  String Length(string=$"Start date and time") -> (length=w11)
  Is Greater Than 0(x=w11) -> w12
  case (w12) {
    frame False, Default {
      w13 = $"Last date and time"
    }
    frame True {
      w13 = $"Start date and time"
    }
  }
  Match Pattern(regular expression="/", string=w13) -> (after substring=w14, before substring=w15, match substring=w16)
  String Subset(length (rest)=6, string=w15) -> w17
  String Subset(offset (0)=6, string=w15) -> w18
  Concatenate Strings("20", w18) -> w19
  Concatenate Strings(w17, w19, w16, w14) -> w20
  call "Search and Replace Pattern.gvi"(string=w20, pattern="/", replace all=TRUE) -> (result string=w21)
  Scan From String(formatString="%<%d.%m.%Y %H:%M:%S>T", inputString=w21, default=1904-01-01T00:00:00Z) -> (errOut=w22, out0=w23)
  call "Clear Error Cluster.gvi"(error in=w22) -> (error out=w24)
  call "Clear Error Cluster.gvi"(error in=w9) -> (error out=w25)
  Timestamp Subtract(x=w10, y=w23) -> w26
  Is Greater Than 0(x=w26) -> w27
  case (w27) {
    frame False, Default {
      w28 = "0"
      w29 = w25
    }
    frame True {
      Quotient And Remainder(x=w26, y=3600) -> (floor(x/y)=w30, x-y*floor(x/y)=w31)
      Number To Decimal String(number=w30) -> (decimal integer string=w32)
      String Length(string=w32) -> (length=w33)
      Is Greater Or Equal(x=w33, y=2) -> w34
      case (w34) {
        frame False, Default {
          Concatenate Strings("0", w32) -> w35
        }
        frame True {
          w35 = w32
        }
      }
      Quotient And Remainder(x=w31, y=60) -> (floor(x/y)=w36, x-y*floor(x/y)=w37)
      Number To Decimal String(number=w36) -> (decimal integer string=w38)
      String Length(string=w38) -> (length=w39)
      Is Greater Or Equal(x=w39, y=2) -> w40
      case (w40) {
        frame False, Default {
          Concatenate Strings("0", w38) -> w41
        }
        frame True {
          w41 = w38
        }
      }
      Number To Decimal String(number=w37) -> (decimal integer string=w42)
      String Length(string=w42) -> (length=w43)
      Is Greater Or Equal(x=w43, y=2) -> w44
      case (w44) {
        frame False, Default {
          Concatenate Strings("0", w42) -> w45
        }
        frame True {
          w45 = w42
        }
      }
      Concatenate Strings(w35, ":", w41, ":", w45) -> w28
      w29 = w25
    }
  }
  $"Output Error" <- w29
  $"Duration time" <- w26
  $Duration <- w28
