vi "Check_File_Content_iCombi_Pro.gviweb"   [G Web Development Software 22.3.0]
inputs:
  "Error input": error
  "Inhalt Haccp": string
  "file type": string
outputs:
  "Error Output": error
  "HACCP File Content": string
  "i Combi Pro ?": bool
uses:
  NI::G Core::Strings::Search and Replace Pattern.gvi
  NI::G Core::Strings::Trim Whitespace.gvi
diagram:
  case ($"file type") {
    frame ".txt", Default {
      Match Pattern(regular expression="Dev-Typ", string=$"Inhalt Haccp") -> (after substring=w2)
      Match Pattern(regular expression="<<", string=w2) -> (before substring=w3)
      call "Search and Replace Pattern.gvi"(string=w3, pattern=">>") -> (result string=w1)
    }
    frame ".xml" {
      Match Pattern(regular expression="1.2>", string=$"Inhalt Haccp") -> (after substring=w4)
      Match Pattern(regular expression="</_1.2", string=w4) -> (before substring=w5)
      call "Search and Replace Pattern.gvi"(string=w5, pattern=">>") -> (result string=w1)
    }
  }
  call "Trim Whitespace.gvi"(string=w1) -> (trimmed string=w6)
  case (w6) {
    frame "False", Default {
      w10 = "The device type is incorrect, select a correct iCombi-pro HACCP file!"
      One Button Dialog(button name ("OK")="OK", message=w10)
      w11 = "❌"  # String {0}
      w7 = w11
      w8 = $"Error input"
      w9 = FALSE
    }
    frame "623", "E101", "E102", "E201", "E202", "E523", "E61", "E61T", "E62", "E623", "G101", "G102", "G201", "G202", "G61", "G62" {
      w7 = "✅"
      w8 = $"Error input"
      w9 = TRUE
    }
  }
  $"Error Output" <- w8
  $"HACCP File Content" <- w7
  $"i Combi Pro ?" <- w9
