vi "Check_content_iCC.gviweb"   [G Web Development Software 22.3.0]
inputs:
  "Inhalt Haccp": string
  "Error input": error
outputs:
  "HACCP File Content": string
  "i Combi Classic?": bool
  "Error Output": error
panel indicators:
  "trimmed string": string
uses:
  NI::G Core::Strings::Trim Whitespace.gvi
diagram:
  Match Pattern(regular expression="CMP", string=$"Inhalt Haccp") -> (after substring=w1)
  Is Empty String Or Path(string/path=w1) -> w2
  case (w2) {
    frame False, Default {
      w3 = w1
    }
    frame True {
      Match Pattern(regular expression="iCC", string=$"Inhalt Haccp") -> (after substring=w3)
    }
  }
  Match Pattern(regular expression=";", string=w3) -> (before substring=w4)
  call "Trim Whitespace.gvi"(string=w4) -> (trimmed string=w5)
  String Length(string=w5) -> (length=w6)
  Is Greater Than 0(x=w6) -> w7
  case (w7) {
    frame False, Default {
      w11 = "The device type is incorrect, select a correct iCombi-Classic HACCP file!"
      One Button Dialog(button name ("OK")="OK", message=w11)
      w12 = "❌"  # String {0}
      w8 = w12
      w9 = $"Error input"
      w10 = FALSE
    }
    frame True {
      w8 = "✅"
      w9 = $"Error input"
      w10 = TRUE
    }
  }
  $"Error Output" <- w9
  $"HACCP File Content" <- w8
  $"i Combi Classic?" <- w10
  $"trimmed string" <- w5
