vi "Dispaly_All_Programm_im_Graph_iVario.gviweb"   [G Web Development Software 22.3.0]
inputs:
  "common_iVario": T1[]
  "Error input": error
outputs:
  "Curve": T2[]
  "Output Error": error
  "Statistics": T3[]
panel indicators:
  "FRYING": f64[]
  "BOILING": f64[]
  "Mixed: (FRYING; BOILING)": f64[]
  "Mixed: FRYING; BOILING; PRESSURE": f64[]
  "Timestamp": timestamp[]
  "output array": u64[]
  "Mixed: (BOILING; PRESSURE)": f64[]
  "Mixed: PRESSURE; FRYING": f64[]
types:
  T1 = cluster{"Selected": bool, "Charge Nr.": string, "Operating mode": string, "Programme name": string, "Date and time ⌚": string, "Duration": string, "Status": string, "Average temp. (°C/°F)": string, "Device side": string, "Active heating elements": string, "iZC active ?": string}
  T2 = cluster{"Element 1": timestamp[], "Element 2": f64[]}
  T3 = cluster{"Operating mode": string, "quantity": string}
uses:
  WebApp::Add_offset_time_txt.gviweb
diagram:
  s1 = f64[] []  # shift register
  s2 = f64[] []  # shift register
  s3 = f64[] []  # shift register
  s4 = f64[] []  # shift register
  s5 = 0  # shift register
  s6 = 0  # shift register
  s7 = 0  # shift register
  s8 = 0  # shift register
  s9 = ""  # shift register
  s10 = 0  # shift register
  s11 = f64[] []  # shift register
  s12 = 0  # shift register
  s13 = f64[] []  # shift register
  s14 = 0  # shift register
  for {
    w1 = each element of $common_iVario
    # s5: FRYING
    # s7: BOILING
    Property Node(instance in=w1) -> ("Operating mode"=w3, "Date and time ⌚"=w4)
    # s6: Mixed: (FRYING; BOILING)
    # s8: Mixed: (BOILING; FRYING)
    case (w3) {
      frame "False", Default {
        Insert Into Array(inArray=s1, new=0) -> w5
        Insert Into Array(inArray=s2, new=0) -> w6
        Insert Into Array(inArray=s4, new=0) -> w8
        Insert Into Array(inArray=s3, new=0) -> w7
        Insert Into Array(inArray=s11, new=0) -> w13
        Insert Into Array(inArray=s13, new=0) -> w15
        w9 = s5
        w10 = s6
        w11 = s7
        w12 = s8
        w14 = s12
        w16 = s14
      }
      frame "Mixed: BOILING; PRESSURE", "Mixed: PRESSURE; BOILING" {
        Insert Into Array(inArray=s1, new=0) -> w5
        Insert Into Array(inArray=s2, new=0) -> w6
        Insert Into Array(inArray=s4, new=0) -> w8
        Insert Into Array(inArray=s3, new=0) -> w7
        Insert Into Array(inArray=s11, new=1) -> w13
        Insert Into Array(inArray=s13, new=0) -> w15
        Increment(x=s12) -> w14
        w9 = s5
        w10 = s6
        w11 = s7
        w12 = s8
        w16 = s14
      }
      frame "Mixed: FRYING ; PRESSURE", "Mixed: PRESSURE; FRYING" {
        Insert Into Array(inArray=s1, new=0) -> w5
        Insert Into Array(inArray=s2, new=0) -> w6
        Insert Into Array(inArray=s4, new=0) -> w8
        Insert Into Array(inArray=s3, new=0) -> w7
        Insert Into Array(inArray=s11, new=0) -> w13
        Insert Into Array(inArray=s13, new=1) -> w15
        Increment(x=s14) -> w16
        w9 = s5
        w10 = s6
        w11 = s7
        w12 = s8
        w14 = s12
      }
      frame "Mixed: BOILING; FRYING", "Mixed: FRYING; BOILING" {
        Insert Into Array(inArray=s1, new=0) -> w5
        Insert Into Array(inArray=s2, new=0) -> w6
        Insert Into Array(inArray=s4, new=0) -> w8
        Insert Into Array(inArray=s3, new=1) -> w7
        Insert Into Array(inArray=s11, new=0) -> w13
        Insert Into Array(inArray=s13, new=0) -> w15
        Increment(x=s6) -> w10
        w9 = s5
        w11 = s7
        w12 = s8
        w14 = s12
        w16 = s14
      }
      frame "BOILING" {
        Insert Into Array(inArray=s1, new=0) -> w5
        Insert Into Array(inArray=s2, new=1) -> w6
        Insert Into Array(inArray=s4, new=0) -> w8
        Insert Into Array(inArray=s3, new=0) -> w7
        Insert Into Array(inArray=s11, new=0) -> w13
        Insert Into Array(inArray=s13, new=0) -> w15
        Increment(x=s7) -> w11
        w9 = s5
        w10 = s6
        w12 = s8
        w14 = s12
        w16 = s14
      }
      frame "Mixed: BOILING; FRYING; PRESSURE", "Mixed: BOILING; PRESSURE; FRYING", "Mixed: FRYING; BOILING; PRESSURE", "Mixed: FRYING; PRESSURE; BOILING", "Mixed: PRESSURE; BOILING; FRYING", "Mixed: PRESSURE; FRYING; BOILING" {
        Insert Into Array(inArray=s1, new=0) -> w5
        Insert Into Array(inArray=s2, new=0) -> w6
        Insert Into Array(inArray=s4, new=1) -> w8
        Insert Into Array(inArray=s3, new=0) -> w7
        Insert Into Array(inArray=s11, new=0) -> w13
        Insert Into Array(inArray=s13, new=0) -> w15
        Increment(x=s8) -> w12
        w9 = s5
        w10 = s6
        w11 = s7
        w14 = s12
        w16 = s14
      }
      frame "FRYING" {
        Insert Into Array(inArray=s1, new=1) -> w5
        Insert Into Array(inArray=s2, new=0) -> w6
        Insert Into Array(inArray=s4, new=0) -> w8
        Insert Into Array(inArray=s3, new=0) -> w7
        Insert Into Array(inArray=s11, new=0) -> w13
        Insert Into Array(inArray=s13, new=0) -> w15
        Increment(x=s5) -> w9
        w10 = s6
        w11 = s7
        w12 = s8
        w14 = s12
        w16 = s14
      }
    }
    String Subset(length (rest)=10, string=w4) -> w17
    Is Equal(x=s9, y=w17) -> w18
    case (w18) {
      frame False, Default {
        Increment(x=s10) -> w19
      }
      frame True {
        w19 = s10
      }
    }
    call "Add_offset_time_txt.gviweb"(Start date and time=w4, Error input=$"Error input") -> (timestamp=w20, Output Error=w21)
    append w20 to w2
    next s1 = w5
    next s2 = w6
    next s3 = w7
    next s4 = w8
    next s5 = w9
    next s6 = w10
    next s7 = w11
    next s8 = w12
    next s9 = w17
    next s10 = w19
    next s11 = w13
    next s12 = w14
    next s13 = w15
    next s14 = w16
  }
  Build Cluster(w2, s1) -> w22
  Build Cluster(w2, s2) -> w23
  Build Cluster(w2, s4) -> w24
  Build Cluster(w2, s3) -> w25
  Build Cluster(w2, s11) -> w26
  Build Array(w22, w23, w24, w25, w26) -> w27
  $Curve <- w27
  Insert Into Array(inArray=u64[] [], new=s5, new=s7, new=s8, new=s6, new=s12, new=s14, new=s10) -> w28
  $"output array" <- w28
  w29 = ["FRYING", "BOILING", "Mixed: (FRYING; BOILING; PRESSURE)", "Mixed: (FRYING; BOILING)", "Mixed: (BOILING; PRESSURE)", "Mixed: (FRYING; PRESSURE)", "Total days"]
  # Mixed: PRESSURE; FRYING
  # Mixed: BOILING; FRYING
  # Mixed: FRYING; PRESSURE; BOILING
  for {
    w30 = each element of w29
    w31 = each element of w28
    Number To Decimal String(number=w31) -> (decimal integer string=w33)
    w34 = T3 {all zero or empty}  # Cluster Constant
    Property Node(instance in=w34, "Operating mode"=w30, "quantity"=w33) -> (instance out=w35)
    append w35 to w32
  }
  $Statistics <- w32
  $"Output Error" <- w21
  $FRYING <- s1
  $BOILING <- s2
  $"Mixed: FRYING; BOILING; PRESSURE" <- s4
  $"Mixed: (FRYING; BOILING)" <- s3
  $"Mixed: (BOILING; PRESSURE)" <- s11
  $"Mixed: PRESSURE; FRYING" <- s13
  $Timestamp <- w2
