vi "Display_Details_iVario.gviweb"   [G Web Development Software 22.3.0]
inputs:
  "Get all charge": string[]
  "Charge Name": string[]
  "all in txt ?": bool
  "Error input": error
outputs:
  "Curve double": cluster{"Element 1": f64[], "Element 2": f64[]}[]
  "Error Output": error
  "Curve": T1[]
  "Programme Details": T2[]
  "Details of the selected programme:": cluster{"Entry": string, "Information": string}[]
  "max value": f64
  "Average temp.": f64
  "Output_2": string[]
panel indicators:
  "Output": string
  "before substring": string
  "concatenated string": string
types:
  T1 = cluster{"Element 1": timestamp[], "Element 2": f64[]}
  T2 = cluster{"Mode/ Event": string, "cabinet temp.": string, "core temp. Target": string, "core temp.": string, "Date and time": string}
  T3 = cluster{"Charge Nr:": string, "Programme Id:": string, "Software version:": string, "Start date and time:": string, "Programme name:": string}
uses:
  NI::G Core::Strings::Trim Whitespace.gvi
  NI::G Core::Strings::Search and Replace Pattern.gvi
  WebApp::Get_recipe_name_process_iVario.gviweb
  WebApp::Get_Details_selected_programme.gviweb
diagram:
  Array Index(array=$"Charge Name") -> (out0[0]=w1)
  Match Pattern(regular expression="Charge Nr:", string=w1) -> (after substring=w2)
  call "Trim Whitespace.gvi"(string=w2) -> (trimmed string=w3)
  for {
    w4 = each element of $"Get all charge"
    Match Pattern(regular expression="Ch-nr.", string=w4) -> (after substring=w5)
    Match Pattern(regular expression="<<", string=w5) -> (before substring=w6)
    call "Search and Replace Pattern.gvi"(string=w6, pattern=">>") -> (result string=w7)
    call "Trim Whitespace.gvi"(string=w7) -> (trimmed string=w8)
    Match Pattern(regular expression="Progr.", string=w4) -> (after substring=w9)
    Match Pattern(regular expression=")", string=w9) -> (before substring=w10)
    Match Pattern(regular expression="(", string=w10) -> (after substring=w11)
    call "Trim Whitespace.gvi"(string=w11) -> (trimmed string=w12)
    Match Pattern(regular expression="Time", string=w4) -> (after substring=w13)
    Match Pattern(regular expression="<<", string=w13) -> (before substring=w14)
    call "Search and Replace Pattern.gvi"(string=w14, pattern=">>") -> (result string=w15)
    call "Trim Whitespace.gvi"(string=w15) -> (trimmed string=w16)
    Match Pattern(regular expression="Version", string=w4) -> (after substring=w17)
    Match Pattern(regular expression="<<", string=w17) -> (before substring=w18)
    call "Search and Replace Pattern.gvi"(string=w18, pattern=">>") -> (result string=w19)
    call "Trim Whitespace.gvi"(string=w19) -> (trimmed string=w20)
    Match Pattern(regular expression="Pr-GUID", string=w4) -> (after substring=w21)
    Match Pattern(regular expression="<<", string=w21) -> (before substring=w22)
    call "Search and Replace Pattern.gvi"(string=w22, pattern=">>") -> (result string=w23)
    call "Trim Whitespace.gvi"(string=w23) -> (trimmed string=w24)
    call "Get_recipe_name_process_iVario.gviweb"(Programm Id=w12, GUID=w24, Input=$"Error input") -> (Programme name=w25, Output=w26)
    Property Node(instance in=T3 {all zero or empty}, "Charge Nr:"=w8, "Programme Id:"=w12, "Software version:"=w20, "Start date and time:"=w16, "Programme name:"=w25) -> (instance out=w27)
    case ($"all in txt ?") {
      frame False, Default {
        Is Empty String Or Path(string/path=w4) -> w28
      }
      frame True {
        Is Equal(x=w8, y=w3) -> w28
      }
    }
    stop if w28
  }
  Property Node(instance in=w27) -> ("Charge Nr:"=w29, "Programme Id:"=w30, "Software version:"=w31, "Start date and time:"=w32, "Programme name:"=w33)
  Insert Into Array(inArray=string[] [], new=w29, new=w30, new=w31, new=w32, new=w33) -> w34
  w35 = ["Charge Nr.:", "Programme Id:", "Software version:", "Start date and time:", "Programme name:", ""]
  for {
    w36 = each element of w35
    w37 = each element of w34
    w39 = cluster{"Entry": string, "Information": string} {all zero or empty}
    Property Node(instance in=w39, "Entry"=w36, "Information"=w37) -> (instance out=w40)
    append w40 to w38
  }
  $"Details of the selected programme:" <- w38
  Search Or Split String(search string/char="; HE actives", string=w4) -> (match + rest of string=w41)
  Concatenate Strings("\n", w41) -> w42
  $"concatenated string" <- w42
  s1 = ""  # shift register
  s2 = string[] []  # shift register
  while (iteration -> i1) {
    case (i1) {
      frame 0 {
        Match Pattern(regular expression="\n", string=w42) -> (after substring=w43, before substring=w44)
        $"before substring" <- w44
      }
      frame 1, Default {
        Match Pattern(regular expression="; ", string=s1) -> (after substring=w43, before substring=w45, match substring=w46)
        Concatenate Strings(w46, w45) -> w44
      }
    }
    call "Trim Whitespace.gvi"(string=w44) -> (trimmed string=w47)
    Match Pattern(regular expression="\n", string=w47) -> (after substring=w48)
    Is Empty String Or Path(string/path=w48) -> w49
    case (w49) {
      frame True {
        w50 = s2
      }
      frame False {
        Match Pattern(regular expression="END", string=w47) -> (match substring=w51)
        case (w51) {
          frame "END" {
            w50 = s2
          }
          frame "false", Default {
            Insert Into Array(inArray=s2, new=w47) -> w50
          }
        }
      }
    }
    Is Empty String Or Path(string/path=w43) -> w52
    next s1 = w43
    next s2 = w50
    stop if w52
  }
  $Output_2 <- s2
  $Output <- w4
  call "Get_Details_selected_programme.gviweb"(Array=s2, Start date and time=w32, Error input=w26) -> (max value=w53, Average temp.=w54, Programme Details=w55, Curve singel=w56, Output Error=w57, Curve double=w58)
  $"Curve double" <- w58
  $"Programme Details" <- w55
  $Curve <- w56
  $"Error Output" <- w57
  $"Average temp." <- w54
  $"max value" <- w53
