vi "Display_all_programm_in_graph.gviweb"   [G Web Development Software 22.3.0]
inputs:
  "Charge infos": T2[] = [{"selected"=TRUE, "Charge Nr."="548", "Process name"="Cooking process", "Programme name"="Manual Cooking Mode", "Date and time"="2022.12.05 08:18:31", "Duration"="000:04:03", "Status"="Cancelled/aborted", "Average temp."="110.17"}, {"selected"=FALSE, "Charge Nr."="549", "Process name"="Cooking process", "Programme name"="Side Dishes Casserole", "Date and time"="2022.12.05 08:22:41", "Duration"="000:23:50", "Status"="Cancelled/aborted", "Average temp."="212.22"}, {"selected"=FALSE, "Charge Nr."="550", "Process name"="Cleaning", "Programme name"="Light eco without steam generator descaling", "Date and time"="2022.12.05 09:13:40", "Duration"="000:00:11", "Status"="Cancelled/aborted", "Average temp."="153.67"}, {"selected"=FALSE, "Charge Nr."="551", "Process name"="Cleaning", "Programme name"="Emergency clean", "Date and time"="2022.12.05 09:13:52", "Duration"="000:00:02", "Status"="Cancelled/aborted", "Average temp."="143.00"}, {"selected"=FALSE, "Charge Nr."="552", "Process name"="Cleaning", "Programme name"="Light eco without steam generator descaling", "Date and time"="2022.12.05 09:32:56", "Duration"="003:24:04", "Status"="Completed", "Average temp."="86.31"}, {"selected"=FALSE, "Charge Nr."="553", "Process name"="Cooking process", "Programme name"="Finishing Plates à la carte", "Date and time"="2022.12.06 08:10:39", "Duration"="000:12:46", "Status"="Completed", "Average temp."="112.81"}, {"selected"=FALSE, "Charge Nr."="554", "Process name"="IPM", "Programme name"="IPM", "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
  "Error input": error
outputs:
  "Curve": T1[]
  "Error Output": error
  "Cleaning graphic": cluster{"Element 1": f64[], "Element 2": f64[]}[]
  "Statistics": cluster{"Process": string, "quantity": string}[]
  "Cleaning statistics": T3[]
panel indicators:
  "Cooking process": f64[]
  "Emergency Clean": f64[]
  "IPM": f64[]
  "Service": f64[]
  "Cleaning": f64[]
  "Timestamp": timestamp[]
  "Strong cleaning standard": f64
  "all cleaning programms": string[]
  "Cleaning name": string[]
  "Kategorie": string[]
  "Eco": i32[]
  "Strong emergency clean": f64
  "Strong cleaning eco": f64
types:
  T1 = cluster{"Element 1": timestamp[], "Element 2": f64[]}
  T2 = cluster{"selected": bool, "Charge Nr.": string, "Process name": string, "Programme name": string, "Date and time": string, "Duration": string, "Status": string, "Average temp.": string}
  T3 = cluster{"Cleaning name": string, "Standard cleaning": f64, "Eco cleaning": f64, "Aborted cleaning": f64}
uses:
  WebApp::Add_offset_time_txt.gviweb
  WebApp::Find_Emergency_clean.gviweb
diagram:
  # Express
  disable {
    frame Enabled { }
    frame Disabled {
      case (_) {
        frame "False", Default { }
        frame "{CBA589DD-96CD-402A-96AC-5BFF7D114EBA}" { }
        frame "{66C96C8E-B391-417B-A6C9-DA20EDCCFAEA}" { }
        frame "{25BD9CAA-E37F-44C2-87C2-56C327C622FD}" { }
        frame "{332078E2-D710-4D65-A529-2175C4359A6F}" { }
        frame "{738E0E75-020D-49D1-9852-54C9DCF67051}" { }
        frame "{DACC4655-7A92-41E0-96A7-A283E5BD1AEE}" { }
        frame "{82CEFD0A-43C8-4F39-BA40-CD7BB0232FA4}" { }
        frame "{DBC24574-DDCC-4FC3-A778-2AB93AF8AFEA}" { }
        frame "{887397A1-94D5-4B95-B1F8-EA161F861245}" { }
        frame "{B5275CEB-3D2C-4919-A6E8-45317A409630}" { }
        frame "{203FE8F6-9995-40DE-BDAB-6D5CB377BF6A}" { }
        frame "{315B87B6-C01A-4D6D-B8C2-0527ED177727}" { }
        frame "{65E2919B-5C42-4820-BC98-33F63AFDD3F0}" { }
        frame "{D29BE15A-B3B6-4244-8E0E-44A7DFD9B520}" { }
        frame "{3C95817D-14FB-4BAD-A002-DB4D22F0E0AA}" { }
        frame "{F96FB4D2-17FC-4704-848B-4AABE8F8C820}" { }
        frame "{B72345AA-C872-403A-B567-E1ADF63A5081}" {
          w1 = "Without drying phase Light without steam generator descaling"
        }
        frame "{C18D2A4A-4547-4E43-865A-3FC6E833092C}" { }
        frame "{492F451C-0B93-47C3-BC36-AFCB8A228D7C}" {
          w2 = "Without drying phase strong without steam generator descaling"
        }
        frame "{724E55F3-E6D1-4D29-8B39-625418C3CCA8}" { }
        frame "{99C7BB81-A9DC-48CB-A479-9A9980AA71FA}" { }
        frame "{1C2F9924-D80E-4CA8-A56B-78642B236FAF}" {
          w3 = "Without drying phase strong eco without steam generator descaling"
        }
        frame "{5B6F3441-978A-489D-AE9B-5B3699863351}" {
          w4 = "Without drying phase strong eco with steam generator descaling"
        }
        frame "{7473F324-AC8E-4C8C-A738-1E07FDA8E109}" { }
        frame "{0A0807EE-C625-4815-80F7-A4B4AE974899}" { }
        frame "{38739E20-1D61-4BDC-BCDA-1AA25A40F2FE}" {
          w5 = "Interim cleaning without steam generator descaling (auto dose)"
        }
        frame "{B5DCEC69-E9DF-4C25-A8FF-8496D332501C}" { }
        frame "{12712E54-B744-46B8-A141-0A81B64D7011}" { }
        frame "{025AA6D1-C3F2-4E90-A4D6-F1917D171C6E}" { }
        frame "{F7624E50-66B4-4421-80C7-46480577468E}" { }
        frame "{EE769139-367E-4C52-8814-3C9C61866BF7}" { }
        frame "{29F8F17A-F2E8-4143-BE93-B4A6018D43E5}" { }
        frame "{5FE207E0-2372-4082-BD08-AB9AA60799E7}" { }
        frame "{43F7F290-F5CA-4E32-8D7F-205CEAC7ED7E}" { }
        frame "{4E9B4379-26D1-43CB-A99B-8FF396892B4D}" { }
        frame "{B9BFE4E2-E953-46C2-9FD7-AE4A8E11CD13}" { }
        frame "{57D3BF39-11B3-4760-8300-3ADE7944D77D}" { }
        frame "{E30D7068-41F6-40A7-A10F-A2B3644B2FE3}" {
          w6 = "Interim cleaning without steam generator descaling (auto dose)"
        }
        frame "{6671DBEB-BB70-48F9-A93C-CAE76BA47A87}" { }
        frame "{B4CD2665-EE21-4E45-881E-CD434890B0A2}" { }
        frame "{318D64C3-C5DA-4D03-9BB6-0479A6F40CCC}" { }
        frame "{574CCD29-FFFD-4003-83C9-8AC080532669}" { }
        frame "{FE4CB1DD-2B30-4295-A957-128BC69272F0}" { }
        frame "{F1DBF74B-F189-423B-A0EF-4BE4F8B88896}" { }
        frame "{FC5886DA-E94D-4FED-B001-430247AE11C1}" { }
        frame "{C3157636-9CB5-4153-8B02-D9BC6D63F4D2}" { }
        frame "{2A43CD70-B0C1-41A7-959B-99EFD232E764}" { }
        frame "{D1C7A2CE-5708-4454-889B-C1125FD83297}" { }
        frame "{42A6A575-6469-4043-9241-D5FA45B7DF87}" {
          w7 = "Without drying phase strong eco with steam generator descaling (auto dose)"
        }
        frame "{AFF7E7C1-FE23-46DF-B537-182E5AC4E2EA}" {
          w8 = "Without drying phase strong eco without steam generator descaling (auto dose)"
        }
        frame "{44B79862-E680-462F-897C-3BA26E314C79}" {
          w9 = "Without drying phase strong with steam generator descaling (auto dose)"
        }
        frame "{8F9272A2-7BC0-46A4-8A8C-CFB81E294D88}" {
          w10 = "Without drying phase strong without steam generator descaling (auto dose)"
        }
        frame "{AB1098CC-4227-411B-BF9D-017D11705A06}" {
          w11 = "Without drying phase light with steam generator descaling (auto dose)"
        }
        frame "{5D09A017-0BAC-4CFC-8ABA-BEA1BF918B49}" {
          w12 = "Without drying phase light without steam generator descaling (auto dose)"
        }
        frame "{F41A1B99-DA3B-4760-9EC1-451A0417D29F}" { }
        frame "{1B085774-3E4F-4FE8-8149-1FD7C2C5786A}" {
          w13 = "Light Express without steam generator descaling (auto dose)"
        }
        frame "{224F9D8B-6031-4194-8209-90E725DA55D1}" { }
        frame "{F3F5C49B-0873-48F9-884E-6375C9FA875B}" {
          w14 = "Thermo oxidative cleaning without steam generator descaling"
        }
        frame "{CB225C78-3F87-4E9F-9822-A3CB2671AA6C}" { }
        frame "{7A2304A9-6CF1-44F1-B9CA-C835D12420B1}" { }
      }
    }
  }
  s1 = f64[] []  # shift register
  s2 = f64[] []  # shift register
  s3 = f64[] []  # shift register
  s4 = f64[] []  # shift register
  s5 = f64[] []  # shift register
  s6 = 0  # shift register
  s7 = 0  # shift register
  s8 = 0  # shift register
  s9 = 0  # shift register
  s10 = 0  # shift register
  s11 = ""  # shift register
  s12 = 0  # shift register
  s13 = string[] []  # shift register
  for {
    w15 = each element of $"Charge infos"
    # s10: Emergency Clean
    # s6: Cooking Prozess
    # s8: IPM
    # s9: Cleaning
    Property Node(instance in=w15) -> ("Process name"=w17, "Programme name"=w18, "Date and time"=w19)
    call "Add_offset_time_txt.gviweb"(Start date and time=w19, Error input=$"Error input") -> (timestamp=w20, Output Error=w21)
    String Subset(length (rest)=10, string=w19) -> w22
    Is Equal(x=s11, y=w22) -> w23
    case (w23) {
      frame False, Default {
        Increment(x=s12) -> w24
      }
      frame True {
        w24 = s12
      }
    }
    # s7: Service
    case (w17) {
      frame "False", Default {
        Insert Into Array(inArray=s1, new=0) -> w25
        Insert Into Array(inArray=s3, new=0) -> w27
        Insert Into Array(inArray=s4, new=0) -> w28
        Insert Into Array(inArray=s5, new=0) -> w29
        Insert Into Array(inArray=s2, new=0) -> w26
        w30 = s6
        w31 = s7
        w32 = s8
        w33 = s9
        w34 = s10
        w35 = s13
      }
      frame "Service" {
        Insert Into Array(inArray=s1, new=0) -> w25
        Insert Into Array(inArray=s3, new=0) -> w27
        Insert Into Array(inArray=s4, new=1) -> w28
        Insert Into Array(inArray=s5, new=0) -> w29
        Insert Into Array(inArray=s2, new=0) -> w26
        Increment(x=s7) -> w31
        w30 = s6
        w32 = s8
        w33 = s9
        w34 = s10
        w35 = s13
      }
      frame "IPM" {
        Insert Into Array(inArray=s1, new=0) -> w25
        Insert Into Array(inArray=s3, new=1) -> w27
        Insert Into Array(inArray=s4, new=0) -> w28
        Insert Into Array(inArray=s5, new=0) -> w29
        Insert Into Array(inArray=s2, new=0) -> w26
        Increment(x=s8) -> w32
        w30 = s6
        w31 = s7
        w33 = s9
        w34 = s10
        w35 = s13
      }
      frame "Cleaning" {
        Insert Into Array(inArray=s1, new=0) -> w25
        Insert Into Array(inArray=s3, new=0) -> w27
        Insert Into Array(inArray=s4, new=0) -> w28
        case (w18) {
          frame "False", Default {
            Insert Into Array(inArray=s13, new=w18) -> w35
            Insert Into Array(inArray=s5, new=1) -> w29
            Insert Into Array(inArray=s2, new=0) -> w26
            Increment(x=s9) -> w33
            w34 = s10
          }
          frame "Emergency clean" {
            Insert Into Array(inArray=s13, new=w18) -> w35
            Insert Into Array(inArray=s5, new=0) -> w29
            Insert Into Array(inArray=s2, new=1) -> w26
            Increment(x=s10) -> w34
            w33 = s9
          }
        }
        w30 = s6
        w31 = s7
        w32 = s8
      }
      frame "Cooking process" {
        Insert Into Array(inArray=s1, new=1) -> w25
        Insert Into Array(inArray=s3, new=0) -> w27
        Insert Into Array(inArray=s4, new=0) -> w28
        Insert Into Array(inArray=s5, new=0) -> w29
        Insert Into Array(inArray=s2, new=0) -> w26
        Increment(x=s6) -> w30
        w31 = s7
        w32 = s8
        w33 = s9
        w34 = s10
        w35 = s13
      }
    }
    append w20 to w16
    next s1 = w25
    next s2 = w26
    next s3 = w27
    next s4 = w28
    next s5 = w29
    next s6 = w30
    next s7 = w31
    next s8 = w32
    next s9 = w33
    next s10 = w34
    next s11 = w22
    next s12 = w24
    next s13 = w35
  }
  for {
    w36 = each element of s13
    case (w36) {
      frame "False", Default {
        w40 = "Unknown"
        w41 = 0
        w42 = w36
      }
      frame "Emergency clean" {
        w40 = "Emergency clean"
        w41 = 0
        w42 = w36
      }
      frame "Light without steam generator descaling" {
        w40 = "Light"
        w41 = 0
        w42 = w36
      }
      frame "Light with steam generator descaling" {
        w40 = "Light"
        w41 = 0
        w42 = w36
      }
      frame "Light eco without steam generator descaling" {
        w40 = "Light"
        w41 = 1
        w42 = w36
      }
      frame "Light eco with steam generator descaling" {
        w40 = "Light"
        w41 = 1
        w42 = w36
      }
      frame "Medium without steam generator descaling" {
        w40 = "Medium"
        w41 = 0
        w42 = w36
      }
      frame "Medium with steam generator descaling" {
        w40 = "Medium"
        w41 = 0
        w42 = w36
      }
      frame "Medium eco without steam generator descaling" {
        w40 = "Medium"
        w41 = 1
        w42 = w36
      }
      frame "Medium eco with steam generator descaling" {
        w40 = "Medium"
        w41 = 1
        w42 = w36
      }
      frame "Strong without steam generator descaling" {
        w40 = "Strong"
        w41 = 0
        w42 = w36
      }
      frame "Strong with steam generator descaling" {
        w40 = "Strong"
        w41 = 0
        w42 = w36
      }
      frame "Strong eco without steam generator descaling" {
        w40 = "Strong"
        w41 = 1
        w42 = w36
      }
      frame "Strong eco with steam generator descaling" {
        w40 = "Strong"
        w41 = 1
        w42 = w36
      }
      frame "Interim cleaning without steam generator descaling" {
        w40 = "Express"
        w41 = 0
        w42 = w36
      }
      frame "Rinse without steam generator descaling" {
        w40 = "Express"
        w41 = 0
        w42 = w36
      }
      frame "Rinse with steam generator descaling (auto dose)" {
        w40 = "Express"
        w41 = 0
        w42 = w36
      }
      frame "Rinse without tabs (auto dose)" {
        w40 = "Express"
        w41 = 0
        w42 = w36
      }
      frame "Without drying phase Light without steam generator descaling" {
        w40 = "Light"
        w41 = 0
        w42 = w36
      }
      frame "Without drying phase Light with steam generator descaling" {
        w40 = "Light"
        w41 = 0
        w42 = w36
      }
      frame "Without drying phase strong without steam generator descaling" {
        w40 = "strong"
        w41 = 0
        w42 = w36
      }
      frame "Without drying phase strong with steam generator descaling" {
        w40 = "strong"
        w41 = 0
        w42 = w36
      }
      frame "NDG interim cleaning without steam generator descaling" {
        w40 = "Express"
        w41 = 0
        w42 = w36
      }
      frame "Without drying phase strong eco without steam generator descaling" {
        w40 = "strong"
        w41 = 1
        w42 = w36
      }
      frame "Without drying phase strong eco with steam generator descaling" {
        w40 = "strong"
        w41 = 1
        w42 = w36
      }
      frame "NDG strong with steam generator descaling" {
        w40 = "strong"
        w41 = 0
        w42 = w36
      }
      frame "NDG strong without steam generator descaling" {
        w40 = "strong"
        w41 = 0
        w42 = w36
      }
      frame "Interim cleaning without steam generator descaling (auto dose)" {
        w40 = "Express"
        w41 = 0
        w42 = w36
      }
      frame "Light without steam generator descaling (Baking)" {
        w40 = "Light"
        w41 = 0
        w42 = w36
      }
      frame "Light with steam generator descaling (Baking)" {
        w40 = "Light"
        w41 = 0
        w42 = w36
      }
      frame "Light eco without steam generator descaling (Baking)" {
        w40 = "Light"
        w41 = 1
        w42 = w36
      }
      frame "Light eco with steam generator descaling (Baking)" {
        w40 = "Light"
        w41 = 1
        w42 = w36
      }
      frame "Light Express without steam generator descaling" {
        w40 = "Light"
        w41 = 0
        w42 = w36
      }
      frame "Light Express with steam generator descaling" {
        w40 = "Light"
        w41 = 0
        w42 = w36
      }
      frame "Light without steam generator descaling (auto dose)" {
        w40 = "Light"
        w41 = 0
        w42 = w36
      }
      frame "Light with steam generator descaling (auto dose)" {
        w40 = "Light"
        w41 = 0
        w42 = w36
      }
      frame "Rinse with steam generator descaling" {
        w40 = "Express"
        w41 = 0
        w42 = w36
      }
      frame "Rinse without steam generator descaling (auto dose)" {
        w40 = "Express"
        w41 = 0
        w42 = w36
      }
      frame "Rinse without tabs" {
        w40 = "Express"
        w41 = 0
        w42 = w36
      }
      frame "Strong eco with steam generator descaling (auto dose)" {
        w40 = "Strong"
        w41 = 1
        w42 = w36
      }
      frame "Strong eco without steam generator descaling (auto dose)" {
        w40 = "Strong"
        w41 = 1
        w42 = w36
      }
      frame "Strong with steam generator descaling (auto dose)" {
        w40 = "Strong"
        w41 = 0
        w42 = w36
      }
      frame "Strong without steam generator descaling (auto dose)" {
        w40 = "Strong"
        w41 = 0
        w42 = w36
      }
      frame "Medium eco with steam generator descaling (auto dose)" {
        w40 = "Medium"
        w41 = 1
        w42 = w36
      }
      frame "Medium eco without steam generator descaling (auto dose)" {
        w40 = "Medium"
        w41 = 1
        w42 = w36
      }
      frame "Medium with steam generator descaling (auto dose)" {
        w40 = "Medium"
        w41 = 0
        w42 = w36
      }
      frame "Medium without steam generator descaling (auto dose)" {
        w40 = "Medium"
        w41 = 0
        w42 = w36
      }
      frame "Light eco with steam generator descaling (auto dose)" {
        w40 = "Light"
        w41 = 1
        w42 = w36
      }
      frame "Light eco without steam generator descaling (auto dose)" {
        w40 = "Light"
        w41 = 1
        w42 = w36
      }
      frame "Without drying phase strong eco with steam generator descaling (auto dose)" {
        w40 = "Strong"
        w41 = 1
        w42 = w36
      }
      frame "Without drying phase strong eco without steam generator descaling (auto dose)" {
        w40 = "Strong"
        w41 = 1
        w42 = w36
      }
      frame "Without drying phase strong with steam generator descaling (auto dose)" {
        w40 = "Strong"
        w41 = 0
        w42 = w36
      }
      frame "Without drying phase strong without steam generator descaling (auto dose)" {
        w40 = "Strong"
        w41 = 0
        w42 = w36
      }
      frame "Without drying phase light with steam generator descaling (auto dose)" {
        w40 = "Light"
        w41 = 0
        w42 = w36
      }
      frame "Without drying phase light without steam generator descaling (auto dose)" {
        w40 = "Light"
        w41 = 0
        w42 = w36
      }
      frame "Light Express with steam generator descaling (auto dose)" {
        w40 = "Light"
        w41 = 0
        w42 = w36
      }
      frame "Light Express without steam generator descaling (auto dose)" {
        w40 = "Light"
        w41 = 0
        w42 = w36
      }
      frame "Medium Express" {
        w40 = "Medium"
        w41 = 0
        w42 = w36
      }
      frame "Thermo oxidative cleaning without steam generator descaling" {
        w40 = "Strong"
        w41 = 0
        w42 = w36
      }
      frame "Thermo oxidative cleaning with steam generator descaling" {
        w40 = "Strong"
        w41 = 0
        w42 = w36
      }
      frame "Test Reciepe: Strong eco without SG-descaling." {
        w40 = "Strong"
        w41 = 1
        w42 = w36
      }
    }
    append w40 to w37
    append w41 to w38
    append w42 to w39
  }
  call "Find_Emergency_clean.gviweb"(Kategorie_in=w37, Error input=w21) -> (adapted array=w43, Error Output=w44)
  s14 = 0  # shift register
  s15 = 0  # shift register
  s16 = 0  # shift register
  for {
    w45 = each element of w43
    w46 = each element of w38
    Match Pattern(regular expression="Strong", string=w45) -> (match substring=w47)
    case (w47) {
      frame "False", Default {
        w48 = s14
        w49 = s15
        w50 = s16
      }
      frame "Strong" {
        Match Pattern(regular expression="after Emergency", string=w45) -> (match substring=w51)
        case (w51) {
          frame "False", Default {
            case (w46) {
              frame 1 {
                Increment(x=s15) -> w49
                w50 = s16
              }
              frame 0, Default {
                Increment(x=s16) -> w50
                w49 = s15
              }
            }
            w48 = s14
          }
          frame "after Emergency" {
            Increment(x=s14) -> w48
            w49 = s15
            w50 = s16
          }
        }
      }
    }
    next s14 = w48
    next s15 = w49
    next s16 = w50
  }
  Build Array(s16) -> w52
  Build Cluster([4], w52) -> w53
  Build Array(s15) -> w54
  Build Cluster([4], w54) -> w55
  Build Array(s14) -> w56
  Build Cluster([4], w56) -> w57
  s17 = 0  # shift register
  s18 = 0  # shift register
  s19 = 0  # shift register
  for {
    w58 = each element of w43
    w59 = each element of w38
    Match Pattern(regular expression="Medium", string=w58) -> (match substring=w60)
    case (w60) {
      frame "False", Default {
        w61 = s17
        w62 = s18
        w63 = s19
      }
      frame "Medium" {
        Match Pattern(regular expression="after Emergency", string=w58) -> (match substring=w64)
        case (w64) {
          frame "False", Default {
            case (w59) {
              frame 1 {
                Increment(x=s18) -> w62
                w63 = s19
              }
              frame 0, Default {
                Increment(x=s19) -> w63
                w62 = s18
              }
            }
            w61 = s17
          }
          frame "after Emergency" {
            Increment(x=s17) -> w61
            w62 = s18
            w63 = s19
          }
        }
      }
    }
    next s17 = w61
    next s18 = w62
    next s19 = w63
  }
  Build Array(s19) -> w65
  Build Cluster([3], w65) -> w66
  Build Array(s18) -> w67
  Build Cluster([3], w67) -> w68
  Build Array(s17) -> w69
  Build Cluster([3], w69) -> w70
  s20 = 0  # shift register
  s21 = 0  # shift register
  s22 = 0  # shift register
  for {
    w71 = each element of w43
    w72 = each element of w38
    Match Pattern(regular expression="Light", string=w71) -> (match substring=w73)
    case (w73) {
      frame "False", Default {
        w74 = s20
        w75 = s21
        w76 = s22
      }
      frame "Light" {
        Match Pattern(regular expression="after Emergency", string=w71) -> (match substring=w77)
        case (w77) {
          frame "False", Default {
            case (w72) {
              frame 1 {
                Increment(x=s21) -> w75
                w76 = s22
              }
              frame 0, Default {
                Increment(x=s22) -> w76
                w75 = s21
              }
            }
            w74 = s20
          }
          frame "after Emergency" {
            Increment(x=s20) -> w74
            w75 = s21
            w76 = s22
          }
        }
      }
    }
    next s20 = w74
    next s21 = w75
    next s22 = w76
  }
  Build Array(s22) -> w78
  Build Cluster([2], w78) -> w79
  Build Array(s21) -> w80
  Build Cluster([2], w80) -> w81
  Build Array(s20) -> w82
  Build Cluster([2], w82) -> w83
  s23 = 0  # shift register
  s24 = 0  # shift register
  s25 = 0  # shift register
  for {
    w84 = each element of w43
    w85 = each element of w38
    Match Pattern(regular expression="Express", string=w84) -> (match substring=w86)
    case (w86) {
      frame "False", Default {
        w87 = s23
        w88 = s24
        w89 = s25
      }
      frame "Express" {
        Match Pattern(regular expression="after Emergency", string=w84) -> (match substring=w90)
        case (w90) {
          frame "False", Default {
            case (w85) {
              frame 1 {
                Increment(x=s24) -> w88
                w89 = s25
              }
              frame 0, Default {
                Increment(x=s25) -> w89
                w88 = s24
              }
            }
            w87 = s23
          }
          frame "after Emergency" {
            Increment(x=s23) -> w87
            w88 = s24
            w89 = s25
          }
        }
      }
    }
    next s23 = w87
    next s24 = w88
    next s25 = w89
  }
  Build Array(s25) -> w91
  Build Cluster([1], w91) -> w92
  Build Array(s24) -> w93
  Build Cluster([1], w93) -> w94
  Build Array(s23) -> w95
  Build Cluster([1], w95) -> w96
  Build Array(w53, w55, w57, w66, w68, w70, w79, w81, w83, w92, w94, w96) -> w97
  $"Cleaning graphic" <- w97
  $"all cleaning programms" <- s13
  $Eco <- w38
  $"Cleaning name" <- w39
  $Timestamp <- w16
  $"Strong cleaning standard" <- s16
  $"Strong cleaning eco" <- s15
  $Kategorie <- w37
  $"Cooking process" <- s1
  $"Strong emergency clean" <- s14
  $IPM <- s3
  $Cleaning <- s5
  $"Emergency Clean" <- s2
  $Service <- s4
  Build Cluster(w16, s1) -> w98
  Build Cluster(w16, s3) -> w99
  Build Cluster(w16, s5) -> w100
  Build Cluster(w16, s2) -> w101
  Build Cluster(w16, s4) -> w102
  Build Array(w98, w99, w100, w101, w102) -> w103
  $Curve <- w103
  Insert Into Array(inArray=u64[] [], new=s6, new=s8, new=s9, new=s10, new=s7, new=s12) -> w104
  w105 = ["Cooking processes", "IPMs", "Cleanings", "Emergency cleans", "Service programmes", "Total days"]
  # 1. Cooking process
  # 2. IPM
  # 3. Cleaning
  # 4. Emergency Clean
  # 4. Service
  for {
    w106 = each element of w105
    w107 = each element of w104
    Number To Decimal String(number=w107) -> (decimal integer string=w109)
    w110 = cluster{"Process": string, "quantity": string} {all zero or empty}  # Cluster Constant
    Property Node(instance in=w110, "Process"=w106, "quantity"=w109) -> (instance out=w111)
    append w111 to w108
  }
  $"Error Output" <- w21
  $Statistics <- w108
  # s22: Light Standard
  # s19: Medium  Standard
  # s16: Strong standard
  # s24: Express Eco
  # s21: Light Eco
  # s18: Medium Eco
  # s15: Strong Eco
  # s23: Express abort
  # s20: Light abort
  # s17: Medium abort
  # s14: Strong abort
  sequence {
    frame 0 {
      # Standard
      Insert Into Array(inArray=f64[] [], new=s25, new=s22, new=s19, new=s16) -> w112
    }
    frame 1 {
      # Eco
      Insert Into Array(inArray=f64[] [], new=s24, new=s21, new=s18, new=s15) -> w113
    }
    frame 2 {
      # abort
      Insert Into Array(inArray=f64[] [], new=s23, new=s20, new=s17, new=s14) -> w114
    }
  }
  for {
    w115 = each element of w112
    w116 = each element of w113
    w117 = each element of w114
    w118 = each element of ["Express", "Light", "Medium", "Strong"]
    Property Node(instance in=T3 {all zero or empty}, "Cleaning name"=w118, "Standard cleaning"=w115, "Eco cleaning"=w116, "Aborted cleaning"=w117) -> (instance out=w120)
    append w120 to w119
  }
  $"Cleaning statistics" <- w119
