vi "Find_Emergency_clean.gviweb"   [G Web Development Software 22.3.0]
inputs:
  "Kategorie_in": string[]
  "Error input": error
outputs:
  "adapted array": string[]
  "Error Output": error
diagram:
  s1 = i32[] []  # shift register
  for (iteration -> i1) {
    w1 = each element of $Kategorie_in
    case (w1) {
      frame "False", Default {
        w2 = s1
      }
      frame "Emergency clean" {
        Insert Into Array(inArray=s1, new=i1) -> w2
      }
    }
    next s1 = w2
  }
  s2 = i32[] []  # shift register
  for {
    w3 = each element of s1
    Is Greater Or Equal To 0(x=w3) -> w4
    case (w4) {
      frame False, Default {
        Insert Into Array(inArray=s2, new=w3) -> w5
      }
      frame True {
        Decrement(x=w3) -> w6
        Insert Into Array(inArray=s2, new=w6) -> w5
      }
    }
    next s2 = w5
  }
  Array Size(array=s2) -> (size(s)=w7)
  Is Not Equal To 0(x=w7) -> w8
  case (w8) {
    frame False, Default {
      w9 = $Kategorie_in
    }
    frame True {
      s3 = string[] []  # shift register
      for (iteration -> i2) {
        w10 = each element of s2
        case (i2) {
          frame 1, Default {
            Increment(x=w10) -> w12
            Array Index(array=s3) -> (out0[w10]=w13)
            Concatenate Strings(w13, " after Emergency") -> w14
            Insert Into Array(inArray=s3, index0=w10, new=w14) -> w15
            Delete From Array(inArray=w15, index0=w12) -> w11
          }
          frame 0 {
            Increment(x=w10) -> w16
            Array Index(array=$Kategorie_in) -> (out0[w10]=w17)
            Concatenate Strings(w17, " after Emergency") -> w18
            Insert Into Array(inArray=$Kategorie_in, index0=w10, new=w18) -> w19
            Delete From Array(inArray=w19, index0=w16) -> w11
          }
        }
        next s3 = w11
      }
      w9 = s3
    }
  }
  $"adapted array" <- w9
  $"Error Output" <- $"Error input"
