vi "Function.gviweb"   [G Web Development Software 22.3.0]
inputs:
  "Start date and time": string
  "Error input": error
  "time offset (sec)": string
outputs:
  "timestamp": timestamp
  "Output Error": error
  "Date and time": string
panel indicators:
  "timestamp_2": timestamp
uses:
  NI::G Core::Error::Clear Error Cluster.gvi
diagram:
  Scan From String(formatString="%<%Y.%m.%d %H:%M:%S>T", inputString=$"Start date and time", errIn=$"Error input", default=1904-01-01T00:00:00Z) -> (errOut=w1, out0=w2)
  Floating Point String To Number(string=$"time offset (sec)") -> (number=w3)
  Timestamp Add(x=w2, y=w3) -> w4
  $timestamp <- w4
  Get Date And Time String(date format (0)="long", time stamp=w4, want seconds? (F)=TRUE) -> (date string=w5, time string=w6)
  Concatenate Strings(w5, " ", w6) -> w7
  $"Date and time" <- w7
  call "Clear Error Cluster.gvi"(error in=w1) -> (error out=w8)
  $"Output Error" <- w8
  To Timestamp(number=w3) -> w9
  $timestamp_2 <- w9
