vi "Function_3.gviweb"   [G Web Development Software 22.3.0]
panel controls:
  "Inhalt_file": string
  "Error input": error
panel indicators:
  "iCombi Pro File Content": string
uses:
  NI::G Core::Strings::Search and Replace Pattern.gvi
  NI::G Core::Strings::Trim Whitespace.gvi
diagram:
  Match Pattern(regular expression="Dev-Typ", string=$Inhalt_file) -> (after substring=w1)
  Match Pattern(regular expression="<<", string=w1) -> (before substring=w2)
  call "Search and Replace Pattern.gvi"(string=w2, pattern=">>") -> (result string=w3)
  call "Trim Whitespace.gvi"(string=w3) -> (trimmed string=w4)
  case (w4) {
    frame "False", Default {
      w6 = "The device type is incorrect, select a correct iCombi-pro HACCP file!"
      One Button Dialog(button name ("OK")="OK", message=w6)
      w7 = "❌"  # String {0}
      w5 = w7
    }
    frame "623", "E101", "E102", "E201", "E202", "E523", "E61", "E61T", "E62", "E623", "G101", "G102", "G201", "G202", "G61", "G62" {
      w5 = "✅"
    }
  }
  $"iCombi Pro File Content" <- w5
