vi "Get_Average_Temp.gviweb"   [G Web Development Software 22.3.0]
inputs:
  "Input all Parts": string[]
  "Error input": error
outputs:
  "Average temp.": string[]
  "Output Error": error
panel indicators:
  "Output": string[][]
uses:
  NI::G Core::Strings::Trim Whitespace.gvi
diagram:
  for {
    w1 = each element of $"Input all Parts"
    s1 = ""  # shift register
    s2 = string[] []  # shift register
    while (iteration -> i1) {
      case (i1) {
        frame 0 {
          Match Pattern(regular expression="\n", string=w1) -> (after substring=w4, before substring=w5)
        }
        frame 1, Default {
          Match Pattern(regular expression="\n", string=s1) -> (after substring=w4, before substring=w5)
        }
      }
      Insert Into Array(inArray=s2, new=w5) -> w6
      Is Empty String Or Path(string/path=w4) -> w7
      next s1 = w4
      next s2 = w6
      stop if w7
    }
    s3 = string[] []  # shift register
    for {
      w8 = each element of s2
      call "Trim Whitespace.gvi"(string=w8) -> (trimmed string=w9)
      String Length(string=w9) -> (length=w10)
      Is Less Or Equal(x=w10, y=1) -> w11
      case (w11) {
        frame True {
          w12 = s3
        }
        frame False {
          Match Pattern(regular expression=";", string=w9) -> (match substring=w13)
          case (w13) {
            frame ";" {
              w12 = s3
            }
            frame "False", Default {
              Insert Into Array(inArray=s3, new=w9) -> w12
            }
          }
        }
      }
      next s3 = w12
    }
    s4 = 0  # shift register
    s5 = 0  # shift register
    for {
      w14 = each element of s3
      Scan Value(format string="%3s", string=w14) -> (value=w15)
      Is Not Equal To 0(x=w15) -> w16
      case (w16) {
        frame False, Default {
          w17 = s4
          w18 = s5
        }
        frame True {
          Add(w15, s4) -> w17
          Increment(x=s5) -> w18
        }
      }
      next s4 = w17
      next s5 = w18
    }
    Is Greater Than 0(x=s4) -> w19
    case (w19) {
      frame False, Default {
        w20 = 0
      }
      frame True {
        Divide(x=s4, y=s5) -> w20
      }
    }
    Number To Fractional String(number=w20, precision (6)=2) -> (F-format string=w21)
    append s3 to w2
    append w21 to w3
  }
  $"Output Error" <- $"Error input"
  $"Average temp." <- w3
  $Output <- w2
