vi "Get_Details_selected_programme.gviweb"   [G Web Development Software 22.3.0]
inputs:
  "Array": string[]
  "Start date and time": string
  "Error input": error
outputs:
  "Programme Details": T2[]
  "Output Error": error
  "Curve singel": T1[]
  "time stamp": timestamp[]
  "Curve double": cluster{"Element 1": f64[], "Element 2": f64[]}[]
  "Average temp.": f64
  "max value": f64
panel indicators:
  "date and time": string[]
  "Temp. Unit": string[]
  "Zeiten in sekunden": f64[]
  "core sensor curent point": f64[]
  "chamber temp": f64[]
  "core sensor setpoint": f64[]
types:
  T1 = cluster{"Element 1": timestamp[], "Element 2": f64[]}
  T2 = cluster{"Mode/ Event": string, "cabinet temp.": string, "core temp. Target": string, "core temp.": string, "Date and time": string}
uses:
  NI::G Core::Strings::Trim Whitespace.gvi
  WebApp::Add_offset_time_txt.gviweb
  NI::G Core::Strings::Search and Replace Pattern.gvi
diagram:
  s1 = 0  # shift register
  for {
    w1 = each element of $Array
    s2 = ""  # shift register
    s3 = f64[] []  # shift register
    s4 = f64[] []  # shift register
    s5 = f64[] []  # shift register
    s6 = string[] []  # shift register
    s7 = uninitialised  # shift register
    s8 = string[] []  # shift register
    s9 = string[] []  # shift register
    s10 = uninitialised  # shift register
    s11 = uninitialised  # shift register
    s12 = uninitialised  # shift register
    s13 = uninitialised  # shift register
    s14 = timestamp[] []  # shift register
    s15 = s1  # shift register
    s16 = f64[] []  # shift register
    while (iteration -> i1) {
      # s9: temp. unit
      # s11: core probre setpoint temp.
      # s12: core probe curent temp.
      # s10: chamber temp.
      case (i1) {
        frame 1, Default {
          call "Trim Whitespace.gvi"(string=s2, location="both"(0)) -> (trimmed string=w26)
          Scan Value(format string="%3s", string=w26) -> (output string=w27, value=w19)
          call "Trim Whitespace.gvi"(string=w27, location="both"(0)) -> (trimmed string=w28)
          Scan Value(format string="%3s", string=w28) -> (output string=w29, value=w30)
          case (w30) {
            frame 0 {
              Match Pattern(regular expression="-", string=w29)
              String Subset(offset (0)=1, string=w29) -> w31
              w20 = 0
            }
            frame 1, Default {
              w20 = w30
              w31 = w29
            }
          }
          call "Trim Whitespace.gvi"(string=w31, location="both"(0)) -> (trimmed string=w32)
          Scan Value(format string="%3s", string=w32) -> (output string=w33, value=w21)
          call "Trim Whitespace.gvi"(string=w33, location="both"(0)) -> (trimmed string=w34)
          Scan From String(formatString="%9s", inputString=w34) -> (outString=w35, out0=w36)
          Scan From String(formatString="%s", inputString=w35) -> (outString=w37, out0=w22)
          Match Pattern(regular expression="\n", string=w37) -> (after substring=w9)
          Is Empty String Or Path(string/path=w9) -> w15
          Insert Into Array(inArray=s9, new=w22) -> w18
          call "Add_offset_time_txt.gviweb"(Start date and time=$"Start date and time", time offset (sec)=w36, Error input=$"Error input") -> (Date and time=w38, timestamp=w39, Duration in seconds=w40, Output Error=w17)
          Insert Into Array(inArray=s8, new=w38) -> w16
          Insert Into Array(inArray=s14, new=w39) -> w23
          Insert Into Array(inArray=s5, new=w21) -> w12
          Insert Into Array(inArray=s4, new=w20) -> w11
          Insert Into Array(inArray=s3, new=w19) -> w10
          Insert Into Array(inArray=s6, new=s7) -> w13
          Insert Into Array(inArray=s16, new=w40) -> w25
          w14 = s7
          w24 = s15
        }
        frame 0 {
          Match Pattern(regular expression=";", string=w1) -> (after substring=w41)
          Match Pattern(regular expression="/", string=w41) -> (before substring=w42, match substring=w43)
          case (w43) {
            frame "False", Default {
              Match Pattern(regular expression=")", string=w41) -> (after substring=w44, before substring=w45, match substring=w46)
              case (w46) {
                frame ")" {
                  Concatenate Strings(w45, w46) -> w48
                  call "Trim Whitespace.gvi"(string=w48) -> (trimmed string=w47)
                  Match Pattern(regular expression="\n", string=w44) -> (after substring=w49)
                  call "Trim Whitespace.gvi"(string=w44) -> (trimmed string=w50)
                  Is Empty String Or Path(string/path=w49) -> w51
                  case (w51) {
                    frame False, Default {
                      w9 = w49
                      w16 = s8
                      w10 = s3
                      w11 = s4
                      w12 = s5
                      w18 = s9
                      w17 = $"Error input"
                      w23 = s14
                      w25 = s16
                    }
                    frame True {
                      call "Add_offset_time_txt.gviweb"(Start date and time=$"Start date and time", time offset (sec)=w50, Error input=$"Error input") -> (Date and time=w52, timestamp=w53, Duration in seconds=w54, Output Error=w17)
                      Insert Into Array(inArray=s8, new=w52) -> w16
                      Insert Into Array(inArray=s14, new=w53) -> w23
                      Insert Into Array(inArray=s4, new=s11) -> w11
                      Insert Into Array(inArray=s3, new=s10) -> w10
                      Insert Into Array(inArray=s5, new=s12) -> w12
                      Insert Into Array(inArray=s9, new=s13) -> w18
                      Insert Into Array(inArray=s16, new=w54) -> w25
                      w9 = w49
                    }
                  }
                }
                frame "False", Default {
                  Match Pattern(regular expression="ELC", string=w41) -> (after substring=w55, before substring=w56, match substring=w57)
                  case (w57) {
                    frame "ELC" {
                      Concatenate Strings(w57, w56) -> w58
                      call "Trim Whitespace.gvi"(string=w58) -> (trimmed string=w47)
                      Match Pattern(regular expression="\n", string=w55) -> (after substring=w59)
                      call "Trim Whitespace.gvi"(string=w55) -> (trimmed string=w60)
                      Is Empty String Or Path(string/path=w59) -> w61
                      case (w61) {
                        frame False, Default {
                          w9 = w59
                          w16 = s8
                          w10 = s3
                          w11 = s4
                          w12 = s5
                          w18 = s9
                          w17 = $"Error input"
                          w23 = s14
                          w25 = s16
                        }
                        frame True {
                          call "Add_offset_time_txt.gviweb"(Start date and time=$"Start date and time", time offset (sec)=w60, Error input=$"Error input") -> (Date and time=w62, timestamp=w63, Output Error=w17)
                          Insert Into Array(inArray=s8, new=w62) -> w16
                          Insert Into Array(inArray=s14, new=w63) -> w23
                          Insert Into Array(inArray=s4, new=s11) -> w11
                          Insert Into Array(inArray=s3, new=s10) -> w10
                          Insert Into Array(inArray=s5, new=s12) -> w12
                          Insert Into Array(inArray=s9, new=s13) -> w18
                          w9 = w59
                          w25 = s16
                        }
                      }
                    }
                    frame "False", Default {
                      Match Pattern(regular expression="Microwave", string=w41) -> (after substring=w64, match substring=w65)
                      Match Pattern(regular expression="Broken: ", string=w64) -> (after substring=w66, before substring=w67, match substring=w68)
                      String Subset(length (rest)=2, string=w66) -> w69
                      Concatenate Strings(w65, w67, w68, w69) -> w70
                      call "Trim Whitespace.gvi"(string=w70) -> (trimmed string=w47)
                      Match Pattern(regular expression="\n", string=w66) -> (after substring=w71)
                      call "Trim Whitespace.gvi"(string=w66) -> (trimmed string=w72)
                      Is Empty String Or Path(string/path=w71) -> w73
                      case (w73) {
                        frame False, Default {
                          w9 = w71
                          w16 = s8
                          w10 = s3
                          w11 = s4
                          w12 = s5
                          w18 = s9
                          w17 = $"Error input"
                          w23 = s14
                          w25 = s16
                        }
                        frame True {
                          call "Add_offset_time_txt.gviweb"(Start date and time=$"Start date and time", time offset (sec)=w72, Error input=$"Error input") -> (Date and time=w74, timestamp=w75, Duration in seconds=w76, Output Error=w17)
                          Insert Into Array(inArray=s8, new=w74) -> w16
                          Insert Into Array(inArray=s14, new=w75) -> w23
                          Insert Into Array(inArray=s4, new=s11) -> w11
                          Insert Into Array(inArray=s3, new=s10) -> w10
                          Insert Into Array(inArray=s5, new=s12) -> w12
                          Insert Into Array(inArray=s9, new=s13) -> w18
                          Insert Into Array(inArray=s16, new=w76) -> w25
                          w9 = w71
                        }
                      }
                    }
                  }
                }
              }
              case (w47) {
                frame "False", Default {
                  w14 = w47
                }
                frame "end (RETURN)" {
                  w14 = "Program finished with back button"
                }
                frame "end (ERROR)" {
                  w14 = "Program was aborted \ndue to error"
                }
                frame "end (ABORT)" {
                  w14 = "Program was aborted"
                }
                frame "stop (END)" {
                  w14 = "end of Program is reached"
                }
                frame "end (HOME)" {
                  w14 = "Program finished with home button"
                }
                frame "restart (POWER)" {
                  w14 = "Restart after switching off \nor power failure "
                }
              }
            }
            frame "/" {
              Match Pattern(regular expression="\n", string=w41) -> (after substring=w9)
              call "Search and Replace Pattern.gvi"(string=w42, pattern="(EN)") -> (result string=w77)
              call "Trim Whitespace.gvi"(string=w77) -> (trimmed string=w78)
              Match Pattern(regular expression="Handshower", string=w78) -> (match substring=w79)
              case (w79) {
                frame "False", Default {
                  Match Pattern(regular expression=":", string=w78) -> (match substring=w80)
                  case (w80) {
                    frame "False", Default {
                      w14 = w78
                    }
                    frame ":" {
                      call "Search and Replace Pattern.gvi"(string=w78, pattern=":", replace string="\n") -> (result string=w14)
                    }
                  }
                }
                frame "Handshower" {
                  w14 = w79
                }
              }
              w16 = s8
              w10 = s3
              w11 = s4
              w12 = s5
              w18 = s9
              w17 = $"Error input"
              w23 = s14
              w25 = s16
            }
          }
          Insert Into Array(inArray=s6, new=w14) -> w13
          Is Empty String Or Path(string/path=w9) -> w15
          w19 = s10
          w20 = s11
          w21 = s12
          w22 = s13
          w24 = s15
        }
      }
      Is Greater(x=w24, y=w19) -> w81
      case (w81) {
        frame False, Default {
          w82 = w19
        }
        frame True {
          w82 = w24
        }
      }
      next s2 = w9
      next s3 = w10
      next s4 = w11
      next s5 = w12
      next s6 = w13
      next s7 = w14
      next s8 = w16
      next s9 = w18
      next s10 = w19
      next s11 = w20
      next s12 = w21
      next s13 = w22
      next s14 = w23
      next s15 = w82
      next s16 = w25
      stop if w15
    }
    $"Output Error" <- w17
    for (after s14) {
      w83 = each element of s6
      w84 = each element of s3
      w85 = each element of s4
      w86 = each element of s5
      w87 = each element of s8
      w88 = each element of s9
      Number To Fractional String(number=w84, precision (6)=0) -> (F-format string=w90)
      Concatenate Strings(w90, " ", w88) -> w91
      Number To Fractional String(number=w85, precision (6)=0) -> (F-format string=w92)
      case (w92) {
        frame "False", Default {
          w93 = w92
          w94 = w88
        }
        frame "0" {
          w93 = "-"
          w94 = ""
        }
      }
      Concatenate Strings(w93, " ", w94) -> w95
      Number To Fractional String(number=w86, precision (6)=0) -> (F-format string=w96)
      Concatenate Strings(w96, " ", w88) -> w97
      Property Node(instance in=T2 {all zero or empty}, "Mode/ Event"=w83, "cabinet temp."=w91, "core temp. Target"=w95, "core temp."=w97, "Date and time"=w87) -> (instance out=w98)
      append w98 to w89
    }
    $"date and time" <- s8
    $"Temp. Unit" <- s9
    concatenate w89 onto w2
    concatenate s3 onto w3
    concatenate s4 onto w4
    concatenate s5 onto w5
    concatenate s14 onto w6
    concatenate s6 onto w7
    concatenate s16 onto w8
    next s1 = s15
  }
  Build Cluster(w6, w3) -> w99
  Build Cluster(w6, w4) -> w100
  Build Cluster(w6, w5) -> w101
  s17 = f64[] []  # shift register
  for {
    w102 = each element of w7
    case (w102) {
      frame "False", Default {
        Insert Into Array(inArray=s17, new=0) -> w103
      }
      frame "Door opened" {
        Insert Into Array(inArray=s17, new=s1) -> w103
      }
      frame "Lid not closed" {
        Insert Into Array(inArray=s17, new=s1) -> w103
      }
    }
    next s17 = w103
  }
  Build Cluster(w6, s17) -> w104
  Build Array(w99, w100, w101, w104) -> w105
  $"Curve singel" <- w105
  $"time stamp" <- w6
  $"max value" <- s1
  $"core sensor setpoint" <- w4
  $"core sensor curent point" <- w5
  $"Programme Details" <- w2
  $"chamber temp" <- w3
  s18 = 0  # shift register
  for {
    w106 = each element of w3
    Add(s18, w106) -> w107
    next s18 = w107
  }
  Array Size(array=w3) -> (size(s)=w108)
  Divide(x=s18, y=w108) -> w109
  $"Average temp." <- w109
  $"Zeiten in sekunden" <- w8
  Build Cluster(w8, w3) -> w110
  Build Cluster(w8, w4) -> w111
  Build Cluster(w8, w5) -> w112
  Build Cluster(w8, s17) -> w113
  Build Array(w110, w111, w112, w113) -> w114
  $"Curve double" <- w114
