vi "Get_Duration_If_Stop_Missing.gviweb"   [G Web Development Software 22.3.0]
inputs:
  "Charge infos": string
  "Error input": error
outputs:
  "Duration": string
  "Error ouput": error
  "Last date and time": string
panel indicators:
  "Output": string[]
uses:
  NI::G Core::Strings::Trim Whitespace.gvi
diagram:
  $"Error ouput" <- $"Error input"
  s1 = ""  # shift register
  s2 = string[] []  # shift register
  while (iteration -> i1) {
    case (i1) {
      frame 0 {
        Match Pattern(regular expression="\n", string=$"Charge infos") -> (after substring=w1, before substring=w2)
      }
      frame 1, Default {
        Match Pattern(regular expression="\n", string=s1) -> (after substring=w1, before substring=w2)
      }
    }
    Insert Into Array(inArray=s2, new=w2) -> w3
    Is Empty String Or Path(string/path=w1) -> w4
    next s1 = w1
    next s2 = w3
    stop if w4
  }
  $Output <- s2
  s3 = string[] []  # shift register
  for {
    w5 = each element of s2
    call "Trim Whitespace.gvi"(string=w5) -> (trimmed string=w6)
    String Length(string=w6) -> (length=w7)
    Is Less Or Equal(x=w7, y=1) -> w8
    case (w8) {
      frame True {
        w9 = s3
      }
      frame False {
        Match Pattern(regular expression=";", string=w6) -> (match substring=w10)
        case (w10) {
          frame ";" {
            w9 = s3
          }
          frame "False", Default {
            Insert Into Array(inArray=s3, new=w6) -> w9
          }
        }
      }
    }
    next s3 = w9
  }
  Array Size(array=s3) -> (size(s)=w11)
  Decrement(x=w11) -> w12
  Array Index(array=s3) -> (out0[w12]=w13)
  Search Or Split String(search string/char=":", string=w13) -> (match + rest of string=w14, substring before match=w15)
  Reverse String(string=w15) -> (reversed=w16)
  String Subset(length (rest)=3, string=w16) -> w17
  Reverse String(string=w17) -> (reversed=w18)
  Concatenate Strings(w18, w14) -> w19
  String Subset(length (rest)=9, string=w19) -> w20
  call "Trim Whitespace.gvi"(string=w20) -> (trimmed string=w21)
  $Duration <- w21
  Match Pattern(regular expression="/ ", string=w13) -> (after substring=w22, before substring=w23, match substring=w24)
  String Subset(length (rest)=9, string=w22) -> w25
  Reverse String(string=w23) -> (reversed=w26)
  String Subset(length (rest)=9, string=w26) -> w27
  Reverse String(string=w27) -> (reversed=w28)
  Concatenate Strings(w28, w24, w25) -> w29
  $"Last date and time" <- w29
