vi "Get_Duration_iCC.gviweb"   [G Web Development Software 22.3.0]
inputs:
  "Charge infos": string
  "Error Input": error
outputs:
  "Output Error": error
  "Start Date and Time": string
uses:
  NI::G Core::Strings::Trim Whitespace.gvi
diagram:
  Match Pattern(regular expression="Handshower", string=$"Charge infos") -> (after substring=w1)
  Match Pattern(regular expression="\n", string=w1) -> (after substring=w2)
  s1 = ""  # shift register
  s2 = string[] []  # shift register
  while (iteration -> i1) {
    case (i1) {
      frame 0 {
        Match Pattern(regular expression="\n", string=w2) -> (after substring=w3, before substring=w4)
      }
      frame 1, Default {
        Match Pattern(regular expression="\n", string=s1) -> (after substring=w3, before substring=w4)
      }
    }
    Insert Into Array(inArray=s2, new=w4) -> w5
    Is Empty String Or Path(string/path=w3) -> w6
    next s1 = w3
    next s2 = w5
    stop if w6
  }
  s3 = string[] []  # shift register
  for {
    w7 = each element of s2
    call "Trim Whitespace.gvi"(string=w7) -> (trimmed string=w8)
    String Length(string=w8) -> (length=w9)
    Is Less Or Equal(x=w9, y=1) -> w10
    case (w10) {
      frame True {
        w11 = s3
        w12 = FALSE
      }
      frame False {
        Match Pattern(regular expression="/", string=w8) -> (match substring=w13)
        case (w13) {
          frame "False", Default {
            w11 = s3
            w12 = FALSE
          }
          frame "/" {
            Insert Into Array(inArray=s3, new=w8) -> w11
            w12 = TRUE
          }
        }
      }
    }
    next s3 = w11
    stop if w12
  }
  Array Index(array=s3) -> (out0[0]=w14)
  Match Pattern(regular expression="/", string=w14) -> (after substring=w15, before substring=w16, match substring=w17)
  String Subset(length (rest)=9, string=w15) -> w18
  Reverse String(string=w16) -> (reversed=w19)
  String Subset(length (rest)=9, string=w19) -> w20
  Reverse String(string=w20) -> (reversed=w21)
  Concatenate Strings(w21, " ", w17, w18) -> w22
  $"Start Date and Time" <- w22
  $"Output Error" <- $"Error Input"
