vi "Get_Operation_Mode.gviweb"   [G Web Development Software 22.3.0]
inputs:
  "Input all Parts": string[]
  "Error input": error
outputs:
  "Operating Mode": string[]
  "Output Error": error
panel indicators:
  "size(s)": i32
uses:
  NI::G Core::Strings::Trim Whitespace.gvi
diagram:
  for {
    w1 = each element of $"Input all Parts"
    s1 = ""  # shift register
    s2 = string[] []  # shift register
    while (iteration -> i1) {
      case (i1) {
        frame 0 {
          Match Pattern(regular expression="\n", string=w1) -> (after substring=w3, before substring=w4)
        }
        frame 1, Default {
          Match Pattern(regular expression="\n", string=s1) -> (after substring=w3, before substring=w4)
        }
      }
      Insert Into Array(inArray=s2, new=w4) -> w5
      Is Empty String Or Path(string/path=w3) -> w6
      next s1 = w3
      next s2 = w5
      stop if w6
    }
    s3 = string[] []  # shift register
    for {
      w7 = each element of s2
      call "Trim Whitespace.gvi"(string=w7) -> (trimmed string=w8)
      String Length(string=w8) -> (length=w9)
      Is Less Or Equal(x=w9, y=1) -> w10
      case (w10) {
        frame True {
          w11 = s3
        }
        frame False {
          Match Pattern(regular expression=";", string=w8) -> (match substring=w12)
          case (w12) {
            frame "False", Default {
              w11 = s3
            }
            frame ";" {
              Match Pattern(regular expression="Mode", string=w8) -> (after substring=w13, match substring=w14)
              case (w14) {
                frame "False", Default {
                  w11 = s3
                }
                frame "Mode" {
                  Match Pattern(regular expression="/", string=w13) -> (before substring=w15)
                  call "Trim Whitespace.gvi"(string=w15) -> (trimmed string=w16)
                  Insert Into Array(inArray=s3, new=w16) -> w11
                }
              }
            }
          }
        }
      }
      next s3 = w11
    }
    Sort 1D Array(array=s3) -> (sorted array=w17)
    s4 = ""  # shift register
    s5 = uninitialised  # shift register
    for (iteration -> i2) {
      w18 = each element of w17
      case (i2) {
        frame Default {
          Is Equal(x=w18, y=s4) -> w21
          case (w21) {
            frame False, Default {
              Build Array(s5, w18) -> w20
              w19 = w18
            }
            frame True {
              Concatenate Strings(w18, "+") -> w22
              Build Array(s5, w22) -> w20
              w19 = s4
            }
          }
        }
        frame 0 {
          Build Array(w18) -> w20
          w19 = w18
        }
      }
      next s4 = w19
      next s5 = w20
    }
    s6 = s5  # shift register
    s7 = string[] []  # shift register
    for {
      w23 = each element of s3
      s8 = s7  # shift register
      for {
        w24 = each element of s6
        Is Equal(x=w23, y=w24) -> w26
        case (w26) {
          frame False, Default {
            w27 = s8
            w28 = w24
          }
          frame True {
            Concatenate Strings(w24, "=") -> w28
            Build Array(s8, w23) -> w27
          }
        }
        append w28 to w25
        next s8 = w27
      }
      next s6 = w25
      next s7 = s8
    }
    Array Size(array=s7) -> (size(s)=w29)
    Is Greater(x=w29, y=1) -> w30
    case (w30) {
      frame False, Default {
        for {
          w31 = each element of s7
        }
      }
      frame True {
        s9 = ""  # shift register
        for (iteration -> i3) {
          w32 = each element of s7
          case (i3) {
            frame 0 {
              Concatenate Strings("Mixed: ", w32) -> w33
            }
            frame 1, Default {
              Concatenate Strings(s9, "; ", w32) -> w33
            }
          }
          next s9 = w33
        }
        w31 = s9
      }
    }
    $"size(s)" <- w29
    append w31 to w2
  }
  $"Output Error" <- $"Error input"
  $"Operating Mode" <- w2
