vi "Get_Process_and_Prgramme_name_iCC.gviweb"   [G Web Development Software 22.3.0]
inputs:
  "Charge infos": string
  "Input": error
outputs:
  "Process name": string
  "Programme name": string
  "Output": error
uses:
  NI::G Core::Strings::Search and Replace Pattern.gvi
  NI::G Core::Strings::Trim Whitespace.gvi
diagram:
  Match Pattern(regular expression="CLEAN START", string=$"Charge infos") -> (after substring=w1, match substring=w2)
  case (w2) {
    frame "False", Default {
      Match Pattern(regular expression="Clean-Prog", string=$"Charge infos") -> (after substring=w6, match substring=w7)
      case (w7) {
        frame "Clean-Prog" {
          call "Search and Replace Pattern.gvi"(string=w6, pattern=":") -> (result string=w8)
          String Subset(length (rest)=4, string=w8) -> w9
          call "Trim Whitespace.gvi"(string=w9) -> (trimmed string=w10)
          case (w10) {
            frame "False", Default {
              w5 = "Cleaning"
              w4 = "Cleaning"
            }
            frame "001" {
              w5 = "Cleaning programme with descaling process"
              w4 = "Heavy cleaning"
            }
            frame "002" {
              w5 = "Cleaning programme with descaling process"
              w4 = "Meduim cleaning"
            }
            frame "003" {
              w5 = "Cleaning programme with descaling process"
              w4 = "Light cleaning"
            }
            frame "004" {
              w5 = "Cleaning programme with descaling process"
              w4 = "Rinse without tabs"
            }
            frame "005" {
              w5 = "Cleaning programme without descaling process"
              w4 = "Heavy cleaning"
            }
            frame "006" {
              w5 = "Cleaning programme without descaling process"
              w4 = "Medium cleaning"
            }
            frame "007" {
              w5 = "Cleaning programme without descaling process"
              w4 = "Light cleaning"
            }
            frame "008" {
              w5 = "Cleaning programme without descaling process"
              w4 = "Rinse without tabs"
            }
          }
        }
        frame "false", Default {
          w5 = "Cooking Process"
          w4 = "Manual Cooking"
        }
      }
      w3 = $Input
    }
    frame "CLEAN START" {
      Match Pattern(regular expression="PROG", string=w1) -> (after substring=w11)
      String Subset(length (rest)=4, string=w11) -> w12
      call "Trim Whitespace.gvi"(string=w12) -> (trimmed string=w13)
      case (w13) {
        frame "False", Default {
          w5 = "Cleaning"
          w4 = "Cleaning"
        }
        frame "001" {
          w5 = "Cleaning programme with descaling process"
          w4 = "Heavy cleaning"
        }
        frame "002" {
          w5 = "Cleaning programme with descaling process"
          w4 = "Meduim cleaning"
        }
        frame "003" {
          w5 = "Cleaning programme with descaling process"
          w4 = "Light cleaning"
        }
        frame "004" {
          w5 = "Cleaning programme with descaling process"
          w4 = "Rinse without tabs"
        }
        frame "005" {
          w5 = "Cleaning programme without descaling process"
          w4 = "Heavy cleaning"
        }
        frame "006" {
          w5 = "Cleaning programme without descaling process"
          w4 = "Medium cleaning"
        }
        frame "007" {
          w5 = "Cleaning programme without descaling process"
          w4 = "Light cleaning"
        }
        frame "008" {
          w5 = "Cleaning programme without descaling process"
          w4 = "Rinse without tabs"
        }
      }
      w3 = $Input
    }
  }
  $Output <- w3
  $"Programme name" <- w4
  $"Process name" <- w5
