vi "Get_Temperature_Door_state_iCC.gviweb"   [G Web Development Software 22.3.0]
panel controls:
  "Details in line": string[]
  "Array": string[]
  "Start date and time": string
  "Error input": error
panel indicators:
  "date and time": string[]
  "Output Error": error
  "Temp. Unit": string[]
  "Curve singel": T1[]
  "time stamp": timestamp[]
  "chamber temp": f64[]
  "core sensor setpoint": f64[]
  "core sensor curent point": f64[]
  "max value": f64
  "Average temp.": f64
  "Zeiten in sekunden": f64[]
  "Curve double": cluster{"Element 1": f64[], "Element 2": f64[]}[]
  "Programme Details": T2[]
types:
  T1 = cluster{"Element 1": timestamp[], "Element 2": f64[]}
  T2 = cluster{"Mode/ Event": string, "cabinet temp.": string, "core temp. Target": string, "core temp.": string, "Date and time": string}
uses:
  NI::G Core::Strings::Trim Whitespace.gvi
  WebApp::Add_offset_time_txt.gviweb
  NI::G Core::Strings::Search and Replace Pattern.gvi
diagram:
  w1 = $"Start date and time"
  w2 = $"Error input"
  s1 = 0  # shift register
  for {
    w3 = each element of $"Details in line"
    s2 = ""  # shift register
    s3 = f64[] []  # shift register
    s4 = f64[] []  # shift register
    s5 = f64[] []  # shift register
    s6 = string[] []  # shift register
    s7 = uninitialised  # shift register
    s8 = string[] []  # shift register
    s9 = string[] []  # shift register
    s10 = uninitialised  # shift register
    s11 = uninitialised  # shift register
    s12 = uninitialised  # shift register
    s13 = uninitialised  # shift register
    s14 = timestamp[] []  # shift register
    s15 = s1  # shift register
    s16 = f64[] []  # shift register
    while (iteration -> i1) {
      # s9: temp. unit
      # s11: core probre setpoint temp.
      # s12: core probe curent temp.
      # s10: chamber temp.
      case (i1) {
        frame 1, Default {
          call "Trim Whitespace.gvi"(string=s2, location="both"(0)) -> (trimmed string=w28)
          Scan Value(format string="%3s", string=w28) -> (output string=w29, value=w21)
          call "Trim Whitespace.gvi"(string=w29, location="both"(0)) -> (trimmed string=w30)
          Scan Value(format string="%3s", string=w30) -> (output string=w31, value=w32)
          case (w32) {
            frame 0 {
              Match Pattern(regular expression="-", string=w31)
              String Subset(offset (0)=1, string=w31) -> w33
              w22 = 0
            }
            frame 1, Default {
              w22 = w32
              w33 = w31
            }
          }
          call "Trim Whitespace.gvi"(string=w33, location="both"(0)) -> (trimmed string=w34)
          Scan Value(format string="%3s", string=w34) -> (output string=w35, value=w23)
          call "Trim Whitespace.gvi"(string=w35, location="both"(0)) -> (trimmed string=w36)
          Scan From String(formatString="%9s", inputString=w36) -> (outString=w37, out0=w38)
          Scan From String(formatString="%s", inputString=w37) -> (outString=w39, out0=w24)
          Match Pattern(regular expression="\n", string=w39) -> (after substring=w11)
          Is Empty String Or Path(string/path=w11) -> w17
          Insert Into Array(inArray=s9, new=w24) -> w20
          call "Add_offset_time_txt.gviweb"(Start date and time=w1, time offset (sec)=w38, Error input=w2) -> (Date and time=w40, timestamp=w41, Duration in seconds=w42, Output Error=w19)
          Insert Into Array(inArray=s8, new=w40) -> w18
          Insert Into Array(inArray=s14, new=w41) -> w25
          Insert Into Array(inArray=s5, new=w23) -> w14
          Insert Into Array(inArray=s4, new=w22) -> w13
          Insert Into Array(inArray=s3, new=w21) -> w12
          Insert Into Array(inArray=s6, new=s7) -> w15
          Insert Into Array(inArray=s16, new=w42) -> w27
          w16 = s7
          w26 = s15
        }
        frame 0 {
          Match Pattern(regular expression=";", string=w3) -> (after substring=w43)
          Match Pattern(regular expression="/", string=w43) -> (before substring=w44, match substring=w45)
          case (w45) {
            frame "False", Default {
              Match Pattern(regular expression=")", string=w43) -> (after substring=w46, before substring=w47, match substring=w48)
              case (w48) {
                frame ")" {
                  Concatenate Strings(w47, w48) -> w50
                  call "Trim Whitespace.gvi"(string=w50) -> (trimmed string=w49)
                  Match Pattern(regular expression="\n", string=w46) -> (after substring=w51)
                  call "Trim Whitespace.gvi"(string=w46) -> (trimmed string=w52)
                  Is Empty String Or Path(string/path=w51) -> w53
                  case (w53) {
                    frame False, Default {
                      w11 = w51
                      w18 = s8
                      w12 = s3
                      w13 = s4
                      w14 = s5
                      w20 = s9
                      w19 = w2
                      w25 = s14
                      w27 = s16
                    }
                    frame True {
                      call "Add_offset_time_txt.gviweb"(Start date and time=w1, time offset (sec)=w52, Error input=w2) -> (Date and time=w54, timestamp=w55, Duration in seconds=w56, Output Error=w19)
                      Insert Into Array(inArray=s8, new=w54) -> w18
                      Insert Into Array(inArray=s14, new=w55) -> w25
                      Insert Into Array(inArray=s4, new=s11) -> w13
                      Insert Into Array(inArray=s3, new=s10) -> w12
                      Insert Into Array(inArray=s5, new=s12) -> w14
                      Insert Into Array(inArray=s9, new=s13) -> w20
                      Insert Into Array(inArray=s16, new=w56) -> w27
                      w11 = w51
                    }
                  }
                }
                frame "False", Default {
                  Match Pattern(regular expression="ELC", string=w43) -> (after substring=w57, before substring=w58, match substring=w59)
                  case (w59) {
                    frame "ELC" {
                      Concatenate Strings(w59, w58) -> w60
                      call "Trim Whitespace.gvi"(string=w60) -> (trimmed string=w49)
                      Match Pattern(regular expression="\n", string=w57) -> (after substring=w61)
                      call "Trim Whitespace.gvi"(string=w57) -> (trimmed string=w62)
                      Is Empty String Or Path(string/path=w61) -> w63
                      case (w63) {
                        frame False, Default {
                          w11 = w61
                          w18 = s8
                          w12 = s3
                          w13 = s4
                          w14 = s5
                          w20 = s9
                          w19 = w2
                          w25 = s14
                          w27 = s16
                        }
                        frame True {
                          call "Add_offset_time_txt.gviweb"(Start date and time=w1, time offset (sec)=w62, Error input=w2) -> (Date and time=w64, timestamp=w65, Output Error=w19)
                          Insert Into Array(inArray=s8, new=w64) -> w18
                          Insert Into Array(inArray=s14, new=w65) -> w25
                          Insert Into Array(inArray=s4, new=s11) -> w13
                          Insert Into Array(inArray=s3, new=s10) -> w12
                          Insert Into Array(inArray=s5, new=s12) -> w14
                          Insert Into Array(inArray=s9, new=s13) -> w20
                          w11 = w61
                          w27 = s16
                        }
                      }
                    }
                    frame "False", Default {
                      Match Pattern(regular expression="Microwave", string=w43) -> (after substring=w66, match substring=w67)
                      Match Pattern(regular expression="Broken: ", string=w66) -> (after substring=w68, before substring=w69, match substring=w70)
                      String Subset(length (rest)=2, string=w68) -> w71
                      Concatenate Strings(w67, w69, w70, w71) -> w72
                      call "Trim Whitespace.gvi"(string=w72) -> (trimmed string=w49)
                      Match Pattern(regular expression="\n", string=w68) -> (after substring=w73)
                      call "Trim Whitespace.gvi"(string=w68) -> (trimmed string=w74)
                      Is Empty String Or Path(string/path=w73) -> w75
                      case (w75) {
                        frame False, Default {
                          w11 = w73
                          w18 = s8
                          w12 = s3
                          w13 = s4
                          w14 = s5
                          w20 = s9
                          w19 = w2
                          w25 = s14
                          w27 = s16
                        }
                        frame True {
                          call "Add_offset_time_txt.gviweb"(Start date and time=w1, time offset (sec)=w74, Error input=w2) -> (Date and time=w76, timestamp=w77, Duration in seconds=w78, Output Error=w19)
                          Insert Into Array(inArray=s8, new=w76) -> w18
                          Insert Into Array(inArray=s14, new=w77) -> w25
                          Insert Into Array(inArray=s4, new=s11) -> w13
                          Insert Into Array(inArray=s3, new=s10) -> w12
                          Insert Into Array(inArray=s5, new=s12) -> w14
                          Insert Into Array(inArray=s9, new=s13) -> w20
                          Insert Into Array(inArray=s16, new=w78) -> w27
                          w11 = w73
                        }
                      }
                    }
                  }
                }
              }
              case (w49) {
                frame "False", Default {
                  w16 = w49
                }
                frame "end (RETURN)" {
                  w16 = "Program finished with back button"
                }
                frame "end (ERROR)" {
                  w16 = "Program was aborted \ndue to error"
                }
                frame "end (ABORT)" {
                  w16 = "Program was aborted"
                }
                frame "stop (END)" {
                  w16 = "end of Program is reached"
                }
                frame "end (HOME)" {
                  w16 = "Program finished with home button"
                }
                frame "restart (POWER)" {
                  w16 = "Restart after switching off \nor power failure "
                }
              }
            }
            frame "/" {
              Match Pattern(regular expression="\n", string=w43) -> (after substring=w11)
              call "Search and Replace Pattern.gvi"(string=w44, pattern="(EN)") -> (result string=w79)
              call "Trim Whitespace.gvi"(string=w79) -> (trimmed string=w80)
              Match Pattern(regular expression="Handshower", string=w80) -> (match substring=w81)
              case (w81) {
                frame "False", Default {
                  Match Pattern(regular expression=":", string=w80) -> (match substring=w82)
                  case (w82) {
                    frame "False", Default {
                      w16 = w80
                    }
                    frame ":" {
                      call "Search and Replace Pattern.gvi"(string=w80, pattern=":", replace string="\n") -> (result string=w16)
                    }
                  }
                }
                frame "Handshower" {
                  w16 = w81
                }
              }
              w18 = s8
              w12 = s3
              w13 = s4
              w14 = s5
              w20 = s9
              w19 = w2
              w25 = s14
              w27 = s16
            }
          }
          Insert Into Array(inArray=s6, new=w16) -> w15
          Is Empty String Or Path(string/path=w11) -> w17
          w21 = s10
          w22 = s11
          w23 = s12
          w24 = s13
          w26 = s15
        }
      }
      Is Greater(x=w26, y=w21) -> w83
      case (w83) {
        frame False, Default {
          w84 = w21
        }
        frame True {
          w84 = w26
        }
      }
      next s2 = w11
      next s3 = w12
      next s4 = w13
      next s5 = w14
      next s6 = w15
      next s7 = w16
      next s8 = w18
      next s9 = w20
      next s10 = w21
      next s11 = w22
      next s12 = w23
      next s13 = w24
      next s14 = w25
      next s15 = w84
      next s16 = w27
      stop if w17
    }
    $"Output Error" <- w19
    for (after s14) {
      w85 = each element of s6
      w86 = each element of s3
      w87 = each element of s4
      w88 = each element of s5
      w89 = each element of s8
      w90 = each element of s9
      Number To Fractional String(number=w86, precision (6)=0) -> (F-format string=w92)
      Concatenate Strings(w92, " ", w90) -> w93
      Number To Fractional String(number=w87, precision (6)=0) -> (F-format string=w94)
      case (w94) {
        frame "False", Default {
          w95 = w94
          w96 = w90
        }
        frame "0" {
          w95 = "-"
          w96 = ""
        }
      }
      Concatenate Strings(w95, " ", w96) -> w97
      Number To Fractional String(number=w88, precision (6)=0) -> (F-format string=w98)
      Concatenate Strings(w98, " ", w90) -> w99
      Property Node(instance in=T2 {all zero or empty}, "Mode/ Event"=w85, "cabinet temp."=w93, "core temp. Target"=w97, "core temp."=w99, "Date and time"=w89) -> (instance out=w100)
      append w100 to w91
    }
    $"date and time" <- s8
    $"Temp. Unit" <- s9
    concatenate w91 onto w4
    concatenate s3 onto w5
    concatenate s4 onto w6
    concatenate s5 onto w7
    concatenate s14 onto w8
    concatenate s6 onto w9
    concatenate s16 onto w10
    next s1 = s15
  }
  Build Cluster(w8, w5) -> w101
  Build Cluster(w8, w6) -> w102
  Build Cluster(w8, w7) -> w103
  s17 = f64[] []  # shift register
  for {
    w104 = each element of w9
    case (w104) {
      frame "False", Default {
        Insert Into Array(inArray=s17, new=0) -> w105
      }
      frame "Door opened" {
        Insert Into Array(inArray=s17, new=s1) -> w105
      }
    }
    next s17 = w105
  }
  Build Cluster(w8, s17) -> w106
  Build Array(w101, w102, w103, w106) -> w107
  $"Curve singel" <- w107
  $"time stamp" <- w8
  $"max value" <- s1
  $"core sensor setpoint" <- w6
  $"core sensor curent point" <- w7
  $"Programme Details" <- w4
  $"chamber temp" <- w5
  s18 = 0  # shift register
  for {
    w108 = each element of w5
    Add(s18, w108) -> w109
    next s18 = w109
  }
  Array Size(array=w5) -> (size(s)=w110)
  Divide(x=s18, y=w110) -> w111
  $"Average temp." <- w111
  $"Zeiten in sekunden" <- w10
  Build Cluster(w10, w5) -> w112
  Build Cluster(w10, w6) -> w113
  Build Cluster(w10, w7) -> w114
  Build Cluster(w10, s17) -> w115
  Build Array(w112, w113, w114, w115) -> w116
  $"Curve double" <- w116
