vi "Measurements.gviweb"   [G Web Development Software 22.3.0]
inputs:
  "Error input": error
  "Output all Parts": string[]
  "Start date and time": string
  "Unit Temp": string
outputs:
  "Output Error": error
  "General information": T1[]
  "Observed Data and Fitted Curve": T2[]
  "Energieverbrauch": string
  "max value": f64
  "average temp.": f64
types:
  T1 = cluster{"mode": string, "chamber_temperature°C": string, "food_temperature_set": string, "food_temperature": string, "Date and time": string}
  T2 = cluster{"Element 1": timestamp[], "Element 2": f64[]}
  T3 = cluster{"Chamber temperature": f64, "food temperature setpoint": f64, "food temperature actual": f64, "timestamp": timestamp}
uses:
  NI::G Core::Strings::Trim Whitespace.gvi
  WebApp::Function.gviweb
diagram:
  s1 = T1[] []  # shift register
  s2 = ""  # shift register
  s3 = ""  # shift register
  s4 = ""  # shift register
  s5 = ""  # shift register
  s6 = T3[] []  # shift register
  s7 = uninitialised  # shift register
  s8 = f64[] []  # shift register
  s9 = ""  # shift register
  s10 = 0  # shift register
  s11 = 0  # shift register
  for {
    w1 = each element of $"Output all Parts"
    # s2: Chamber. temp
    # s4: food temp actual
    # s5: Date & time
    # s3: food temp setpoint
    # $"Start date and time": Start date and time
    Match Pattern(regular expression="<_3.1>", string=w1) -> (match substring=w2)
    # s9: Energieverbrauch
    case (w2) {
      frame "False", Default {
        Match Pattern(regular expression="<_2.1>", string=w1) -> (match substring=w15)
        case (w15) {
          frame "False", Default {
            w3 = s1
            w4 = s2
            w5 = s3
            w6 = s4
            w7 = s5
            w8 = $"Error input"
            w9 = s6
            w10 = s7
            w11 = s8
            w12 = s9
            w13 = s10
            w14 = s11
          }
          frame "<_2.1>" {
            Floating Point String To Number(string=s2) -> (number=w16)
            Is Greater(x=s10, y=w16) -> w17
            case (w17) {
              frame False, Default {
                w13 = w16
              }
              frame True {
                w13 = s10
              }
            }
            Add(s11, w16) -> w14
            Match Pattern(regular expression="<_2.4>", string=w1) -> (after substring=w18)
            Match Pattern(regular expression="</_", string=w18) -> (before substring=w19)
            call "Trim Whitespace.gvi"(string=w19) -> (trimmed string=w12)
            Floating Point String To Number(string=s3) -> (number=w20)
            Floating Point String To Number(string=s4) -> (number=w21)
            Match Pattern(regular expression="<_2.2>", string=w1) -> (after substring=w22)
            Match Pattern(regular expression="</_", string=w22) -> (before substring=w23)
            call "Trim Whitespace.gvi"(string=w23) -> (trimmed string=w24)
            call "Function.gviweb"(Start date and time=$"Start date and time", time offset (sec)=w24, Error input=$"Error input") -> (timestamp=w25, Date and time=w7, Output Error=w8)
            Property Node(instance in=T3 {all zero or empty}, "Chamber temperature"=w16, "food temperature setpoint"=w20, "food temperature actual"=w21, "timestamp"=w25) -> (instance out=w26)
            Insert Into Array(inArray=s6, new=w26) -> w9
            Concatenate Strings(s2, " ", $"Unit Temp") -> w27
            Concatenate Strings(s4, " ", $"Unit Temp") -> w28
            Concatenate Strings(s3, " ", $"Unit Temp") -> w29
            case (w29) {
              frame "False", Default {
                w30 = w29
              }
              frame "0 °C", "0 °F" {
                w30 = "-"
              }
            }
            Match Pattern(regular expression="<_2.1>", string=w1) -> (after substring=w31)
            Match Pattern(regular expression="</_", string=w31) -> (before substring=w32)
            call "Trim Whitespace.gvi"(string=w32) -> (trimmed string=w33)
            Decimal String To Number(string=w33) -> (number=w34)
            case (w34) {
              frame 0, Default {
                w35 = "Undefiniert\n\n"
                w10 = 0
              }
              frame 1 {
                w35 = " Door opened "
                w10 = 1
              }
              frame 2 {
                w35 = " Door closed "
                w10 = 0
              }
              frame 3 {
                w35 = "Program finished \nwith home button"
                w10 = 0
              }
              frame 4 {
                w35 = "Program finished \nwith back button"
                w10 = 0
              }
              frame 5 {
                w36 = "Door was open too long \nduring cooking time. \nproduct quality at risk"
                w35 = w36
                w10 = 0
              }
              frame 6 {
                w37 = "Door was open \ntoo long during cooking time. \nproduct spoilt"
                w35 = w37
                w10 = 0
              }
              frame 7 {
                w38 = "Door was open \ntoo long during loading procedure. \nproduct quality at risk"
                w35 = w38
                w10 = 0
              }
              frame 8 {
                w39 = "Door was open \ntoo long during loading procedure. \nproduct spoilt."
                w35 = w39
                w10 = 0
              }
              frame 9 {
                w35 = "Cooking process was aborted \ndue to error "
                w10 = 0
              }
              frame 10 {
                w35 = "Change over to rolling\n loading  (ELC)"
                w10 = 0
              }
              frame 11 {
                w35 = "Restart after switching off \nor power failure"
                w10 = 0
              }
              frame 12 {
                w35 = "End of process is reached"
                w10 = 0
              }
              frame 13 {
                w35 = "Neustart nach regulärem Ausschalten"
                w10 = 0
              }
              frame 14 {
                w35 = "Neustart nach Stromausfall"
                w10 = 0
              }
              frame 15 {
                w40 = "Übergang von Mischbeschickung \noder intelligentem Garen \nin manuelle Betriebsart"
                w35 = w40
                w10 = 0
              }
              frame 16 {
                w35 = "Door was open too long \nduring preaheating\t"
                w10 = 0
              }
            }
            call "Trim Whitespace.gvi"(string=w35) -> (trimmed string=w41)
            Property Node(instance in=T1 {all zero or empty}, "mode"=w41, "chamber_temperature°C"=w27, "food_temperature_set"=w30, "food_temperature"=w28, "Date and time"=w7) -> (instance out=w42)
            Insert Into Array(inArray=s1, new=w42) -> w3
            Insert Into Array(inArray=s8, new=w10) -> w11
            w4 = s2
            w5 = s3
            w6 = s4
          }
        }
      }
      frame "<_3.1>" {
        Insert Into Array(inArray=s8, new=0) -> w11
        Match Pattern(regular expression="<_3.2>", string=w1) -> (after substring=w43)
        Match Pattern(regular expression="</_", string=w43) -> (before substring=w44)
        call "Trim Whitespace.gvi"(string=w44) -> (trimmed string=w4)
        Concatenate Strings(w4, " ", $"Unit Temp") -> w45
        Match Pattern(regular expression="<_3.4>", string=w1) -> (after substring=w46)
        Match Pattern(regular expression="</_", string=w46) -> (before substring=w47)
        call "Trim Whitespace.gvi"(string=w47) -> (trimmed string=w6)
        Concatenate Strings(w6, " ", $"Unit Temp") -> w48
        Match Pattern(regular expression="<_3.5>", string=w1) -> (after substring=w49)
        Match Pattern(regular expression="</_", string=w49) -> (before substring=w50)
        call "Trim Whitespace.gvi"(string=w50) -> (trimmed string=w51)
        call "Function.gviweb"(Start date and time=$"Start date and time", time offset (sec)=w51, Error input=$"Error input") -> (timestamp=w52, Date and time=w7, Output Error=w8)
        Match Pattern(regular expression="<_3.3>", string=w1) -> (after substring=w53)
        Match Pattern(regular expression="</_", string=w53) -> (before substring=w54)
        call "Trim Whitespace.gvi"(string=w54) -> (trimmed string=w5)
        Concatenate Strings(w5, " ", $"Unit Temp") -> w55
        case (w55) {
          frame "False", Default {
            w56 = w55
          }
          frame "0 °C", "0 °F" {
            w56 = "-"
          }
        }
        Match Pattern(regular expression="<_3.1>", string=w1) -> (after substring=w57)
        Match Pattern(regular expression="</_", string=w57) -> (before substring=w58)
        call "Trim Whitespace.gvi"(string=w58) -> (trimmed string=w59)
        Decimal String To Number(string=w59) -> (number=w60)
        case (w60) {
          frame 0, Default {
            w61 = "UNDEFINED/OFF"
          }
          frame 1 {
            w61 = "STEAM "
          }
          frame 2 {
            w61 = "HOT_AIR"
          }
          frame 3 {
            w61 = "COMBI"
          }
          frame 4 {
            w61 = "COOL_DOWN"
          }
          frame 5 {
            w61 = "FRYING"
          }
          frame 6 {
            w61 = "BOILING"
          }
          frame 7 {
            w61 = "DEEP_FRYING"
          }
          frame 8 {
            w61 = "PRESSURE"
          }
          frame 9 {
            w61 = "UNCHANGED"
          }
        }
        call "Trim Whitespace.gvi"(string=w61) -> (trimmed string=w62)
        Property Node(instance in=T1 {all zero or empty}, "mode"=w62, "chamber_temperature°C"=w45, "food_temperature_set"=w56, "food_temperature"=w48, "Date and time"=w7) -> (instance out=w63)
        Insert Into Array(inArray=s1, new=w63) -> w3
        Floating Point String To Number(string=w4) -> (number=w64)
        Is Greater(x=s10, y=w64) -> w65
        case (w65) {
          frame False, Default {
            w13 = w64
          }
          frame True {
            w13 = s10
          }
        }
        Add(w64, s11) -> w14
        Floating Point String To Number(string=w5) -> (number=w66)
        Floating Point String To Number(string=w6) -> (number=w67)
        Property Node(instance in=T3 {all zero or empty}, "Chamber temperature"=w64, "food temperature setpoint"=w66, "food temperature actual"=w67, "timestamp"=w52) -> (instance out=w68)
        Insert Into Array(inArray=s6, new=w68) -> w9
        w10 = 0
        w12 = s9
      }
    }
    next s1 = w3
    next s2 = w4
    next s3 = w5
    next s4 = w6
    next s5 = w7
    next s6 = w9
    next s7 = w10
    next s8 = w11
    next s9 = w12
    next s10 = w13
    next s11 = w14
  }
  $"General information" <- s1
  for {
    w69 = each element of s6
    Property Node(instance in=w69) -> ("Chamber temperature"=w74, "food temperature setpoint"=w75, "food temperature actual"=w76, "timestamp"=w77)
    append w74 to w70
    append w75 to w71
    append w76 to w72
    append w77 to w73
  }
  Build Cluster(w73, w70) -> w78
  Build Cluster(w73, w71) -> w79
  Build Cluster(w73, w72) -> w80
  for {
    w81 = each element of s8
    Multiply(w81, s10) -> w83
    append w83 to w82
  }
  Build Cluster(w73, w82) -> w84
  Build Array(w78, w79, w80, w84) -> w85
  $"Observed Data and Fitted Curve" <- w85
  $Energieverbrauch <- s9
  $"max value" <- s10
  $"Output Error" <- w8
  Array Size(array=s8) -> (size(s)=w86)
  Divide(x=s11, y=w86) -> w87
  $"average temp." <- w87
