vi "Measurements_Txt_iCC.gviweb"   [G Web Development Software 22.3.0]
inputs:
  "Get all charge": string[]
  "Error in": error
outputs:
  "Charge infos": T1[]
  "First charge": string
  "Error out": error
types:
  T1 = cluster{"selected": bool, "Charge Nr.": string, "Process name": string, "Programme name": string, "Date and time": string, "Duration": string, "Status": string, "Average temp.": string}
uses:
  WebApp::Get_Average_Temp_iCC.gviweb
  NI::G Core::Strings::Search and Replace Pattern.gvi
  NI::G Core::Strings::Trim Whitespace.gvi
  WebApp::Get_Duration_iCC.gviweb
  WebApp::Get_Process_and_Prgramme_name_iCC.gviweb
  WebApp::Get_Duration_If_Stop_Missing.gviweb
  WebApp::Calculate_duration_for_iCC.gviweb
diagram:
  call "Get_Average_Temp_iCC.gviweb"(Input all Parts=$"Get all charge", Error input=$"Error in") -> (Average temp.=w1, Output Error=w2)
  for (iteration -> i1) {
    w3 = each element of $"Get all charge"
    w4 = each element of w1
    Match Pattern(regular expression="end", string=w3) -> (match substring=w6)
    case (w6) {
      frame "end" {
        w7 = "Completed"
      }
      frame "ABORT" {
        w7 = "Aborted"
      }
      frame "false", Default {
        w7 = "Aborted/ Canceled"
      }
    }
    Match Pattern(regular expression="Ch-nr.", string=w3) -> (after substring=w8)
    Match Pattern(regular expression="<<", string=w8) -> (before substring=w9)
    call "Search and Replace Pattern.gvi"(string=w9, pattern=">>") -> (result string=w10)
    call "Trim Whitespace.gvi"(string=w10) -> (trimmed string=w11)
    case (i1) {
      frame 0 {
        $"First charge" <- w11
        w12 = TRUE
      }
      frame 1, Default {
        w12 = FALSE
      }
    }
    call "Get_Duration_iCC.gviweb"(Charge infos=w3, Error Input=w2) -> (Start Date and Time=w13, Output Error=w14)
    call "Trim Whitespace.gvi"(string=w13) -> (trimmed string=w15)
    call "Trim Whitespace.gvi"(string=w3) -> (trimmed string=w16)
    call "Get_Process_and_Prgramme_name_iCC.gviweb"(Charge infos=w16, Input=w14) -> (Process name=w17, Programme name=w18, Output=w19)
    call "Get_Duration_If_Stop_Missing.gviweb"(Charge infos=w3, Error input=w19) -> (Last date and time=w20, Error ouput=w21)
    call "Calculate_duration_for_iCC.gviweb"(Start date and time=w13, Last date and time=w20, Error input=w21) -> (Duration=w22, Output Error=w23)
    Property Node(instance in=T1 {all zero or empty}, "selected"=w12, "Charge Nr."=w11, "Process name"=w17, "Programme name"=w18, "Date and time"=w15, "Duration"=w22, "Status"=w7, "Average temp."=w4) -> (instance out=w24)
    append w24 to w5
  }
  $"Charge infos" <- w5
  $"Error out" <- w23
