vi "Measurements_Txt_iCombiPro.gviweb"   [G Web Development Software 22.3.0]
inputs:
  "Get all charge": string[]
  "Error in": error
outputs:
  "Charge infos": T1[]
  "Error out": error
  "First charge": string
types:
  T1 = cluster{"selected": bool, "Charge Nr.": string, "Process name": string, "Programme name": string, "Date and time": string, "Duration": string, "Status": string, "Average temp.": string}
uses:
  WebApp::Get_Average_Temp.gviweb
  NI::G Core::Strings::Search and Replace Pattern.gvi
  NI::G Core::Strings::Trim Whitespace.gvi
  WebApp::Get_recipe_name_process_icombi_pro.gviweb
  WebApp::Get_Duration_If_Stop_Missing.gviweb
diagram:
  call "Get_Average_Temp.gviweb"(Input all Parts=$"Get all charge", Error input=$"Error in") -> (Average temp.=w1, Output Error=w2)
  for (iteration -> i1) {
    w3 = each element of $"Get all charge"
    w4 = each element of w1
    Match Pattern(regular expression="Ch-nr.", string=w3) -> (after substring=w6)
    Match Pattern(regular expression="<<", string=w6) -> (before substring=w7)
    call "Search and Replace Pattern.gvi"(string=w7, pattern=">>") -> (result string=w8)
    call "Trim Whitespace.gvi"(string=w8) -> (trimmed string=w9)
    Match Pattern(regular expression="stop", string=w3) -> (after substring=w10)
    Match Pattern(regular expression=")", string=w10) -> (before substring=w11)
    Match Pattern(regular expression="(", string=w11) -> (after substring=w12)
    call "Trim Whitespace.gvi"(string=w12) -> (trimmed string=w13)
    Match Pattern(regular expression="end (", string=w3) -> (after substring=w14)
    Match Pattern(regular expression=")", string=w14) -> (after substring=w15, before substring=w16)
    call "Trim Whitespace.gvi"(string=w16) -> (trimmed string=w17)
    case (w13) {
      frame "RETURN" {
        w18 = "Completed"
      }
      frame "false", Default {
        case (w17) {
          frame "RETURN" {
            w18 = "Completed"
          }
          frame "ABORT" {
            w18 = "Cancelled/aborted"
          }
          frame "false", Default {
            w18 = "Selected only"
          }
        }
      }
      frame "ABORT" {
        w18 = "Cancelled/aborted"
      }
      frame "24H" {
        w18 = "Operation over 24H"
      }
    }
    case (i1) {
      frame 0 {
        $"First charge" <- w9
        w19 = TRUE
      }
      frame 1, Default {
        w19 = FALSE
      }
    }
    Match Pattern(regular expression="Pr-GUID", string=w3) -> (after substring=w20)
    Match Pattern(regular expression="<<", string=w20) -> (before substring=w21)
    call "Search and Replace Pattern.gvi"(string=w21, pattern=">>") -> (result string=w22)
    call "Trim Whitespace.gvi"(string=w22) -> (trimmed string=w23)
    Match Pattern(regular expression="Progr.", string=w3) -> (after substring=w24)
    Match Pattern(regular expression=")", string=w24) -> (before substring=w25)
    Match Pattern(regular expression="(", string=w25) -> (after substring=w26)
    call "Trim Whitespace.gvi"(string=w26) -> (trimmed string=w27)
    call "Get_recipe_name_process_icombi_pro.gviweb"(Programm Id=w27, GUID=w23, Input=w2) -> (Process name=w28, Programme name=w29, Output=w30)
    Match Pattern(regular expression=";", string=w15) -> (before substring=w31)
    call "Trim Whitespace.gvi"(string=w31) -> (trimmed string=w32)
    Is Empty String Or Path(string/path=w32) -> w33
    case (w33) {
      frame False, Default {
        w34 = w32
        w35 = w30
      }
      frame True {
        call "Get_Duration_If_Stop_Missing.gviweb"(Charge infos=w3, Error input=w30) -> (Duration=w34, Error ouput=w35)
      }
    }
    Match Pattern(regular expression="Time", string=w3) -> (after substring=w36)
    Match Pattern(regular expression="<<", string=w36) -> (before substring=w37)
    call "Search and Replace Pattern.gvi"(string=w37, pattern=">>") -> (result string=w38)
    call "Trim Whitespace.gvi"(string=w38) -> (trimmed string=w39)
    Property Node(instance in=T1 {all zero or empty}, "selected"=w19, "Charge Nr."=w9, "Process name"=w28, "Programme name"=w29, "Date and time"=w39, "Duration"=w34, "Status"=w18, "Average temp."=w4) -> (instance out=w40)
    append w40 to w5
  }
  $"Charge infos" <- w5
  $"Error out" <- w35
