vi "Measurements_iVario.gviweb"   [G Web Development Software 22.3.0]
inputs:
  "Error input": error
  "Output all Parts": string[]
  "Start date and time": string
  "Temp Einheit": string
outputs:
  "Output Error": error
  "General information": T2[]
  "Observed Data and Fitted Curve": T1[]
  "Energieverbrauch": string
  "max value": f64
  "average temp.": f64
types:
  T1 = cluster{"Element 1": timestamp[], "Element 2": f64[]}
  T2 = cluster{"mode": string, "chamber_temperature°C": string, "food_temperature_set": string, "food_temperature": string, "Used heating elements": string, "Date and time": string}
  T3 = cluster{"Chamber temperature": f64, "food temperature setpoint": f64, "food temperature actual": f64, "timestamp": timestamp}
uses:
  NI::G Core::Strings::Trim Whitespace.gvi
  WebApp::Function.gviweb
diagram:
  s1 = T2[] []  # shift register
  s2 = ""  # shift register
  s3 = ""  # shift register
  s4 = ""  # shift register
  s5 = ""  # shift register
  s6 = T3[] []  # shift register
  s7 = 0  # shift register
  s8 = f64[] []  # shift register
  s9 = ""  # shift register
  s10 = 0  # shift register
  s11 = ""  # shift register
  s12 = ""  # shift register
  s13 = 0  # shift register
  for {
    w1 = each element of $"Output all Parts"
    # s4: food temp actual
    Match Pattern(regular expression="<_3.1>", string=w1) -> (match substring=w2)
    # s2: Chamber. temp
    # $"Start date and time": Start date and time
    # s12: Mode
    # s3: food temp setpoint
    # s11: Used heating elements
    # s9: Energieverbrauch
    # s5: Date & time
    case (w2) {
      frame "False", Default {
        Match Pattern(regular expression="<_2.1>", string=w1) -> (match substring=w17)
        case (w17) {
          frame "False", Default {
            # s2: Chamber. temp
            # s3: food temp setpoint
            # s4: food temp actual
            # s5: Date & time
            # s9: Energieverbrauch
            Match Pattern(regular expression="<_7.1>", string=w1) -> (match substring=w18)
            case (w18) {
              frame "<_7.1>" {
                Concatenate Strings(s2, $"Temp Einheit") -> w19
                Concatenate Strings(s3, $"Temp Einheit") -> w20
                Concatenate Strings(s4, $"Temp Einheit") -> w21
                Match Pattern(regular expression="<_7.2>", string=w1) -> (after substring=w22)
                Match Pattern(regular expression="</_", string=w22) -> (before substring=w23)
                call "Trim Whitespace.gvi"(string=w23) -> (trimmed string=w24)
                call "Function.gviweb"(Start date and time=$"Start date and time", time offset (sec)=w24, Error input=$"Error input") -> (Date and time=w25, Output Error=w8)
                Match Pattern(regular expression="<_7.1>", string=w1) -> (after substring=w26)
                Match Pattern(regular expression="</_", string=w26) -> (before substring=w27)
                call "Trim Whitespace.gvi"(string=w27) -> (trimmed string=w14)
                Property Node(instance in=T2 {all zero or empty}, "mode"=s12, "chamber_temperature°C"=w19, "food_temperature_set"=w20, "food_temperature"=w21, "Used heating elements"=w14, "Date and time"=w25) -> (instance out=w28)
                Insert Into Array(inArray=s1, new=w28) -> w3
                w9 = s6
                w11 = s8
                w12 = s9
                w4 = s2
                w13 = s10
                w10 = s7
                w7 = s5
                w5 = s3
                w6 = s4
                w15 = s12
                w16 = s13
              }
              frame "False", Default {
                w3 = s1
                w9 = s6
                w11 = s8
                w12 = s9
                w4 = s2
                w13 = s10
                w8 = $"Error input"
                w10 = s7
                w7 = s5
                w5 = s3
                w6 = s4
                w14 = s11
                w15 = s12
                w16 = s13
              }
            }
          }
          frame "<_2.1>" {
            Floating Point String To Number(string=s2) -> (number=w29)
            Floating Point String To Number(string=s3) -> (number=w30)
            Floating Point String To Number(string=s4) -> (number=w31)
            Match Pattern(regular expression="<_2.2>", string=w1) -> (after substring=w32)
            Match Pattern(regular expression="</_", string=w32) -> (before substring=w33)
            call "Trim Whitespace.gvi"(string=w33) -> (trimmed string=w34)
            call "Function.gviweb"(Start date and time=$"Start date and time", time offset (sec)=w34, Error input=$"Error input") -> (timestamp=w35, Date and time=w7, Output Error=w8)
            Property Node(instance in=T3 {all zero or empty}, "Chamber temperature"=w29, "food temperature setpoint"=w30, "food temperature actual"=w31, "timestamp"=w35) -> (instance out=w36)
            Insert Into Array(inArray=s6, new=w36) -> w9
            Match Pattern(regular expression="<_2.1>", string=w1) -> (after substring=w37)
            Match Pattern(regular expression="</_", string=w37) -> (before substring=w38)
            call "Trim Whitespace.gvi"(string=w38) -> (trimmed string=w39)
            Decimal String To Number(string=w39) -> (number=w40)
            case (w40) {
              frame 0, Default {
                w41 = "Undefiniert\n\n"
                w10 = 0
              }
              frame 1 {
                w41 = "Lid opened "
                w10 = 1
              }
              frame 2 {
                w41 = "Lid closed "
                w10 = 0
              }
              frame 3 {
                w41 = "Program finished \nwith home button"
                w10 = 0
              }
              frame 4 {
                w41 = "Program finished \nwith back button"
                w10 = 0
              }
              frame 5 {
                w42 = "Lid was open too long \nduring cooking time. \nproduct quality at risk"
                w41 = w42
                w10 = 0
              }
              frame 6 {
                w43 = "Lid was open \ntoo long during cooking time. \nproduct spoilt"
                w41 = w43
                w10 = 0
              }
              frame 7 {
                w44 = "Lid was open \ntoo long during loading procedure. \nproduct quality at risk"
                w41 = w44
                w10 = 0
              }
              frame 8 {
                w45 = "Lid was open \ntoo long during loading procedure. \nproduct spoilt."
                w41 = w45
                w10 = 0
              }
              frame 9 {
                w41 = "Cooking process was aborted \ndue to error "
                w10 = 0
              }
              frame 10 {
                w41 = "Change over to rolling\n loading  (ELC)"
                w10 = 0
              }
              frame 11 {
                w41 = "Restart after switching off \nor power failure"
                w10 = 0
              }
              frame 12 {
                w41 = "End of process is reached"
                w10 = 0
              }
              frame 13 {
                w41 = "Neustart nach regulärem Ausschalten"
                w10 = 0
              }
              frame 14 {
                w41 = "Neustart nach Stromausfall"
                w10 = 0
              }
              frame 15 {
                w46 = "Übergang von Mischbeschickung \noder intelligentem Garen \nin manuelle Betriebsart"
                w41 = w46
                w10 = 0
              }
              frame 16 {
                w41 = "Lid was open too long \nduring preaheating\t"
                w10 = 0
              }
            }
            Insert Into Array(inArray=s8, new=w10) -> w11
            Is Greater(x=s10, y=w29) -> w47
            case (w47) {
              frame False, Default {
                w13 = w29
              }
              frame True {
                w13 = s10
              }
            }
            Concatenate Strings(s2, $"Temp Einheit") -> w48
            Concatenate Strings(s3, $"Temp Einheit") -> w49
            Concatenate Strings(s4, $"Temp Einheit") -> w50
            call "Trim Whitespace.gvi"(string=w41) -> (trimmed string=w15)
            Property Node(instance in=T2 {all zero or empty}, "mode"=w15, "chamber_temperature°C"=w48, "food_temperature_set"=w49, "food_temperature"=w50, "Used heating elements"=s11, "Date and time"=w7) -> (instance out=w51)
            Insert Into Array(inArray=s1, new=w51) -> w3
            Add(s13, w29) -> w16
            Match Pattern(regular expression="<_2.4>", string=w1) -> (after substring=w52)
            Match Pattern(regular expression="</_", string=w52) -> (before substring=w53)
            call "Trim Whitespace.gvi"(string=w53) -> (trimmed string=w12)
            w4 = s2
            w5 = s3
            w6 = s4
            w14 = s11
          }
        }
      }
      frame "<_3.1>" {
        Match Pattern(regular expression="<_3.3>", string=w1) -> (after substring=w54)
        Match Pattern(regular expression="</_", string=w54) -> (before substring=w55)
        call "Trim Whitespace.gvi"(string=w55) -> (trimmed string=w5)
        Floating Point String To Number(string=w5) -> (number=w56)
        Match Pattern(regular expression="<_3.4>", string=w1) -> (after substring=w57)
        Match Pattern(regular expression="</_", string=w57) -> (before substring=w58)
        call "Trim Whitespace.gvi"(string=w58) -> (trimmed string=w6)
        Floating Point String To Number(string=w6) -> (number=w59)
        Match Pattern(regular expression="<_3.2>", string=w1) -> (after substring=w60)
        Match Pattern(regular expression="</_", string=w60) -> (before substring=w61)
        call "Trim Whitespace.gvi"(string=w61) -> (trimmed string=w4)
        Floating Point String To Number(string=w4) -> (number=w62)
        Match Pattern(regular expression="<_3.5>", string=w1) -> (after substring=w63)
        Match Pattern(regular expression="</_", string=w63) -> (before substring=w64)
        call "Trim Whitespace.gvi"(string=w64) -> (trimmed string=w65)
        call "Function.gviweb"(Start date and time=$"Start date and time", time offset (sec)=w65, Error input=$"Error input") -> (timestamp=w66, Date and time=w7, Output Error=w8)
        Property Node(instance in=T3 {all zero or empty}, "Chamber temperature"=w62, "food temperature setpoint"=w56, "food temperature actual"=w59, "timestamp"=w66) -> (instance out=w67)
        Insert Into Array(inArray=s6, new=w67) -> w9
        Insert Into Array(inArray=s8, new=0) -> w11
        Concatenate Strings(w4, $"Temp Einheit") -> w68
        Concatenate Strings(w5, $"Temp Einheit") -> w69
        Concatenate Strings(w6, $"Temp Einheit") -> w70
        Match Pattern(regular expression="<_3.1>", string=w1) -> (after substring=w71)
        Match Pattern(regular expression="</_", string=w71) -> (before substring=w72)
        call "Trim Whitespace.gvi"(string=w72) -> (trimmed string=w73)
        Decimal String To Number(string=w73) -> (number=w74)
        case (w74) {
          frame 0, Default {
            w75 = "UNDEFINED/OFF"
          }
          frame 1 {
            w75 = "STEAM "
          }
          frame 2 {
            w75 = "HOT_AIR"
          }
          frame 3 {
            w75 = "COMBI"
          }
          frame 4 {
            w75 = "COOL_DOWN"
          }
          frame 5 {
            w75 = "FRYING"
          }
          frame 6 {
            w75 = "BOILING"
          }
          frame 7 {
            w75 = "DEEP_FRYING"
          }
          frame 8 {
            w75 = "PRESSURE"
          }
          frame 9 {
            w75 = "UNCHANGED"
          }
        }
        call "Trim Whitespace.gvi"(string=w75) -> (trimmed string=w76)
        Property Node(instance in=T2 {all zero or empty}, "mode"=w76, "chamber_temperature°C"=w68, "food_temperature_set"=w69, "food_temperature"=w70, "Used heating elements"=s11, "Date and time"=w7) -> (instance out=w77)
        Insert Into Array(inArray=s1, new=w77) -> w3
        Is Greater(x=s10, y=w62) -> w78
        case (w78) {
          frame False, Default {
            w13 = w62
          }
          frame True {
            w13 = s10
          }
        }
        Add(w62, s13) -> w16
        w10 = 0
        w12 = s9
        w14 = s11
        w15 = s12
      }
    }
    next s1 = w3
    next s2 = w4
    next s3 = w5
    next s4 = w6
    next s5 = w7
    next s6 = w9
    next s7 = w10
    next s8 = w11
    next s9 = w12
    next s10 = w13
    next s11 = w14
    next s12 = w15
    next s13 = w16
  }
  for {
    w79 = each element of s6
    Property Node(instance in=w79) -> ("Chamber temperature"=w84, "food temperature setpoint"=w85, "food temperature actual"=w86, "timestamp"=w87)
    append w84 to w80
    append w85 to w81
    append w86 to w82
    append w87 to w83
  }
  Build Cluster(w83, w80) -> w88
  Build Cluster(w83, w81) -> w89
  Build Cluster(w83, w82) -> w90
  for {
    w91 = each element of s8
    Multiply(w91, s10) -> w93
    append w93 to w92
  }
  Build Cluster(w83, w92) -> w94
  Build Array(w88, w89, w90, w94) -> w95
  $"Observed Data and Fitted Curve" <- w95
  $"Output Error" <- w8
  Array Size(array=s8) -> (size(s)=w96)
  Divide(x=s13, y=w96) -> w97
  $"average temp." <- w97
  Delete From Array(inArray=s1, length (1)=1, index0=0) -> w98
  $"General information" <- w98
  $Energieverbrauch <- s9
  $"max value" <- s10
