vi "Read_XML_Part_all.gviweb"   [G Web Development Software 22.3.0]
inputs:
  "Input XML": string
  "End XML Part": string = "</Common_Information>"
  "Start XML Part": string = "<Common_Information>"
  "Error in": error
outputs:
  "Error out": error
  "Output XML array": string[]
uses:
  NI::G Core::Strings::Trim Whitespace.gvi
diagram:
  s1 = string[] []  # shift register
  s2 = ""  # shift register
  while (iteration -> i1) {
    case (i1) {
      frame 1, Default {
        Match Pattern(regular expression=$"Start XML Part", string=s2) -> (after substring=w3)
        Match Pattern(regular expression=$"End XML Part", string=w3) -> (after substring=w2, before substring=w1)
      }
      frame 0 {
        Match Pattern(regular expression=$"Start XML Part", string=$"Input XML") -> (after substring=w4)
        Match Pattern(regular expression=$"End XML Part", string=w4) -> (after substring=w2, before substring=w1)
      }
    }
    call "Trim Whitespace.gvi"(String=w2) -> (Gekürzter String=w5)
    Is Empty String Or Path(string/path=w5) -> w6
    case (w6) {
      frame False, Default {
        Insert Into Array(inArray=s1, new=w1) -> w7
        w8 = w2
        w9 = w6
      }
      frame True {
        w7 = s1
        w8 = ""
        w9 = w6
      }
    }
    next s1 = w7
    next s2 = w8
    stop if w9
  }
  $"Output XML array" <- s1
  $"Error out" <- $"Error in"
