vi "Sort_table_iVario.gviweb"   [G Web Development Software 22.3.0]
inputs:
  "Sort Process name": bool
  "Error Cluster input": error
  "common_iVario": T1[]
outputs:
  "Output Common": T1[]
  "Error Output": error
types:
  T1 = cluster{"Selected": bool, "Charge Nr.": string, "Operating mode": string, "Programme name": string, "Date and time ⌚": string, "Duration": string, "Status": string, "Average temp. (°C/°F)": string, "Device side": string, "Active heating elements": string, "iZC active ?": string}
diagram:
  for {
    w1 = each element of $common_iVario
    Property Node(instance in=w1, "Selected"=FALSE) -> ("Charge Nr."=w3, "Operating mode"=w4, instance out=w5)
    Property Node(instance in=w5, "Operating mode"=w3, "Charge Nr."=w4) -> (instance out=w6)
    append w6 to w2
  }
  Sort 1D Array(array=w2) -> (sorted array=w7)
  case ($"Sort Process name") {
    frame True {
      w8 = w7
    }
    frame False {
      Reverse 1D Array(array=w7) -> (reversed array=w8)
    }
  }
  for {
    w9 = each element of w8
    Property Node(instance in=w9) -> ("Charge Nr."=w11, "Operating mode"=w12, instance out=w13)
    Property Node(instance in=w13, "Operating mode"=w11, "Charge Nr."=w12) -> (instance out=w14)
    append w14 to w10
  }
  $"Output Common" <- w10
  $"Error Output" <- $"Error Cluster input"
