vi "Specification_iCC.gviweb"   [G Web Development Software 22.3.0]
inputs:
  "Error input": error
  "Get all charge": string[]
outputs:
  "General information": cluster{"Entry": string, "Information": string}[]
  "Error Output": error
panel indicators:
  "Serial number": string
  "Device": string
uses:
  NI::G Core::Strings::Search and Replace Pattern.gvi
  NI::G Core::Strings::Trim Whitespace.gvi
diagram:
  s1 = string[] []  # shift register
  for {
    w1 = each element of $"Get all charge"
    Is Empty String Or Path(string/path=w1) -> w2
    case (w2) {
      frame True {
        w3 = s1
      }
      frame False {
        Insert Into Array(inArray=s1, new=w1) -> w3
      }
    }
    next s1 = w3
  }
  Array Subset(array=s1, index0=0, length0=1) -> w4
  Array Index(array=w4) -> (out0[0]=w5)
  Match Pattern(regular expression="Serial", string=w5) -> (after substring=w6)
  Match Pattern(regular expression="<<", string=w6) -> (before substring=w7)
  call "Search and Replace Pattern.gvi"(string=w7, pattern=">>") -> (result string=w8)
  call "Trim Whitespace.gvi"(string=w8) -> (trimmed string=w9)
  Match Pattern(regular expression="CMP", string=w5) -> (after substring=w10)
  Is Empty String Or Path(string/path=w10) -> w11
  case (w11) {
    frame False, Default {
      w12 = w10
    }
    frame True {
      Match Pattern(regular expression="iCC", string=w5) -> (after substring=w12)
    }
  }
  Match Pattern(regular expression=";", string=w12) -> (before substring=w13)
  call "Trim Whitespace.gvi"(string=w13) -> (trimmed string=w14)
  Match Pattern(regular expression="Handshower", string=w5) -> (after substring=w15)
  Match Pattern(regular expression="\n", string=w15) -> (after substring=w16)
  s2 = ""  # shift register
  s3 = string[] []  # shift register
  while (iteration -> i1) {
    case (i1) {
      frame 0 {
        Match Pattern(regular expression="\n", string=w16) -> (after substring=w17, before substring=w18)
      }
      frame 1, Default {
        Match Pattern(regular expression="\n", string=s2) -> (after substring=w17, before substring=w18)
      }
    }
    Insert Into Array(inArray=s3, new=w18) -> w19
    Is Empty String Or Path(string/path=w17) -> w20
    next s2 = w17
    next s3 = w19
    stop if w20
  }
  s4 = string[] []  # shift register
  for {
    w21 = each element of s3
    call "Trim Whitespace.gvi"(string=w21) -> (trimmed string=w22)
    String Length(string=w22) -> (length=w23)
    Is Less Or Equal(x=w23, y=1) -> w24
    case (w24) {
      frame True {
        w25 = s4
        w26 = FALSE
      }
      frame False {
        Match Pattern(regular expression="/", string=w22) -> (match substring=w27)
        case (w27) {
          frame "False", Default {
            w25 = s4
            w26 = FALSE
          }
          frame "/" {
            Insert Into Array(inArray=s4, new=w22) -> w25
            w26 = TRUE
          }
        }
      }
    }
    next s4 = w25
    stop if w26
  }
  Array Index(array=s4) -> (out0[0]=w28)
  Match Pattern(regular expression="/", string=w28) -> (after substring=w29, before substring=w30, match substring=w31)
  String Subset(length (rest)=9, string=w29) -> w32
  Reverse String(string=w30) -> (reversed=w33)
  String Subset(length (rest)=9, string=w33) -> w34
  Reverse String(string=w34) -> (reversed=w35)
  Concatenate Strings(w35, " ", w31, w32) -> w36
  Array Size(array=s1) -> (size(s)=w37)
  Decrement(x=w37) -> w38
  Array Subset(array=s1, index0=w38, length0=1) -> w39
  Array Index(array=w39) -> (out0[0]=w40)
  Match Pattern(regular expression="Handshower", string=w40) -> (after substring=w41)
  Match Pattern(regular expression="\n", string=w41) -> (after substring=w42)
  s5 = ""  # shift register
  s6 = string[] []  # shift register
  while (iteration -> i2) {
    case (i2) {
      frame 0 {
        Match Pattern(regular expression="\n", string=w42) -> (after substring=w43, before substring=w44)
      }
      frame 1, Default {
        Match Pattern(regular expression="\n", string=s5) -> (after substring=w43, before substring=w44)
      }
    }
    Insert Into Array(inArray=s6, new=w44) -> w45
    Is Empty String Or Path(string/path=w43) -> w46
    next s5 = w43
    next s6 = w45
    stop if w46
  }
  s7 = string[] []  # shift register
  for {
    w47 = each element of s6
    call "Trim Whitespace.gvi"(string=w47) -> (trimmed string=w48)
    String Length(string=w48) -> (length=w49)
    Is Less Or Equal(x=w49, y=1) -> w50
    case (w50) {
      frame True {
        w51 = s7
        w52 = FALSE
      }
      frame False {
        Match Pattern(regular expression="/", string=w48) -> (match substring=w53)
        case (w53) {
          frame "False", Default {
            w51 = s7
            w52 = FALSE
          }
          frame "/" {
            Insert Into Array(inArray=s7, new=w48) -> w51
            w52 = TRUE
          }
        }
      }
    }
    next s7 = w51
    stop if w52
  }
  Array Index(array=s7) -> (out0[0]=w54)
  Match Pattern(regular expression="/", string=w54) -> (after substring=w55, before substring=w56, match substring=w57)
  String Subset(length (rest)=9, string=w55) -> w58
  Reverse String(string=w56) -> (reversed=w59)
  String Subset(length (rest)=9, string=w59) -> w60
  Reverse String(string=w60) -> (reversed=w61)
  Concatenate Strings(w61, " ", w57, w58) -> w62
  Concatenate Strings("From ", w36, " till ", w62) -> w63
  Insert Into Array(inArray=string[] [], new=w14, new=w9, new=w63) -> w64
  for {
    w65 = each element of ["Device type", "Serial number", "Timeline (from/till)", ""]
    w66 = each element of w64
    w68 = cluster{"Entry": string, "Information": string} {all zero or empty}
    Property Node(instance in=w68, "Entry"=w65, "Information"=w66) -> (instance out=w69)
    append w69 to w67
  }
  $"Error Output" <- $"Error input"
  $"General information" <- w67
  $Device <- w14
  $"Serial number" <- w9
