vi "Specifications_txt.gviweb"   [G Web Development Software 22.3.0]
inputs:
  "Get all charge": string[]
  "Error input": error
outputs:
  "Error Output": error
  "General information": cluster{"Entry": string, "Information": string}[]
  "Device Type": string
uses:
  NI::G Core::Strings::Search and Replace Pattern.gvi
  NI::G Core::Strings::Trim Whitespace.gvi
diagram:
  s1 = string[] []  # shift register
  for {
    w1 = each element of $"Get all charge"
    Is Empty String Or Path(string/path=w1) -> w2
    case (w2) {
      frame True {
        w3 = s1
      }
      frame False {
        Insert Into Array(inArray=s1, new=w1) -> w3
      }
    }
    next s1 = w3
  }
  Array Subset(array=s1, index0=0, length0=1) -> w4
  for {
    w5 = each element of w4
    Match Pattern(regular expression="Dev-Typ", string=w5) -> (after substring=w6)
    Match Pattern(regular expression="<<", string=w6) -> (before substring=w7)
    call "Search and Replace Pattern.gvi"(string=w7, pattern=">>") -> (result string=w8)
    call "Trim Whitespace.gvi"(string=w8) -> (trimmed string=w9)
    case (w9) {
      frame "False", Default {
        w10 = w9
      }
      frame "623" {
        w10 = "XS Elektro"
      }
    }
    Match Pattern(regular expression="S/N", string=w5) -> (after substring=w11)
    Match Pattern(regular expression="<<", string=w11) -> (before substring=w12)
    call "Search and Replace Pattern.gvi"(string=w12, pattern=">>") -> (result string=w13)
    call "Trim Whitespace.gvi"(string=w13) -> (trimmed string=w14)
    Match Pattern(regular expression="Version", string=w5) -> (after substring=w15)
    Match Pattern(regular expression="<<", string=w15) -> (before substring=w16)
    call "Search and Replace Pattern.gvi"(string=w16, pattern=">>") -> (result string=w17)
    call "Trim Whitespace.gvi"(string=w17) -> (trimmed string=w18)
    Match Pattern(regular expression="Time", string=w5) -> (after substring=w19)
    Match Pattern(regular expression="<<", string=w19) -> (before substring=w20)
    call "Search and Replace Pattern.gvi"(string=w20, pattern=">>") -> (result string=w21)
    call "Trim Whitespace.gvi"(string=w21) -> (trimmed string=w22)
  }
  Array Size(array=s1) -> (size(s)=w23)
  Decrement(x=w23) -> w24
  Array Subset(array=s1, index0=w24, length0=1) -> w25
  for {
    w26 = each element of w25
    Match Pattern(regular expression="Version", string=w26) -> (after substring=w27)
    Match Pattern(regular expression="<<", string=w27) -> (before substring=w28)
    call "Search and Replace Pattern.gvi"(string=w28, pattern=">>") -> (result string=w29)
    call "Trim Whitespace.gvi"(string=w29) -> (trimmed string=w30)
    Match Pattern(regular expression="Time", string=w26) -> (after substring=w31)
    Match Pattern(regular expression="<<", string=w31) -> (before substring=w32)
    call "Search and Replace Pattern.gvi"(string=w32, pattern=">>") -> (result string=w33)
    call "Trim Whitespace.gvi"(string=w33) -> (trimmed string=w34)
  }
  Concatenate Strings(w18, " / ", w30) -> w35
  Concatenate Strings(w22, " / ", w34) -> w36
  Insert Into Array(inArray=string[] [], new=w10, new=w14, new=w35, new=w36) -> w37
  w38 = ["Device type", "Serial number", "Software versions (from/till)", "Timeline (from/till)"]
  for {
    w39 = each element of w38
    w40 = each element of w37
    w42 = cluster{"Entry": string, "Information": string} {all zero or empty}
    Property Node(instance in=w42, "Entry"=w39, "Information"=w40) -> (instance out=w43)
    append w43 to w41
  }
  $"Error Output" <- $"Error input"
  $"Device Type" <- w10
  $"General information" <- w41
