vi "Testen.gviweb"   [G Web Development Software 22.3.0]
panel controls:
  "Input all Parts": string[]
  "Error input": error
panel indicators:
  "Operating Mode": string[]
  "Output Error": error
  "Output_2": string[]
  "Output_3": string
  "size(s)": i32
uses:
  NI::G Core::Strings::Trim Whitespace.gvi
diagram:
  w1 = $"Error input"
  for {
    w2 = each element of $"Input all Parts"
    s1 = ""  # shift register
    s2 = string[] []  # shift register
    while (iteration -> i1) {
      case (i1) {
        frame 0 {
          Match Pattern(regular expression="\n", string=w2) -> (after substring=w4, before substring=w5)
        }
        frame 1, Default {
          Match Pattern(regular expression="\n", string=s1) -> (after substring=w4, before substring=w5)
        }
      }
      Insert Into Array(inArray=s2, new=w5) -> w6
      Is Empty String Or Path(string/path=w4) -> w7
      next s1 = w4
      next s2 = w6
      stop if w7
    }
    s3 = string[] []  # shift register
    for {
      w8 = each element of s2
      call "Trim Whitespace.gvi"(string=w8) -> (trimmed string=w9)
      String Length(string=w9) -> (length=w10)
      Is Less Or Equal(x=w10, y=1) -> w11
      case (w11) {
        frame True {
          w12 = s3
        }
        frame False {
          Match Pattern(regular expression=";", string=w9) -> (match substring=w13)
          case (w13) {
            frame "False", Default {
              w12 = s3
            }
            frame ";" {
              Match Pattern(regular expression="Mode", string=w9) -> (after substring=w14, match substring=w15)
              case (w15) {
                frame "False", Default {
                  w12 = s3
                }
                frame "Mode" {
                  Match Pattern(regular expression="/", string=w14) -> (before substring=w16)
                  call "Trim Whitespace.gvi"(string=w16) -> (trimmed string=w17)
                  Insert Into Array(inArray=s3, new=w17) -> w12
                }
              }
            }
          }
        }
      }
      next s3 = w12
    }
    Sort 1D Array(array=s3) -> (sorted array=w18)
    s4 = ""  # shift register
    s5 = uninitialised  # shift register
    for (iteration -> i2) {
      w19 = each element of w18
      case (i2) {
        frame Default {
          Is Equal(x=w19, y=s4) -> w22
          case (w22) {
            frame False, Default {
              Build Array(s5, w19) -> w21
              w20 = w19
            }
            frame True {
              Concatenate Strings(w19, "+") -> w23
              Build Array(s5, w23) -> w21
              w20 = s4
            }
          }
        }
        frame 0 {
          Build Array(w19) -> w21
          w20 = w19
        }
      }
      next s4 = w20
      next s5 = w21
    }
    s6 = s5  # shift register
    s7 = string[] []  # shift register
    for {
      w24 = each element of s3
      s8 = s7  # shift register
      for {
        w25 = each element of s6
        Is Equal(x=w24, y=w25) -> w27
        case (w27) {
          frame False, Default {
            w28 = s8
            w29 = w25
          }
          frame True {
            Concatenate Strings(w25, "=") -> w29
            Build Array(s8, w24) -> w28
          }
        }
        append w29 to w26
        next s8 = w28
      }
      next s6 = w26
      next s7 = s8
    }
    Array Size(array=s7) -> (size(s)=w30)
    Is Greater(x=w30, y=1) -> w31
    case (w31) {
      frame False, Default {
        for {
          w32 = each element of s7
          $Output_3 <- w32
        }
      }
      frame True {
        s9 = ""  # shift register
        for (iteration -> i3) {
          w33 = each element of s7
          case (i3) {
            frame 0 {
              Concatenate Strings("Mixed: ", w33) -> w34
            }
            frame 1, Default {
              Concatenate Strings(s9, "; ", w33) -> w34
            }
          }
          next s9 = w34
        }
        w32 = s9
      }
    }
    $Output_2 <- s7
    $"size(s)" <- w30
    append w32 to w3
  }
  $"Output Error" <- w1
  $"Operating Mode" <- w3
