vi "Time_String_To_Seconds.gviweb"   [G Web Development Software 22.3.0]
inputs:
  "Time String": string
  "Error in": error
outputs:
  "Time in Seconds": f64
  "Error out": error
uses:
  NI::G Core::Strings::Search and Replace Pattern.gvi
diagram:
  Scan From String(formatString="%<%H:%M:%S>T", inputString=$"Time String", default=1904-01-01T00:00:00Z) -> (out0=w1)
  Get Date And Time String(date format (0)="long", time stamp=w1, want seconds? (F)=TRUE) -> (time string=w2)
  Scan Value(format string="%3s", string=w2) -> (output string=w3, value=w4)
  Multiply(w4, 3600) -> w5
  Search Or Split String(offset=1, search string/char=":", string=w3) -> (match + rest of string=w6, substring before match=w7)
  call "Search and Replace Pattern.gvi"(string=w6, pattern=":") -> (result string=w8)
  Floating Point String To Number(string=w8) -> (number=w9)
  call "Search and Replace Pattern.gvi"(string=w7, pattern=":") -> (result string=w10)
  Floating Point String To Number(string=w10) -> (number=w11)
  Multiply(w11, 60) -> w12
  Add(w12, w9, w5) -> w13
  $"Time in Seconds" <- w13
  $"Error out" <- $"Error in"
