vi "iCombi-Pro.gviweb"   [G Web Development Software 22.3.0]
panel controls:
  "Analyse": bool  # Press the button “Analyse” and select a service report xml file.
  "icombi pro xml": i32 = 1
  "common_icombi_pro": T4[]
  "i Combi Pro txt": i32
  "Press the button to display details:": bool
  "Engine Link": string = "index.html"
  "Sort Process name": bool
  "Press the button to display the graphic of the two selected cleaning processes": bool
  "Default View": bool = TRUE
  "common_icombi_pro_2": T4[]
panel indicators:
  "common": T1[]
  "Graph Display": T2[]
  "Specifications": T3
  "URL-Grafik": string
  "Specifications:": T5[]
  "Details of the selected programme:": cluster{"Information": string, "Detail": string}[]
  "Programme details": T1[]
  "Graph Display_txt": T2[]
  "Curve": T2[]
  "General statistics:": cluster{"Process": string, "quantity": string}[]
  "Cleaning graphic:": cluster{"Element 1": f64[], "Element 2": f64[]}[]
  "Cleaning statistics:": T6[]
  "URL-cleaming_graphic": string
  "Max temperature (C°/°F):": f64
  "Average temperature (C°/°F):": f64
  "Please wait...": f64
  "Details of the programme:": cluster{"Information": string, "Detail": string}[]
  "Programme details_2": T1[]
  "Cleaning process table": T4[]
  "Graph Display multiple": cluster{"Element 1": f64[], "Element 2": f64[]}[]
  "same programme type ?": bool
  "banner": string
  "HACCP File Content:": string
types:
  T1 = cluster{"Mode/Event": string, "Cooking cabinet temp.": string, "Core probe Setpoint temp.": string, "Core sensor actual temp.": string, "Date and Time ⌚": string}
  T2 = cluster{"Element 1": timestamp[], "Element 2": f64[]}
  T3 = cluster{"Device type:": string, "Serial number:": string, "Software version:": string, "Start date:": string, "Charge number:": string, "Prozess-Typ:": string, "Cooking programme name:": string, "Energy consumption:": string}
  T4 = cluster{"Selected": bool, "Charge Nr.": string, "Process name": string, "Programme name": string, "Date and time ⌚": string, "Duration": string, "Status": string, "Average temp. (°C/°F)": string}
  T5 = cluster{"Information": string, "Details": string}
  T6 = cluster{"Cleaning name": string, "Standard cleaning": f64, "Eco cleaning": f64, "Aborted cleaning": f64}
  T7 = cluster{"selected": bool, "Charge Nr.": string, "Process name": string, "Programme name": string, "Date and time": string, "Duration": string, "Status": string, "Average temp.": string}
  T8 = cluster{"Device type:": string, "Serial number:": string, "Software version:": string, "Start date:": string, "Charge number:": string, "Prozess-Typ:": string, "Cooking programme name": string, "Energy consumption:": string}
uses:
  FileTasks::Read File Text.gvi
  WebApp::Check_File_Content_iCombi_Pro.gviweb
  WebApp::Read_XML_Part.gviweb
  WebApp::Specifications_haccp.gviweb
  WebApp::Get_All_Part_Txt.gviweb
  WebApp::Specifications_txt.gviweb
  WebApp::Add_Parts.gviweb
  WebApp::Measurements.gviweb
  WebApp::Measurements_Txt_iCombiPro.gviweb
  WebApp::Get_Cleaning_Processes.gviweb
  WebApp::Display_all_programm_in_graph.gviweb
  ControlExtensions::Data Grid - String Column - Create Background Color Style.gvi
  WebApp::Display_Details.gviweb
  WebApp::Sort_table.gviweb
  WebApp::Select_more_than_Cleaning_process.gviweb
diagram:
  w1 = "Init"  # State
  s1 = w1  # shift register
  s2 = ""  # shift register
  s3 = ""  # shift register
  s4 = ""  # shift register
  s5 = T8 {all zero or empty}  # shift register
  s6 = T7[] []  # shift register
  s7 = string[] []  # shift register
  s8 = ""  # shift register
  while {
    # s4: Energieverbrauch
    # s3: Start time & date
    # s6: General information txt
    # s5: Specifications
    # s2: Inhalt txt/XML
    # s7: Selected Charge nr
    case (s1) {
      frame "Init", Default {
        w11 = "Wait For Interaction"  # State
        Property Node(instance in=reference to "Please wait...", "Visible"=FALSE, error in=no error) -> (error out=w12, instance out=w13)
        Close Reference(error in=w12, reference=w13) -> (error out=w14)
        Property Node(instance in=reference to "common", "Visible"=FALSE, error in=w14) -> (error out=w15, instance out=w16)
        Close Reference(error in=w15, reference=w16) -> (error out=w17)
        Property Node(instance in=reference to "Specifications", "Visible"=FALSE, error in=w17) -> (error out=w18, instance out=w19)
        Close Reference(error in=w18, reference=w19) -> (error out=w20)
        Property Node(instance in=reference to "icombi pro xml", "Visible"=FALSE, error in=w20) -> (error out=w21, instance out=w22)
        Close Reference(error in=w21, reference=w22) -> (error out=w23)
        Property Node(instance in=reference to "i Combi Pro txt", "Visible"=TRUE, error in=w23) -> (error out=w24, instance out=w25)
        Close Reference(error in=w24, reference=w25) -> (error out=w26)
        Property Node(instance in=reference to "Press the button to display details:", "Disabled"=TRUE, error in=w26) -> (error out=w27, instance out=w28)
        Close Reference(error in=w27, reference=w28) -> (error out=w29)
        Property Node(instance in=reference to "Sort Process name", "Disabled"=TRUE, error in=w29) -> (error out=w30, instance out=w31)
        Close Reference(error in=w30, reference=w31) -> (error out=w32)
        Property Node(instance in=reference to "Default View", "Disabled"=TRUE, error in=w32) -> (error out=w33, instance out=w34)
        Close Reference(error in=w33, reference=w34) -> (error out=w2)
        $"URL-Grafik" <- "Rational_logo.jpg"
        $"URL-cleaming_graphic" <- "Legende_Cleaning_graphic.png"
        w3 = w11
        w4 = s2
        w5 = s3
        w6 = s4
        w7 = s5
        w8 = s6
        w9 = s7
        w10 = s8
      }
      frame "Read XML File" {
        call "Read File Text.gvi"(allowed file types=[".xml", ".txt"], error in=no error) -> (file content=w35, file name=w36, error out=w37)
        Match Pattern(regular expression=".xml", string=w36) -> (match substring=w38)
        call "Check_File_Content_iCombi_Pro.gviweb"(Inhalt Haccp=w35, file type=w38, Error input=w37) -> (HACCP File Content=w39, i Combi Pro ?=w40, Error Output=w41)
        case (w40) {
          frame False, Default {
            Property Node(instance in=reference to "Specifications:", "Value"=T5[] [], error in=w41) -> (error out=w42, instance out=w43)
            Close Reference(error in=w42, reference=w43) -> (error out=w44)
            Property Node(instance in=reference to "common_icombi_pro", "Value"=T4[] [], error in=w44) -> (error out=w45, instance out=w46)
            Close Reference(error in=w45, reference=w46) -> (error out=w2)
            w3 = "Wait For Interaction"
          }
          frame True {
            case (w38) {
              frame "False", Default {
                Match Pattern(regular expression=".txt", string=w36) -> (match substring=w47)
                case (w47) {
                  frame ".txt" {
                    w48 = "Specifications TXT"  # State
                    Property Node(instance in=reference to "i Combi Pro txt", "Visible"=TRUE, error in=w41) -> (error out=w49, instance out=w50)
                    Close Reference(error in=w49, reference=w50) -> (error out=w51)
                    Property Node(instance in=reference to "icombi pro xml", "Visible"=FALSE, error in=w51) -> (error out=w52, instance out=w53)
                    Close Reference(error in=w52, reference=w53) -> (error out=w54)
                    Property Node(instance in=reference to "Specifications:", "Value"=T5[] [], error in=w54) -> (error out=w55, instance out=w56)
                    Close Reference(error in=w55, reference=w56) -> (error out=w57)
                    Property Node(instance in=reference to "common_icombi_pro", "Value"=T4[] [], error in=w57) -> (error out=w58, instance out=w59)
                    Close Reference(error in=w58, reference=w59) -> (error out=w2)
                    w3 = w48
                  }
                  frame "False", Default {
                    w60 = "Wait For Interaction"  # State
                    w3 = w60
                    w2 = w41
                  }
                }
              }
              frame ".xml" {
                w61 = "Specifications XML"  # State
                Property Node(instance in=reference to "i Combi Pro txt", "Visible"=FALSE, error in=w41) -> (error out=w62, instance out=w63)
                Close Reference(error in=w62, reference=w63) -> (error out=w64)
                Property Node(instance in=reference to "icombi pro xml", "Visible"=TRUE, "ActiveTab"=0, "Value"=0, error in=w64) -> ("Tab"=w65, instance out=w66)
                Property Node(instance in=w65, "Visible"=TRUE) -> (error out=w67)
                Close Reference(error in=w67, reference=w66) -> (error out=w2)
                w3 = w61
              }
            }
          }
        }
        Concatenate Strings(w35, ";") -> w4
        $"HACCP File Content:" <- w39
        w5 = s3
        w6 = s4
        w7 = s5
        w8 = s6
        w9 = s7
        w10 = s8
      }
      frame "Specifications XML" {
        w68 = "Get Events from XML"  # State
        Property Node(instance in=reference to "Details of the programme:", "Visible"=FALSE, error in=no error) -> (error out=w69, instance out=w70)
        Close Reference(error in=w69, reference=w70) -> (error out=w71)
        Property Node(instance in=reference to "Programme details_2", "Visible"=FALSE, error in=w71) -> (error out=w72, instance out=w73)
        Close Reference(error in=w72, reference=w73) -> (error out=w74)
        call "Read_XML_Part.gviweb"(Input XML=s2, Start XML Part="<_1>", End XML Part="</_1>", Error in=w74) -> (Output XML array=w75, Error out=w76)
        call "Specifications_haccp.gviweb"(Output XML array=w75, Energy consumption:=s4, Error in=w76) -> (Specifications=w7, Unit temp.=w10, Start date=w5, Error out=w2)
        w3 = w68
        w4 = s2
        w6 = s4
        w8 = s6
        w9 = s7
      }
      frame "Specifications TXT" {
        call "Get_All_Part_Txt.gviweb"(Happ_file=s2, Error input=no error) -> (Get all charge=w77, Error Output=w78)
        Array Size(array=w77) -> (size(s)=w79)
        Is Greater(x=w79, y=1) -> w80
        case (w80) {
          frame False, Default {
            Property Node(instance in=reference to "Details of the programme:", "Visible"=TRUE, error in=w78) -> (error out=w81, instance out=w82)
            Close Reference(error in=w81, reference=w82) -> (error out=w83)
            Property Node(instance in=reference to "Programme details_2", "Visible"=TRUE, error in=w83) -> (error out=w84, instance out=w85)
            Close Reference(error in=w84, reference=w85) -> (error out=w86)
            Property Node(instance in=reference to "common", "Visible"=FALSE, error in=w86) -> (error out=w87, instance out=w88)
            Close Reference(error in=w87, reference=w88) -> (error out=w89)
            Property Node(instance in=reference to "Specifications", "Visible"=FALSE, error in=w89) -> (error out=w90, instance out=w91)
            Close Reference(error in=w90, reference=w91) -> (error out=w92)
            Property Node(instance in=reference to "icombi pro xml", "Visible"=TRUE, "ActiveTab"=0, "Value"=0, error in=w92) -> ("Tab"=w93, instance out=w94)
            Property Node(instance in=w93, "Visible"=TRUE) -> (error out=w95, instance out=w96)
            Close Reference(error in=w95, reference=w96) -> (error out=w97)
            Close Reference(error in=w97, reference=w94) -> (error out=w98)
            Property Node(instance in=reference to "i Combi Pro txt", "Visible"=FALSE, error in=w98) -> (error out=w99, instance out=w100)
            Close Reference(error in=w99, reference=w100) -> (error out=w2)
            w101 = "Get  Event from one TXT"  # State
            w3 = w101
          }
          frame True {
            w102 = "Get Events from TXT"  # State
            Property Node(instance in=reference to "common", "Visible"=FALSE, error in=w78) -> (error out=w103, instance out=w104)
            Close Reference(error in=w103, reference=w104) -> (error out=w105)
            Property Node(instance in=reference to "Specifications", "Visible"=FALSE, error in=w105) -> (error out=w106, instance out=w107)
            Close Reference(error in=w106, reference=w107) -> (error out=w108)
            Property Node(instance in=reference to "icombi pro xml", "Visible"=FALSE, error in=w108) -> (error out=w109, instance out=w110)
            Close Reference(error in=w109, reference=w110) -> (error out=w111)
            call "Specifications_txt.gviweb"(Get all charge=w77, Error input=w111) -> (General information=w112, Error Output=w2)
            $"Specifications:" <- w112
            w3 = w102
          }
        }
        w4 = s2
        w5 = s3
        w6 = s4
        w7 = s5
        w8 = s6
        w9 = s7
        w10 = s8
      }
      frame "Get Events from XML" {
        Property Node(instance in=reference to "common", "Visible"=TRUE, error in=no error) -> (error out=w113, instance out=w114)
        Close Reference(error in=w113, reference=w114) -> (error out=w115)
        Property Node(instance in=reference to "Specifications", "Visible"=TRUE, error in=w115) -> (error out=w116, instance out=w117)
        Close Reference(error in=w116, reference=w117) -> (error out=w118)
        call "Add_Parts.gviweb"(Imput XML=s2, Error input=w118) -> (Output all Parts=w119, Output=w120)
        call "Measurements.gviweb"(Output all Parts=w119, Start date and time=s3, Unit Temp=s8, Error input=w120) -> (average temp.=w121, max value=w122, General information=w123, Observed Data and Fitted Curve=w124, Energieverbrauch=w6, Output Error=w125)
        $common <- w123
        Property Node(instance in=s5, "Energy consumption:"=w6) -> (instance out=w7)
        $Specifications <- w7
        w126 = "Wait For Interaction"  # State
        Property Node(instance in=reference to "Please wait...", "Visible"=FALSE, error in=w125) -> (error out=w127, instance out=w128)
        Close Reference(error in=w127, reference=w128) -> (error out=w2)
        $"Graph Display" <- w124
        $"Max temperature (C°/°F):" <- w122
        $"Average temperature (C°/°F):" <- w121
        w3 = w126
        w4 = s2
        w5 = s3
        w8 = s6
        w9 = s7
        w10 = s8
      }
      frame "Get Events from TXT" {
        call "Get_All_Part_Txt.gviweb"(Happ_file=s2, Error input=no error) -> (Get all charge=w129, Error Output=w130)
        call "Measurements_Txt_iCombiPro.gviweb"(Get all charge=w129, Error in=w130) -> (Charge infos=w8, First charge=w131, Error out=w132)
        call "Get_Cleaning_Processes.gviweb"(Charge infos input=w8, Error in=w132) -> (Only cleaning=w133, First Process=w134, Error out=w135)
        Property Node(instance in=reference to "Please wait...", "Visible"=FALSE, error in=w135) -> (error out=w136, instance out=w137)
        Close Reference(error in=w136, reference=w137) -> (error out=w138)
        call "Display_all_programm_in_graph.gviweb"(Charge infos=w8, Error input=w138) -> (Error Output=w139, Curve=w140, Statistics=w141, Cleaning statistics=w142, Cleaning graphic=w143)
        $Curve <- w140
        w144 = "Wait For Interaction"  # State
        $"General statistics:" <- w141
        $"Cleaning statistics:" <- w142
        w145 = reference to "Press the button to display the graphic of the two selected cleaning processes"
        Concatenate Strings("Charge Nr: ", w131) -> w146
        Build Array(w146) -> w9
        Property Node(instance in=reference to "Press the button to display details:", "Text"=w9, error in=w139) -> (error out=w147, instance out=w148)
        Close Reference(error in=w147, reference=w148) -> (error out=w149)
        Concatenate Strings("Charge Nr: ", w134) -> w150
        Build Array(w150) -> w151
        Property Node(instance in=w145, "Text"=w151, error in=w149) -> (error out=w152, instance out=w153)
        Close Reference(error in=w152, reference=w153) -> (error out=w154)
        call "Data Grid - String Column - Create Background Color Style.gvi"(reference in=reference to "common_icombi_pro", column index=6, color=4294965402, error in=w154, match operator="contains", match text="aborted") -> (reference out=w155, error out=w156)
        Close Reference(error in=w156, reference=w155) -> (error out=w157)
        Property Node(instance in=reference to "Press the button to display details:", "Disabled"=FALSE, error in=w157) -> (error out=w158, instance out=w159)
        Close Reference(error in=w158, reference=w159) -> (error out=w160)
        Property Node(instance in=reference to "Sort Process name", "Disabled"=FALSE, error in=w160) -> (error out=w161, instance out=w162)
        Close Reference(error in=w161, reference=w162) -> (error out=w163)
        Property Node(instance in=reference to "Default View", "Disabled"=FALSE, error in=w163) -> (error out=w164, instance out=w165)
        Close Reference(error in=w164, reference=w165) -> (error out=w2)
        $"Cleaning graphic:" <- w143
        $"Cleaning process table" <- w133
        $common_icombi_pro_2 <- w8
        $common_icombi_pro <- w8
        w3 = w144
        w4 = s2
        w5 = s3
        w6 = s4
        w7 = s5
        w10 = s8
      }
      frame "Details of selected charge" {
        call "Get_All_Part_Txt.gviweb"(Happ_file=s2, Error input=no error) -> (Get all charge=w166, Error Output=w167)
        call "Display_Details.gviweb"(Get all charge=w166, Charge Name=s7, all in txt ?=TRUE, Error input=w167) -> (Details of the selected programme:=w168, Programme Details=w169, Curve=w170, Error Output=w2)
        $"Details of the selected programme:" <- w168
        w171 = "Wait For Interaction"  # State
        $"Programme details" <- w169
        $"Graph Display_txt" <- w170
        w3 = w171
        w4 = s2
        w5 = s3
        w6 = s4
        w7 = s5
        w8 = s6
        w9 = s7
        w10 = s8
      }
      frame "Details of multiple charges" {
        w172 = "Wait For Interaction"  # State
        call "Get_All_Part_Txt.gviweb"(Happ_file=s2, Error input=no error) -> (Get all charge=w173, Error Output=w174)
        Array Index(array=s7) -> (out0[0]=w175)
        Match Pattern(regular expression=";", string=w175) -> (after substring=w176, before substring=w177, match substring=w178)
        case (w178) {
          frame ";" {
            Build Array(w177) -> w180
            call "Display_Details.gviweb"(Get all charge=w173, Charge Name=w180, all in txt ?=TRUE, Error input=w174) -> (Curve double=w181, Error Output=w182)
            Concatenate Strings("Charge Nr:", w176) -> w183
            Build Array(w183) -> w184
            call "Display_Details.gviweb"(Get all charge=w173, Charge Name=w184, all in txt ?=TRUE, Error input=w182) -> (Curve double=w185, Error Output=w2)
            Insert Into Array(inArray=w181, new=w185) -> w179
          }
          frame "False", Default {
            call "Display_Details.gviweb"(Get all charge=w173, Charge Name=s7, all in txt ?=TRUE, Error input=w174) -> (Error Output=w2)
            w179 = default
          }
        }
        $"Graph Display multiple" <- w179
        w3 = w172
        w4 = s2
        w5 = s3
        w6 = s4
        w7 = s5
        w8 = s6
        w9 = s7
        w10 = s8
      }
      frame "Get  Event from one TXT" {
        call "Get_All_Part_Txt.gviweb"(Happ_file=s2, Error input=no error) -> (Get all charge=w186, Error Output=w187)
        call "Display_Details.gviweb"(Get all charge=w186, Charge Name=s7, all in txt ?=TRUE, Error input=w187) -> (Details of the selected programme:=w188, Programme Details=w189, Curve=w190, Error Output=w2, Average temp.=w191, max value=w192)
        $"Average temperature (C°/°F):" <- w191
        $"Max temperature (C°/°F):" <- w192
        $"Details of the programme:" <- w188
        $"Programme details_2" <- w189
        w193 = "Wait For Interaction"  # State
        $"Graph Display" <- w190
        w3 = w193
        w4 = s2
        w5 = s3
        w6 = s4
        w7 = s5
        w8 = s6
        w9 = s7
        w10 = s8
      }
      frame "Wait For Interaction" {
        Property Node(instance in=reference to "Please wait...", "Visible"=FALSE, error in=no error) -> (error out=w194, instance out=w195)
        Close Reference(error in=w194, reference=w195) -> (error out=w196)
        event {
          on "Analyse" Value changed {
            w197 = "Read XML File"  # State
            Property Node(instance in=reference to "Please wait...", "Visible"=TRUE, error in=w196) -> (error out=w198, instance out=w199)
            Close Reference(error in=w198, reference=w199) -> (error out=w2)
            w3 = w197
            w9 = s7
          }
          on "Sort Process name" Value changed {
            w200 = "Wait For Interaction"  # State
            Event Data() -> ("Old Value"=w201, "New Value"=w202)
            Not(x=w201) -> w203
            case (w202) {
              frame False, Default {
                Property Node(instance in=reference to "Sort Process name", "Text"=["Sort Process name ▼ "], error in=w196) -> (error out=w204, instance out=w205)
              }
              frame True {
                Property Node(instance in=reference to "Sort Process name", "Text"=["Sort Process name ▲"], error in=w196) -> (error out=w204, instance out=w205)
              }
            }
            Close Reference(error in=w204, reference=w205) -> (error out=w206)
            Property Node(instance in=reference to "Default View", "Value"=FALSE, error in=w206) -> (error out=w207)
            call "Sort_table.gviweb"(Sort Process name=w203, Imput infos=$common_icombi_pro, Error Cluster input=w207) -> (Output infos=w208, Error Output=w2)
            $common_icombi_pro <- w208
            w3 = w200
            w9 = s7
          }
          on "Default View" Value changed {
            w209 = "Wait For Interaction"  # State
            case ($"Default View") {
              frame False, Default {
                w2 = w196
              }
              frame True {
                $common_icombi_pro <- $common_icombi_pro_2
                Property Node(instance in=reference to "Sort Process name", "Text"=["Sort Process name"], "Value"=FALSE, error in=w196) -> (error out=w210, instance out=w211)
                Close Reference(error in=w210, reference=w211) -> (error out=w2)
              }
            }
            w3 = w209
            w9 = s7
          }
          on "common_icombi_pro" Value changed {
            w212 = "Wait For Interaction"  # State
            Event Data() -> ("Old Value"=w213, "New Value"=w214)
            for {
              w215 = each element of w213
              w216 = each element of w214
              Property Node(instance in=w215) -> ("Selected"=w218)
              case (w218) {
                frame False, Default {
                  Property Node(instance in=w216) -> ("Selected"=w219, "Charge Nr."=w220)
                  case (w219) {
                    frame False, Default {
                      w9 = s7
                    }
                    frame True {
                      Concatenate Strings("Charge Nr: ", w220) -> w221
                      Build Array(w221) -> w9
                      Property Node(instance in=reference to "Press the button to display details:", "Text"=w9) -> (error out=w222, instance out=w223)
                      Close Reference(error in=w222, reference=w223)
                    }
                  }
                }
                frame True {
                  Not(x=w218) -> w219
                  w9 = s7
                }
              }
              Property Node(instance in=w216, "Selected"=w219) -> (instance out=w224)
              append w224 to w217
            }
            $common_icombi_pro <- w217
            w2 = w196
            w3 = w212
          }
          on "Cleaning process table" Value changed {
            w225 = "Wait For Interaction"  # State
            Event Data() -> ("Old Value"=w226, "New Value"=w227)
            call "Select_more_than_Cleaning_process.gviweb"(Cleaning process old=w226, Cleaning process new=w227, Error input=w196) -> (Two selected charge=w228, Selected Charge Nr.=w229, same reciepe name=w230, Error Output=w231)
            $"same programme type ?" <- w230
            w232 = reference to "Press the button to display the graphic of the two selected cleaning processes"
            Concatenate Strings("Charge Nr: ", w229) -> w233
            Build Array(w233) -> w234
            Property Node(instance in=w232, "Text"=w234, error in=w231) -> (error out=w235, instance out=w236)
            Close Reference(error in=w235, reference=w236) -> (error out=w2)
            $"Cleaning process table" <- w228
            w3 = w225
            w9 = s7
          }
          on "Press the button to display details:" Value changed {
            Property Node(instance in=reference to "Press the button to display details:", error in=w196) -> ("Text"=w9, error out=w237)
            for {
              w238 = each element of w9
              case (w238) {
                frame "No charge is selected" {
                  w239 = "Please select a programme after opening a haccp file \nand click the button again to display the details!"
                  One Button Dialog(message=w239)
                  w2 = w237
                }
                frame "False", Default {
                  Property Node(instance in=reference to "i Combi Pro txt", "Value"=2, error in=w237) -> (error out=w240, instance out=w241)
                  Close Reference(error in=w240, reference=w241) -> (error out=w2)
                }
              }
            }
            w242 = "Details of selected charge"  # State
            w3 = w242
          }
          on "Press the button to display the graphic of the two selected cleaning processes" Value changed {
            w243 = "Details of multiple charges"  # State
            w244 = reference to "Press the button to display the graphic of the two selected cleaning processes"
            Property Node(instance in=w244, error in=w196) -> ("Text"=w9, error out=w245)
            case ($"same programme type ?") {
              frame False {
                w246 = "Please select two cleaning programmes of the same type and click on the button again to display the details!"
                One Button Dialog(message=w246)
                w2 = w245
              }
              frame True {
                Property Node(instance in=reference to "i Combi Pro txt", "Value"=5, error in=w245) -> (error out=w247, instance out=w248)
                Close Reference(error in=w247, reference=w248) -> (error out=w2)
              }
            }
            w3 = w243
          }
        }
        w4 = s2
        w5 = s3
        w6 = s4
        w7 = s5
        w8 = s6
        w10 = s8
      }
    }
    next s1 = w3
    next s2 = w4
    next s3 = w5
    next s4 = w6
    next s5 = w7
    next s6 = w8
    next s7 = w9
    next s8 = w10
    stop if FALSE
  }
