vi "iVario.gviweb"   [G Web Development Software 22.3.0]
panel controls:
  "Analyse": bool  # Press the button “Analyse” and select a service report xml file.
  "icombi pro xml": i32 = 1
  "common_iVario": T2[]
  "i Combi Pro txt": i32
  "Press the button to display details:": bool
  "Engine Link": string = "index.html"
  "Sort operating mode": bool
  "Default View": bool = TRUE
  "common_iVario_Defalut": T2[]
panel indicators:
  "Graph Display": T1[]
  "URL-Grafik": string
  "Specifications:": T3[]
  "Details of the selected programme:": cluster{"Information": string, "Detail": string}[]
  "Programme details": T4[]
  "Graph Display_txt": T1[]
  "Curve": T1[]
  "General statistics:": T5[]
  "Max temperature (C°/°F):": f64
  "Average temperature (C°/°F):": f64
  "Please wait...": f64
  "Details of the programme:": cluster{"Information": string, "Detail": string}[]
  "Programme details_2": T4[]
  "banner": string
  "Device Type": string
  "HACCP File Content:": string
  "common_icombi_pro": T6[]
  "Specifications:_2": T3[]
  "Specifications:": T7
  "common": T8[]
  "Temp Einheit": string
types:
  T1 = cluster{"Element 1": timestamp[], "Element 2": f64[]}
  T2 = cluster{"Selected": bool, "Charge Nr.": string, "Operating mode": string, "Programme name": string, "Date and time ⌚": string, "Duration": string, "Status": string, "Average temp. (°C/°F)": string, "Device side": string, "Active heating elements": string, "iZC active ?": string}
  T3 = cluster{"Information": string, "Details": string}
  T4 = cluster{"Mode/Event": string, "Cooking cabinet temp.": string, "Core probe Setpoint temp.": string, "Core sensor actual temp.": string, "Date and Time ⌚": string}
  T5 = cluster{"Operating mode": string, "Quantity": string}
  T6 = cluster{"Selected": bool, "Charge Nr.": string, "Process name": string, "Programme name": string, "Date and time ⌚": string, "Duration": string, "Status": string, "Average temp. (°C/°F)": string}
  T7 = cluster{"Device type:": string, "Device side:": string, "Serial number:": string, "Software version:": string, "Start date:": string, "Charge number:": string, "Prozess-Typ:": string, "Cooking programme name:": string, "Energy consumption:": string}
  T8 = cluster{"Mode/Event": string, "Cooking cabinet temp.": string, "Core probe Setpoint temp.": string, "Core sensor actual temp.": string, "Used heating elements": string, "Date and Time ⌚": string}
  T9 = cluster{"selected": bool, "Charge Nr.": string, "Process name": string, "Programme name": string, "Date and time": string, "Duration": string, "Status": string, "Average temp.": string, "Device side": string, "HE actives": string, "iZC Aktive ?": string}
uses:
  FileTasks::Read File Text.gvi
  WebApp::Check_Content_File_iVario.gviweb
  WebApp::Read_XML_Part.gviweb
  WebApp::Specifications_haccp_iVario.gviweb
  WebApp::Get_All_Part_Txt.gviweb
  WebApp::Specifications_txt.gviweb
  WebApp::Add_Parts.gviweb
  WebApp::Measurements_iVario.gviweb
  WebApp::Measurements_Txt_iVario.gviweb
  WebApp::Dispaly_All_Programm_im_Graph_iVario.gviweb
  ControlExtensions::Data Grid - String Column - Create Background Color Style.gvi
  WebApp::Display_Details_iVario.gviweb
  WebApp::Display_Details.gviweb
  WebApp::Sort_table_iVario.gviweb
diagram:
  w1 = "Init"  # State
  s1 = w1  # shift register
  s2 = ""  # shift register
  s3 = ""  # shift register
  s4 = ""  # shift register
  s5 = T7 {all zero or empty}  # shift register
  s6 = T9[] []  # shift register
  s7 = string[] []  # shift register
  s8 = ""  # shift register
  while {
    # s4: Energieverbrauch
    # s3: Start time & date
    # s6: General information txt
    # s5: Specifications
    # s2: Inhalt txt/XML
    # s7: Selected Charge nr
    case (s1) {
      frame "Init", Default {
        w11 = "Wait For Interaction"  # State
        Property Node(instance in=reference to "Please wait...", "Visible"=FALSE, error in=no error) -> (error out=w12, instance out=w13)
        Close Reference(error in=w12, reference=w13) -> (error out=w14)
        Property Node(instance in=reference to "common", "Visible"=FALSE, error in=w14) -> (error out=w15, instance out=w16)
        Close Reference(error in=w15, reference=w16) -> (error out=w17)
        Property Node(instance in=reference to "Specifications:", "Visible"=FALSE, error in=w17) -> (error out=w18, instance out=w19)
        Close Reference(error in=w18, reference=w19) -> (error out=w20)
        Property Node(instance in=reference to "icombi pro xml", "Visible"=FALSE, error in=w20) -> (error out=w21, instance out=w22)
        Close Reference(error in=w21, reference=w22) -> (error out=w23)
        Property Node(instance in=reference to "i Combi Pro txt", "Visible"=TRUE, error in=w23) -> (error out=w24, instance out=w25)
        Close Reference(error in=w24, reference=w25) -> (error out=w26)
        Property Node(instance in=reference to "Press the button to display details:", "Disabled"=TRUE, error in=w26) -> (error out=w27, instance out=w28)
        Close Reference(error in=w27, reference=w28) -> (error out=w29)
        Property Node(instance in=reference to "Sort operating mode", "Disabled"=TRUE, error in=w29) -> (error out=w30, instance out=w31)
        Close Reference(error in=w30, reference=w31) -> (error out=w32)
        Property Node(instance in=reference to "Default View", "Disabled"=TRUE, error in=w32) -> (error out=w33, instance out=w34)
        Close Reference(error in=w33, reference=w34) -> (error out=w2)
        $"URL-Grafik" <- "Rational_logo.jpg"
        w3 = w11
        w4 = s2
        w5 = s3
        w6 = s4
        w7 = s5
        w8 = s6
        w9 = s7
        w10 = s8
      }
      frame "Read XML File" {
        call "Read File Text.gvi"(allowed file types=[".xml", ".txt"], error in=no error) -> (file content=w35, file name=w36, error out=w37)
        Concatenate Strings(w35, ";") -> w4
        Match Pattern(regular expression=".xml", string=w36) -> (match substring=w38)
        call "Check_Content_File_iVario.gviweb"(Inhalt Haccp=w35, file type xml=w38, file type_txt=w36, Error input=w37) -> (HACCP File Content=w39, i Combi Pro ?=w40, Error Output=w41)
        case (w40) {
          frame False, Default {
            Property Node(instance in=reference to "Specifications:", "Value"=T3[] [], error in=w41) -> (error out=w42, instance out=w43)
            Close Reference(error in=w42, reference=w43) -> (error out=w44)
            Property Node(instance in=reference to "common_iVario", "Value"=T2[] [], error in=w44) -> (error out=w45, instance out=w46)
            Close Reference(error in=w45, reference=w46) -> (error out=w2)
            w3 = "Wait For Interaction"
          }
          frame True {
            case (w38) {
              frame "False", Default {
                Match Pattern(regular expression=".txt", string=w36) -> (match substring=w47)
                case (w47) {
                  frame ".txt" {
                    w48 = "Specifications TXT"  # State
                    Property Node(instance in=reference to "i Combi Pro txt", "Visible"=TRUE, error in=w41) -> (error out=w49, instance out=w50)
                    Close Reference(error in=w49, reference=w50) -> (error out=w51)
                    Property Node(instance in=reference to "icombi pro xml", "Visible"=FALSE, error in=w51) -> (error out=w52, instance out=w53)
                    Close Reference(error in=w52, reference=w53) -> (error out=w54)
                    Property Node(instance in=reference to "Specifications:", "Value"=T3[] [], error in=w54) -> (error out=w55, instance out=w56)
                    Close Reference(error in=w55, reference=w56) -> (error out=w57)
                    Property Node(instance in=reference to "common_iVario", "Value"=T2[] [], error in=w57) -> (error out=w58, instance out=w59)
                    Close Reference(error in=w58, reference=w59) -> (error out=w2)
                    w3 = w48
                  }
                  frame "False", Default {
                    w60 = "Wait For Interaction"  # State
                    w3 = w60
                    w2 = w41
                  }
                }
              }
              frame ".xml" {
                w61 = "Specifications XML"  # State
                Property Node(instance in=reference to "i Combi Pro txt", "Visible"=FALSE, error in=w41) -> (error out=w62, instance out=w63)
                Close Reference(error in=w62, reference=w63) -> (error out=w64)
                Property Node(instance in=reference to "icombi pro xml", "Visible"=TRUE, "ActiveTab"=0, "Value"=0, error in=w64) -> ("Tab"=w65, instance out=w66)
                Property Node(instance in=w65, "Visible"=TRUE) -> (error out=w67)
                Close Reference(error in=w67, reference=w66) -> (error out=w2)
                w3 = w61
              }
            }
          }
        }
        $"HACCP File Content:" <- w39
        w5 = s3
        w6 = s4
        w7 = s5
        w8 = s6
        w9 = s7
        w10 = s8
      }
      frame "Specifications XML" {
        w68 = "Get Events from XML"  # State
        Property Node(instance in=reference to "Details of the programme:", "Visible"=FALSE, error in=no error) -> (error out=w69, instance out=w70)
        Close Reference(error in=w69, reference=w70) -> (error out=w71)
        Property Node(instance in=reference to "Programme details_2", "Visible"=FALSE, error in=w71) -> (error out=w72, instance out=w73)
        Close Reference(error in=w72, reference=w73) -> (error out=w74)
        call "Read_XML_Part.gviweb"(Input XML=s2, Start XML Part="<_1>", End XML Part="</_1>", Error in=w74) -> (Output XML array=w75, Error out=w76)
        call "Specifications_haccp_iVario.gviweb"(Output XML array=w75, Energy consumption:=s4, Error in=w76) -> (Spezifications=w7, Temp Einheit=w77, Software version=w10, Start date=w5, Error out=w2)
        $"Temp Einheit" <- w77
        w3 = w68
        w4 = s2
        w6 = s4
        w8 = s6
        w9 = s7
      }
      frame "Specifications TXT" {
        call "Get_All_Part_Txt.gviweb"(Happ_file=s2, Error input=no error) -> (Get all charge=w78, Error Output=w79)
        Array Size(array=w78) -> (size(s)=w80)
        Is Greater(x=w80, y=1) -> w81
        case (w81) {
          frame False, Default {
            Property Node(instance in=reference to "Details of the programme:", "Visible"=TRUE, error in=w79) -> (error out=w82, instance out=w83)
            Close Reference(error in=w82, reference=w83) -> (error out=w84)
            Property Node(instance in=reference to "Programme details_2", "Visible"=TRUE, error in=w84) -> (error out=w85, instance out=w86)
            Close Reference(error in=w85, reference=w86) -> (error out=w87)
            Property Node(instance in=reference to "common", "Visible"=FALSE, error in=w87) -> (error out=w88, instance out=w89)
            Close Reference(error in=w88, reference=w89) -> (error out=w90)
            Property Node(instance in=reference to "Specifications:", "Visible"=FALSE, error in=w90) -> (error out=w91, instance out=w92)
            Close Reference(error in=w91, reference=w92) -> (error out=w93)
            Property Node(instance in=reference to "icombi pro xml", "Visible"=TRUE, "ActiveTab"=0, "Value"=0, error in=w93) -> ("Tab"=w94, instance out=w95)
            Property Node(instance in=w94, "Visible"=TRUE) -> (error out=w96, instance out=w97)
            Close Reference(error in=w96, reference=w97) -> (error out=w98)
            Close Reference(error in=w98, reference=w95) -> (error out=w99)
            Property Node(instance in=reference to "i Combi Pro txt", "Visible"=FALSE, error in=w99) -> (error out=w100, instance out=w101)
            Close Reference(error in=w100, reference=w101) -> (error out=w2)
            w102 = "Get  Event from one TXT"  # State
            w3 = w102
          }
          frame True {
            w103 = "Get Events from TXT"  # State
            Property Node(instance in=reference to "common", "Visible"=FALSE, error in=w79) -> (error out=w104, instance out=w105)
            Close Reference(error in=w104, reference=w105) -> (error out=w106)
            Property Node(instance in=reference to "Specifications:", "Visible"=FALSE, error in=w106) -> (error out=w107, instance out=w108)
            Close Reference(error in=w107, reference=w108) -> (error out=w109)
            Property Node(instance in=reference to "icombi pro xml", "Visible"=FALSE, error in=w109) -> (error out=w110, instance out=w111)
            Close Reference(error in=w110, reference=w111) -> (error out=w112)
            call "Specifications_txt.gviweb"(Get all charge=w78, Error input=w112) -> (General information=w113, Device Type=w114, Error Output=w2)
            $"Specifications:" <- w113
            $"Device Type" <- w114
            w3 = w103
          }
        }
        w4 = s2
        w5 = s3
        w6 = s4
        w7 = s5
        w8 = s6
        w9 = s7
        w10 = s8
      }
      frame "Get Events from XML" {
        Property Node(instance in=reference to "common", "Visible"=TRUE, error in=no error) -> (error out=w115, instance out=w116)
        Close Reference(error in=w115, reference=w116) -> (error out=w117)
        Property Node(instance in=reference to "Specifications:", "Visible"=TRUE, error in=w117) -> (error out=w118, instance out=w119)
        Close Reference(error in=w118, reference=w119) -> (error out=w120)
        call "Add_Parts.gviweb"(Imput XML=s2, Error input=w120) -> (Output all Parts=w121, Output=w122)
        call "Measurements_iVario.gviweb"(Output all Parts=w121, Start date and time=s3, Temp Einheit=$"Temp Einheit", Error input=w122) -> (average temp.=w123, max value=w124, General information=w125, Observed Data and Fitted Curve=w126, Energieverbrauch=w6, Output Error=w127)
        $common <- w125
        w128 = "Wait For Interaction"  # State
        Property Node(instance in=reference to "Please wait...", "Visible"=FALSE, error in=w127) -> (error out=w129, instance out=w130)
        Close Reference(error in=w129, reference=w130) -> (error out=w2)
        $"Graph Display" <- w126
        $"Max temperature (C°/°F):" <- w124
        $"Average temperature (C°/°F):" <- w123
        Property Node(instance in=s5, "Energy consumption:"=w6) -> (instance out=w7)
        $"Specifications:" <- w7
        w3 = w128
        w4 = s2
        w5 = s3
        w8 = s6
        w9 = s7
        w10 = s8
      }
      frame "Get Events from TXT" {
        call "Get_All_Part_Txt.gviweb"(Happ_file=s2, Error input=no error) -> (Get all charge=w131, Error Output=w132)
        call "Measurements_Txt_iVario.gviweb"(Get all charge=w131, Device type=$"Device Type", Error in=w132) -> (Charge infos=w8, First charge=w133, Error out=w134)
        $common_iVario <- w8
        Property Node(instance in=reference to "Please wait...", "Visible"=FALSE, error in=w134) -> (error out=w135, instance out=w136)
        Close Reference(error in=w135, reference=w136) -> (error out=w137)
        call "Dispaly_All_Programm_im_Graph_iVario.gviweb"(common_iVario=w8, Error input=w137) -> (Curve=w138, Statistics=w139, Output Error=w140)
        $Curve <- w138
        w141 = "Wait For Interaction"  # State
        Concatenate Strings("Charge Nr: ", w133) -> w142
        Build Array(w142) -> w9
        Property Node(instance in=reference to "Press the button to display details:", "Text"=w9, error in=w140) -> (error out=w143, instance out=w144)
        Close Reference(error in=w143, reference=w144) -> (error out=w145)
        call "Data Grid - String Column - Create Background Color Style.gvi"(reference in=reference to "common_iVario", column index=6, color=4294965402, error in=w145, match operator="contains", match text="aborted") -> (reference out=w146, error out=w147)
        Close Reference(error in=w147, reference=w146) -> (error out=w148)
        Property Node(instance in=reference to "Press the button to display details:", "Disabled"=FALSE, error in=w148) -> (error out=w149, instance out=w150)
        Close Reference(error in=w149, reference=w150) -> (error out=w151)
        Property Node(instance in=reference to "Sort operating mode", "Disabled"=FALSE, error in=w151) -> (error out=w152, instance out=w153)
        Close Reference(error in=w152, reference=w153) -> (error out=w154)
        Property Node(instance in=reference to "Default View", "Disabled"=FALSE, error in=w154) -> (error out=w155, instance out=w156)
        Close Reference(error in=w155, reference=w156) -> (error out=w2)
        $"General statistics:" <- w139
        $common_iVario_Defalut <- w8
        w3 = w141
        w4 = s2
        w5 = s3
        w6 = s4
        w7 = s5
        w10 = s8
      }
      frame "Details of selected charge" {
        call "Get_All_Part_Txt.gviweb"(Happ_file=s2, Error input=no error) -> (Get all charge=w157, Error Output=w158)
        call "Display_Details_iVario.gviweb"(Get all charge=w157, Charge Name=s7, all in txt ?=TRUE, Error input=w158) -> (Details of the selected programme:=w159, Programme Details=w160, Curve=w161, Error Output=w2)
        $"Details of the selected programme:" <- w159
        w162 = "Wait For Interaction"  # State
        $"Programme details" <- w160
        $"Graph Display_txt" <- w161
        w3 = w162
        w4 = s2
        w5 = s3
        w6 = s4
        w7 = s5
        w8 = s6
        w9 = s7
        w10 = s8
      }
      frame "Get  Event from one TXT" {
        call "Get_All_Part_Txt.gviweb"(Happ_file=s2, Error input=no error) -> (Get all charge=w163, Error Output=w164)
        call "Display_Details.gviweb"(Get all charge=w163, Charge Name=s7, all in txt ?=TRUE, Error input=w164) -> (Details of the selected programme:=w165, Programme Details=w166, Curve=w167, Error Output=w2, Average temp.=w168, max value=w169)
        $"Average temperature (C°/°F):" <- w168
        $"Max temperature (C°/°F):" <- w169
        $"Details of the programme:" <- w165
        $"Programme details_2" <- w166
        w170 = "Wait For Interaction"  # State
        $"Graph Display" <- w167
        w3 = w170
        w4 = s2
        w5 = s3
        w6 = s4
        w7 = s5
        w8 = s6
        w9 = s7
        w10 = s8
      }
      frame "Wait For Interaction" {
        Property Node(instance in=reference to "Please wait...", "Visible"=FALSE, error in=no error) -> (error out=w171, instance out=w172)
        Close Reference(error in=w171, reference=w172) -> (error out=w173)
        event {
          on "Analyse" Value changed {
            w174 = "Read XML File"  # State
            Property Node(instance in=reference to "Please wait...", "Visible"=TRUE, error in=w173) -> (error out=w175, instance out=w176)
            Close Reference(error in=w175, reference=w176) -> (error out=w2)
            w3 = w174
            w9 = s7
          }
          on "Sort operating mode" Value changed {
            w177 = "Wait For Interaction"  # State
            Event Data() -> ("Old Value"=w178, "New Value"=w179)
            Not(x=w178) -> w180
            case (w179) {
              frame False, Default {
                Property Node(instance in=reference to "Sort operating mode", "Text"=["Sort operating mode ▼ "], error in=w173) -> (error out=w181, instance out=w182)
              }
              frame True {
                Property Node(instance in=reference to "Sort operating mode", "Text"=["Sort operating mode ▲"], error in=w173) -> (error out=w181, instance out=w182)
              }
            }
            Close Reference(error in=w181, reference=w182) -> (error out=w183)
            Property Node(instance in=reference to "Default View", "Value"=FALSE, error in=w183) -> (error out=w184, instance out=w185)
            Close Reference(error in=w184, reference=w185) -> (error out=w186)
            call "Sort_table_iVario.gviweb"(Sort Process name=w180, common_iVario=$common_iVario, Error Cluster input=w186) -> (Output Common=w187, Error Output=w2)
            $common_iVario <- w187
            w3 = w177
            w9 = s7
          }
          on "Default View" Value changed {
            case ($"Default View") {
              frame False, Default {
                w2 = w173
              }
              frame True {
                $common_iVario <- $common_iVario_Defalut
                Property Node(instance in=reference to "Sort operating mode", "Value"=FALSE, "Text"=["Sort Operation mode"]) -> (error out=w188, instance out=w189)
                Close Reference(error in=w188, reference=w189) -> (error out=w2)
              }
            }
            w190 = "Wait For Interaction"  # State
            w3 = w190
            w9 = s7
          }
          on "common_iVario" Value changed {
            w191 = "Wait For Interaction"  # State
            Event Data() -> ("Old Value"=w192, "New Value"=w193)
            for {
              w194 = each element of w192
              w195 = each element of w193
              Property Node(instance in=w194) -> ("Selected"=w197)
              case (w197) {
                frame False, Default {
                  Property Node(instance in=w195) -> ("Selected"=w198, "Charge Nr."=w199)
                  case (w198) {
                    frame False, Default {
                      w9 = s7
                    }
                    frame True {
                      Concatenate Strings("Charge Nr: ", w199) -> w200
                      Build Array(w200) -> w9
                      Property Node(instance in=reference to "Press the button to display details:", "Text"=w9) -> (error out=w201, instance out=w202)
                      Close Reference(error in=w201, reference=w202)
                    }
                  }
                }
                frame True {
                  Not(x=w197) -> w198
                  w9 = s7
                }
              }
              Property Node(instance in=w195, "Selected"=w198) -> (instance out=w203)
              append w203 to w196
            }
            $common_iVario <- w196
            w2 = w173
            w3 = w191
          }
          on "Press the button to display details:" Value changed {
            Property Node(instance in=reference to "Press the button to display details:", error in=w173) -> ("Text"=w9, error out=w204)
            for {
              w205 = each element of w9
              case (w205) {
                frame "No charge is selected" {
                  w206 = "Please select a programme after opening a haccp file \nand click the button again to display the details!"
                  One Button Dialog(message=w206)
                  w2 = w204
                }
                frame "False", Default {
                  Property Node(instance in=reference to "i Combi Pro txt", "Value"=2, error in=w204) -> (error out=w207, instance out=w208)
                  Close Reference(error in=w207, reference=w208) -> (error out=w2)
                }
              }
            }
            w209 = "Details of selected charge"  # State
            w3 = w209
          }
        }
        w4 = s2
        w5 = s3
        w6 = s4
        w7 = s5
        w8 = s6
        w10 = s8
      }
    }
    next s1 = w3
    next s2 = w4
    next s3 = w5
    next s4 = w6
    next s5 = w7
    next s6 = w8
    next s7 = w9
    next s8 = w10
    stop if FALSE
  }
