vi "iVario_XML.gviweb"   [G Web Development Software 22.3.0]
panel controls:
  "Analyse": bool  # Press the button “Analyse” and select a service report xml file.
  "Tab": i32
panel indicators:
  "common": T1[]
  "Graph Display": T2[]
  "URL-Grafik": string
  "Specifications": T3
  "common_2": T1[]
  "Graph Display_2": T2[]
  "Specifications_2": T3
types:
  T1 = cluster{"Mode/Event": string, "Cooking cabinet temp.(°C)": string, "Core probe Setpoint temp.(°C)": string, "Core sensor actual temp.(°C)": string, "Used heating elements": string, "Date and Time": string}
  T2 = cluster{"Element 1": timestamp[], "Element 2": f64[]}
  T3 = cluster{"Device type:": string, "Device side:": string, "Serial number:": string, "Software version:": string, "Start date:": string, "Charge number:": string, "Prozess-Typ:": string, "Cooking programme name:": string, "Energy consumption:": string}
uses:
  FileTasks::Read File Text.gvi
  WebApp::Read_XML_Part.gviweb
  WebApp::Specifications_haccp_iVario.gviweb
  WebApp::Add_Parts.gviweb
  WebApp::Measurements_iVario.gviweb
diagram:
  w1 = "Init"  # State
  s1 = w1  # shift register
  s2 = ""  # shift register
  s3 = ""  # shift register
  s4 = ""  # shift register
  s5 = T3 {all zero or empty}  # shift register
  while {
    # s4: Energieverbrauch
    # s3: Start time & date
    # s5: Specifications
    case (s1) {
      frame "Init", Default {
        w8 = "Wait For Interaction"  # State
        $"URL-Grafik" <- "rat.JPG"
        $common <- T1[] []
        w2 = no error
        w3 = w8
        w4 = s2
        w5 = s3
        w6 = s4
        w7 = s5
      }
      frame "Read XML File" {
        call "Read File Text.gvi"(allowed file types=[".xml", ".txt"], error in=no error) -> (file content=w4, file name=w9, error out=w2)
        Match Pattern(regular expression=".xml", string=w9) -> (match substring=w10)
        case (w10) {
          frame "False", Default {
            Match Pattern(regular expression=".txt", string=w9) -> (match substring=w11)
            case (w11) {
              frame ".txt" {
                w12 = "Specifications TXT"  # State
                w3 = w12
              }
              frame "False", Default {
                w13 = "Wait For Interaction"  # State
                w3 = w13
              }
            }
          }
          frame ".xml" {
            w14 = "Specifications XML"  # State
            w3 = w14
          }
        }
        w5 = s3
        w6 = s4
        w7 = s5
      }
      frame "Specifications XML" {
        w15 = "Get Events from XML"  # State
        call "Read_XML_Part.gviweb"(Input XML=s2, Start XML Part="<_1>", End XML Part="</_1>", Error in=no error) -> (Output XML array=w16, Error out=w17)
        call "Specifications_haccp_iVario.gviweb"(Output XML array=w16, Energy consumption:=s4, Error in=w17) -> (Spezifications=w7, Start date=w5, Error out=w2)
        w3 = w15
        w4 = s2
        w6 = s4
      }
      frame "Specifications TXT" {
        w18 = "Get Events from TXT"  # State
        call "Read_XML_Part.gviweb"(Input XML=s2, Start XML Part="<_1>", End XML Part="</_1>", Error in=no error) -> (Output XML array=w19, Error out=w20)
        call "Specifications_haccp_iVario.gviweb"(Output XML array=w19, Energy consumption:=s4, Error in=w20) -> (Spezifications=w7, Start date=w5, Error out=w2)
        w3 = w18
        w4 = s2
        w6 = s4
      }
      frame "Get Events from XML" {
        w21 = "Wait For Interaction"  # State
        call "Add_Parts.gviweb"(Imput XML=s2, Error input=no error) -> (Output all Parts=w22, Output=w23)
        call "Measurements_iVario.gviweb"(Output all Parts=w22, Start date and time=s3, Error input=w23) -> (General information=w24, Observed Data and Fitted Curve=w25, Energieverbrauch=w6, Output Error=w2)
        $common <- w24
        $"Graph Display" <- w25
        Property Node(instance in=s5, "Energy consumption:"=w6) -> (instance out=w7)
        $Specifications <- w7
        w3 = w21
        w4 = s2
        w5 = s3
      }
      frame "Get Events from TXT" {
        w26 = "Wait For Interaction"  # State
        call "Add_Parts.gviweb"(Imput XML=s2, Error input=no error) -> (Output all Parts=w27, Output=w28)
        call "Measurements_iVario.gviweb"(Output all Parts=w27, Start date and time=s3, Error input=w28) -> (General information=w29, Observed Data and Fitted Curve=w30, Energieverbrauch=w6, Output Error=w2)
        $common_2 <- w29
        $"Graph Display_2" <- w30
        Property Node(instance in=s5, "Energy consumption:"=w6) -> (instance out=w7)
        $Specifications_2 <- w7
        w3 = w26
        w4 = s2
        w5 = s3
      }
      frame "Wait For Interaction" {
        event {
          on "Analyse" Value changed {
            w31 = "Read XML File"  # State
            w2 = no error
            w3 = w31
          }
        }
        w4 = s2
        w5 = s3
        w6 = s4
        w7 = s5
      }
    }
    next s1 = w3
    next s2 = w4
    next s3 = w5
    next s4 = w6
    next s5 = w7
    stop if FALSE
  }
